# Dynamo graph 03-06-00_Primer_sample_DeskPlacement.dyn "primer_sample_DeskPlacement" (Dynamo 2.0.2.6826)

# group: Translate window location points to the right plane
categories = Categories(index=619)
all_elements_of_category = ElementsOfCategory(Category=categories)
getLocation = Element.GetLocation(element=all_elements_of_category)
X = Point.X(point=getLocation)
Y = Point.Y(point=getLocation)
byCoordinates = Point.ByCoordinates(x=X, y=Y)

# group: Get room boundaries as polygons
categories_2 = Categories(index=425)
all_elements_of_category_2 = ElementsOfCategory(Category=categories_2)
area = Room.Area(room=all_elements_of_category_2)
code_block = CodeBlock { 0; }
le = area <= code_block
filterByBoolMask = List.FilterByBoolMask(list=all_elements_of_category_2, mask=le)
coreBoundary = Room.CoreBoundary(room=filterByBoolMask.out)
buildPolygons = GraphicalDynamo.Geometry.Curves.BuildPolygons(lines=coreBoundary)
flatten = List.Flatten(list=buildPolygons.polygons)

# group: Translate points to wall internal side
getHost = FamilyInstance.GetHost(familyInstance=all_elements_of_category)
getLocation_2 = Element.GetLocation(element=getHost)
direction = Line.Direction(line=getLocation_2)
code_block_2 = CodeBlock { DesignScript.Vector.ZAxis(); 90; }
rotate = Vector.Rotate(vector=direction, axis=code_block_2.out0, degrees=code_block_2.out1)
elementType = Element.ElementType(element=getHost)
code_block_3 = CodeBlock { "Width"; }
getParameterValueByName = Element.GetParameterValueByName(element=elementType, parameterName=code_block_3)
code_block_4 = CodeBlock(x=getParameterValueByName) { [x/2,x/-2]; }
translate = Geometry.Translate(geometry=byCoordinates, direction=rotate, distance=code_block_4@L2)
transpose = List.Transpose(lists=translate)
transpose_2 = List.Transpose(lists=translate)
doesIntersect = Geometry.DoesIntersect(geometry=transpose_2@@L1, other=flatten@L2, lacing=Longest)
boolean = BoolSelector(true)
eq = _ == boolean  # unwired: x
trueForAny = List.TrueForAny(list=doesIntersect@@L2, predicate=eq, lacing=Longest)
filterByBoolMask_2 = List.FilterByBoolMask(list=transpose, mask=trueForAny, lacing=Shortest)
flatten_2 = List.Flatten(list=filterByBoolMask_2.in)

# group: Create window segments
elementType_2 = Element.ElementType(element=all_elements_of_category)
code_block_5 = CodeBlock { "Width"; }
getParameterValueByName_2 = Element.GetParameterValueByName(element=elementType_2, parameterName=code_block_5)
code_block_6 = CodeBlock(windowWidth=getParameterValueByName_2) { [windowWidth/2,-windowWidth/2]; }
translate_2 = Geometry.Translate(geometry=flatten_2, direction=direction, distance=code_block_6@L2)
code_block_7 = CodeBlock(x=translate_2) { startPt = x[0]; endPt = x[1]; }
byStartPointEndPoint = Line.ByStartPointEndPoint(startPoint=code_block_7.startPt, endPoint=code_block_7.endPt)

# group: Boundary surface
select_face = DSFaceSelection()  # 1 picked in the model
code_block_8 = CodeBlock(x=select_face) { x[0]; }

# group: Internals - column polygons
categories_3 = Categories(index=506)
all_elements_of_category_3 = ElementsOfCategory(Category=categories_3)
getLocation_3 = Element.GetLocation(element=all_elements_of_category_3)
byOrigin = CoordinateSystem.ByOrigin(origin=getLocation_3)
code_block_9 = CodeBlock { 500; }
byWidthLength = Rectangle.ByWidthLength(cs=byOrigin, width=code_block_9, length=code_block_9)

# group: Data.Remember
remember = Data.Remember(byStartPointEndPoint)
remember_2 = Data.Remember(code_block_8)
remember_3 = Data.Remember(flatten)
remember_4 = Data.Remember(byWidthLength)

# group: Generator - location point
number_slider = DoubleSlider(0.331, range=0..1 step 0.01)
number_slider_2 = DoubleSlider(0.9, range=0..1 step 0.01)
pointAtParameter = Surface.PointAtParameter(surface=remember_2, u=number_slider, v=number_slider_2)

# group: Evaluator - views to outside
byLineSegments = Autodesk.RefineryToolkits.SpacePlanning.Analyze.ViewsToOutside.ByLineSegments(viewSegments=remember, origin=pointAtParameter, boundary=remember_3, internals=remember_4)

# group: Visualize results
code_block_10 = CodeBlock(segments=byLineSegments.segments, origin=pointAtParameter)
# ---------- code_block_10.designscript (2 lines) ----------
segmentPoints = DSCore.List.Transpose([DesignScript.Curve.StartPoint(segments), DesignScript.Curve.EndPoint(segments)]);
viewLines = DesignScript.Line.ByStartPointEndPoint(origin, segmentPoints);
# ----------------------------------------
list_create = List.Create(item0=byLineSegments.segments, item1=code_block_10.viewLines)
transpose_3 = List.Transpose(lists=list_create)
flatten_3 = List.Flatten(list=transpose_3, lacing=Longest)
byJoinedCurves = PolyCurve.ByJoinedCurves(curves=flatten_3)
byPatch = Surface.ByPatch(closedCurve=byJoinedCurves)
color_palette = ColorPalette({R: 255, G: 255, B: 0, A: 255})
byGeometryColor = Modifiers.GeometryColor.ByGeometryColor(geometry=byPatch, color=color_palette)
identity = Object.Identity(obj=code_block_10.segmentPoints)

# group: Place desk in Revit
family_types = FamilyTypes(index=24)
byPoint = FamilyInstance.ByPoint(familyType=family_types, point=pointAtParameter)
