# Dynamo graph 04-01-01_Highest-point-of-a-surface.dyn (Dynamo 2.13.1.3887)
# The 01-01_EvaluateSurface.dyn graph in the examples uses a single objective optimization approach to find the highest Z point on a sinuous surface.

# note: Variables / Inputs
# Red indicates Variables that can be altered per project and must be set accordingly before running the script.
# note: Checking / Outputs
# Orange indicates checking nodes to ensure the script has deployed correctly.
# note: Working / Functions
# Green indicates the working of the script. No changes should be made in these groups unless advised.

# group: Highest Point of a Surface Generative Design Graph Example
# note: DYNAMO PROJECT
# 04-01-01_Highest-point-of-a-surface.dyn
# note: ASSOCIATED FILE(S)
# N/A
# note: AUTHOR(S) / CREATION DATE
# AEC Generative Design Team and The Proving Ground / Dec 2018
# note: DESCRIPTION
# This graph will take a given surface and populate a point on this surface based on a U and V value. It will then report back the Z value (Height) of the point and can be used to find the highest peak through Generative Design optimization.
# note: DYNAMO VERSION
# 2.5.0
# note: ADDITIONAL COMMENTS
# N/A
# note: REQUIRED DYNAMO PACKAGES
# N/A

# group: Surface [Dynamo]: Create sinuous wave surface of peaks and troughs
XY = Plane.XY()
code_block = CodeBlock { 100; }
byWidthLength = Rectangle.ByWidthLength(plane=XY, width=code_block, length=code_block)
byPatch = Surface.ByPatch(closedCurve=byWidthLength)
# note: Creating a number range in the following format:
# start..end..#amount;
# Here we are using U and V values that have to be between 0 and 1 (Start and End of Surface) with an equally spaced #Amount between that range.
code_block_2 = CodeBlock { 0..1..#50; }
pointAtParameter = Surface.PointAtParameter(surface=byPatch, u=code_block_2, v=code_block_2, lacing=CrossProduct)
cycles = DoubleSlider(3, range=0..10 step 1)
amplitude = DoubleSlider(9, range=0..10 step 1)
# note: A custom function inside a Code Block that will generate a complex range of numbers in the following format:
# (start..end)..#amount;
code_block_3 = CodeBlock(x=code_block_2, cycles=cycles, amp=amplitude) { (0..Math.Sin(x*360*cycles)..#List.Count(x))*amp; }
transpose = List.Transpose(lists=code_block_3)
add = code_block_3 + transpose
translate = Geometry.Translate(geometry=pointAtParameter, zTranslation=add)
byPoints = NurbsSurface.ByPoints(points=translate)

# group: Inputs: Changeable variables
# note: Location of the Point in the U-value (Set between 0 and 1). This maps the point onto a surface between 0 (Start of surface) and 1 (End of surface).
u_point_value = DoubleSlider(0.134, range=0..1 step 0.001)  # graph input
# note: NOTE:
# In order to see an 'Input' in Generative Design, you have to right-click on a compatible node and check the 'Is Input' option. Rename the node to see a legible input name in Generative Design.
# note: Location of the Point in the V-value (Set between 0 and 1). This maps the point onto a surface between 0 (Start of surface) and 1 (End of surface).
v_point_value = DoubleSlider(0.58, range=0..1 step 0.001)  # graph input

# group: Point: Creating a Point mapped to UV Coordinates and querying the Z-value
pointAtParameter_2 = Surface.PointAtParameter(surface=byPoints, u=u_point_value, v=v_point_value)
Z = Point.Z(point=pointAtParameter_2)

# group: Outputs: Output information that can be used to filter results in Generative Design
# note: NOTE:
# In order to see an 'Output' in Generative Design, you have to right-click on a compatible node and check the 'Is
# Output' option. Rename the node to see a legible output name in Generative Design.
point_z_value_height = Watch(Z)  # graph output

# group: Visualization: Colourizes Dynamo geometry in the Background Preview window
color_palette = ColorPalette({R: 5, G: 195, B: 222, A: 255})
byGeometryColor = Modifiers.GeometryColor.ByGeometryColor(geometry=byPoints, color=color_palette)
code_block_4 = CodeBlock { 100; }
div = code_block / code_block_4
byCenterPointRadius = Sphere.ByCenterPointRadius(centerPoint=pointAtParameter_2, radius=div)
color_palette_2 = ColorPalette({R: 255, G: 138, B: 61, A: 255})
byGeometryColor_2 = Modifiers.GeometryColor.ByGeometryColor(geometry=byCenterPointRadius, color=color_palette_2)
