# Dynamo graph 02-01_Primer_sample_BuildingGenerator.dyn (Dynamo 2.13.1.3887)
# author: Dynamo Team
# This graph, used with the Randomize mode, will generate a series of random towers, sitting across a stipulated site boundary.
# packages: GenerativeDesign 2.0.10.0, GenerativeDesign.Revit 2.0.10.0

# note: Checking / Outputs
# Orange indicates checking nodes to ensure the script has deployed correctly.
# note: Working / Functions
# Green indicates the working of the script. No changes should be made in these groups unless advised.
# note: Variables / Inputs
# Red indicates Variables that can be altered per project and must be set accordingly before running the script.

# group: BUILDING GENERATOR Refinery Graph Example
# note: ADDITIONAL COMMENTS
# 1) Select the site boundary lines from your Revit file, on the Dynamo Input group
# 2) Open Dynamo Refinery (View > Refinery...)
# 3) Create a New Study
# 4) Under generation method select Randomize
# 5) Under Inputs, uncheck and set a value for the inputs that will not change during run
# 6) Under settings, select the number of solutions wanted
# 7) Fix any possible problems in the issues section
# 8) Click generate and wait for the outputs
# note: REQUIRED DYNAMO PACKAGES
# N/A
# note: DYNAMO VERSION
# 2.5.0
# note: DYNAMO PROJECT
# 04-02-01_Building-Generator.dyn
# note: ASSOCIATED FILE(S)
# N/A
# note: AUTHOR(S) / CREATION DATE
# designtech.io for Autodesk Refinery Team / Feb 2018
# note: DESCRIPTION
# This Graph used with Dynamo Refinery on "Randomize" mode, will automatically generate a series of random towers, sitting across a stipulated site boundary. The Tower will randomise in height, floor plates and orientation that allow for a vast amount of potential design solutions.

# group: Revit Inputs
site_boundary_lines = DSModelElementMutlipleSelection()  # 7 picked in the model; graph input

# group: Geometry [Revit/Dynamo]: Convert Revit site boundary into a Dynamo polycurve
curves = Element.Curves(element=site_boundary_lines)
flatten = List.Flatten(list=curves)
byJoinedCurves = PolyCurve.ByJoinedCurves(curves=flatten)

# group: Remember Selected Lines
code_block = CodeBlock(buildingSite=byJoinedCurves) { buildingSite; }
remember = Data.Remember(code_block)

# group: Refinery Inputs
# note: NOTE:
# In order to see an 'Input' in Refinery, you have to right-click on a compatible node and check the 'Is Input' option. Rename the node to see a legible input name in Refinery.
in_site_offset = IntegerSlider(1790, range=500..4500 step 10)  # graph input
point_1_u = DoubleSlider(0.53, range=0..1 step 0.01)  # graph input
point_1_v = DoubleSlider(0.72, range=0..1 step 0.01)  # graph input
point_2_u = DoubleSlider(0.61, range=0..1 step 0.01)  # graph input
point_2_v = DoubleSlider(0.52, range=0..1 step 0.01)  # graph input
point_3_u = DoubleSlider(0.58, range=0..1 step 0.01)  # graph input
point_3_v = DoubleSlider(0.5, range=0..1 step 0.01)  # graph input
point_4_u = DoubleSlider(0.44, range=0..1 step 0.01)  # graph input
point_4_v = DoubleSlider(0.56, range=0..1 step 0.01)  # graph input
point_5_u = DoubleSlider(0.34, range=0..1 step 0.01)  # graph input
point_5_v = DoubleSlider(0.31, range=0..1 step 0.01)  # graph input
point_6_u = DoubleSlider(0.59, range=0..1 step 0.01)  # graph input
point_6_v = DoubleSlider(0.71, range=0..1 step 0.01)  # graph input
point_7_u = DoubleSlider(0.17, range=0..1 step 0.01)  # graph input
point_7_v = DoubleSlider(0.81, range=0..1 step 0.01)  # graph input
in_building_height = IntegerSlider(126000, range=4000..200000 step 1000)  # graph input
IN_FloorHeight = DoubleSlider(3300, range=2500..3500 step 100)

# group: Geometry [Dynamo]: Offset the site boundary a certain distance towards the interior of the site
# note: INPUTS
# IN[0] = Site Boundary [Crvs]
# IN[1] = Offset Amount [Double]
# OUPUT
# OUT = Site Boundary Offset [Crvs]
python_script_internal_boundary = Python(IN[0]=remember, IN[1]=in_site_offset)  # "Python Script || Internal Boundary Offset"; CPython3
# ---------- python_script_internal_boundary.python (41 lines) ----------
# Copyright 2019 designtech.io. All rights reserved.
"""
Internal Boundary Offset
"""
__copyright__ = 'designtech.io 2019'
__version__ = '1.0.0'

import clr  #Importing the 'Common Language Runtime' module to allow
#us to append .NET framework modules to our Python node
clr.AddReference('ProtoGeometry')  #Dynamo Geometry .dll
from Autodesk.DesignScript.Geometry import *  #Importing everything

#Definitions
def intoOffset(crv, offset):
    offsets = [-offset, offset]  #Offset number in both positive 
    #and negative directions
    lengths = []  #Create empty catchment list
    newCurves = []  #Create empty catchment list
    for off in offsets:  #Loop through each of these offset distances
    # and offset curves
        newCurves.append(crv.Offset(off))  #Append offset curves to 
        #'newCurves' catchment list
    for nc in newCurves:  #Loop through each element inside of the 
    #newCurves list
        lengths.append(nc.Length)  #Append curve lengths to 'lengths' 
        #catchment list
    for nc, len in zip(newCurves, lengths):  #For each paired curve and
    # length inside of our zipped (paired) lists do the following
        if len == min(lengths):  #If the length of that curve matches the 
        #minimum lenght of both offset curves (i.e is internal) then do 
        #the following
            output = nc  #Define a variable called Output

    return output  #Return output
    
#Inputs
crv = IN[0]  #Curves list
offset = IN[1]  #Offset number
    
OUT = intoOffset(crv,offset)  #Calling our function and appending to the 
#'OUT' output port
# ----------------------------------------

list_create = List.Create(item0=point_1_u, item1=point_1_v, item2=point_2_u, item3=point_2_v, item4=point_3_u, item5=point_3_v, item6=point_4_u, item7=point_4_v, item8=point_5_u, item9=point_5_v, item10=point_6_u, item11=point_6_v, item12=point_7_u, item13=point_7_v)

# group: Geometry [Dynamo]: Randomize the primary floor plate based on the selected site boundaries
byPatch = Surface.ByPatch(closedCurve=python_script_internal_boundary)
code_block_2 = CodeBlock { [-0.2,1.2]; }
pointAtParameter = Surface.PointAtParameter(surface=byPatch, u=code_block_2, v=code_block_2, lacing=CrossProduct)
flatten_2 = List.Flatten(list=pointAtParameter)
# note: INPUTS
# IN[0] = Points [Pts]
# OUPUT
# OUT = Building Surface [Srf]
python_script_external_polycurve = Python(IN[0]=flatten_2)  # "Python Script || External PolyCurve Generator"; CPython3
# ---------- python_script_external_polycurve.python (45 lines) ----------
# Copyright 2018 Dimitar Venkov
"""
Externalised PolyCurve Generator
"""
__author__ = 'Dimitar Venkov - @dimven'
__copyright__ = 'MIT Creative Commons'
__version__ = '1.0.0'

import clr
clr.AddReference('ProtoGeometry')
from Autodesk.DesignScript.Geometry import *

from itertools import chain

pts = sorted( (p.X, p.Y) for p in IN[0])
elev = 0

def pCrs(o, a, b):
        return (a[0] - o[0]) * (b[1] - o[1]) - (a[1] - o[1]) * (b[0] - o[0])

pLen = len(pts)
if pLen < 4:
        polyCurve = PolyCurve.ByPoints(pts,True)
        surf = Surface.ByPatch(polyCurve)
        int = Geometry.Intersect(site,surf)
        OUT = int[0]
else:
        lower, upper = [], []
        
        for i in range(pLen):
                j = pLen - 1 - i
                while len(lower) >= 2 and pCrs(lower[-2], lower[-1], pts[i]) <= 0:
                        lower.pop()
                lower.append(pts[i])
                while len(upper) >= 2 and pCrs(upper[-2], upper[-1], pts[j]) <= 0:
                        upper.pop()
                upper.append(pts[j])
        
        lower.pop()
        upper.pop()
        
        newPts = [Point.ByCoordinates(p[0], p[1], elev) for p in chain(lower, upper) ]
        polyCurve = PolyCurve.ByPoints(newPts,True)
        surf = Surface.ByPatch(polyCurve)
        OUT = surf
# ----------------------------------------
code_block_3 = CodeBlock { 2; }
chop = List.Chop(list=list_create, lengths=code_block_3)
transpose = List.Transpose(lists=chop)
code_block_4 = CodeBlock(x=transpose) { x[0]; x[1]; }
pointAtParameter_2 = Surface.PointAtParameter(surface=python_script_external_polycurve, u=code_block_4.out0, v=code_block_4.out1)
# note: INPUTS
# IN[0] = Site Surface [Srf]
# IN[1] = Points [Pts]
# OUPUT
# OUT = Building Surface [Srf]
python_script_external_polycurve_2 = Python(IN[0]=byPatch, IN[1]=pointAtParameter_2)  # "Python Script || External PolyCurve Generator"; CPython3
# ---------- python_script_external_polycurve_2.python (47 lines) ----------
# Copyright 2018 Dimitar Venkov
"""
Externalised PolyCurve Generator
"""
__author__ = 'Dimitar Venkov - @dimven'
__copyright__ = 'MIT Creative Commons'
__version__ = '1.0.0'

import clr
clr.AddReference('ProtoGeometry')
from Autodesk.DesignScript.Geometry import *

from itertools import chain

site = IN[0]
pts = sorted( (p.X, p.Y) for p in IN[1])
elev = 0

def pCrs(o, a, b):
        return (a[0] - o[0]) * (b[1] - o[1]) - (a[1] - o[1]) * (b[0] - o[0])

pLen = len(pts)
if pLen < 4:
        polyCurve = PolyCurve.ByPoints(pts,True)
        surf = Surface.ByPatch(polyCurve)
        int = Geometry.Intersect(site,surf)
        OUT = int[0]
else:
        lower, upper = [], []
        
        for i in range(pLen):
                j = pLen - 1 - i
                while len(lower) >= 2 and pCrs(lower[-2], lower[-1], pts[i]) <= 0:
                        lower.pop()
                lower.append(pts[i])
                while len(upper) >= 2 and pCrs(upper[-2], upper[-1], pts[j]) <= 0:
                        upper.pop()
                upper.append(pts[j])
        
        lower.pop()
        upper.pop()
        
        newPts = [Point.ByCoordinates(p[0], p[1], elev) for p in chain(lower, upper) ]
        polyCurve = PolyCurve.ByPoints(newPts,True)
        surf = Surface.ByPatch(polyCurve)
        int = Geometry.Intersect(site,surf)
        OUT = int[0]
# ----------------------------------------

# group: Geometry [Dynamo]: Generate different floor plates based on the primary floor plate and place them at the correct hegiht
# note: INPUTS
# IN[0] = Random Floor Plate [Surface]
# IN[1] = Current Time [DateTime]
# IN[2] = Maximum Building Height [Double]
# IN[3] = Offset Site Boundary [Crvs]
# OUPUT
# OUT[0] = Floor Plates [Surface]
# OUT[1] = Floor Heights [Double]
# OUT[2] = Number of Floors [Int]
python_script_generate = Python(IN[0]=python_script_external_polycurve_2, IN[1]=in_building_height, IN[2]=IN_FloorHeight, IN[3]=python_script_internal_boundary)  # "Python Script || Generate Randomised Towers"; CPython3
# ---------- python_script_generate.python (212 lines) ----------
# Copyright 2019 designtech.io. All rights reserved.
"""
Site Layout Generator
"""
__copyright__ = 'designtech.io 2019'
__version__ = '1.0.0'

import clr  
clr.AddReference('ProtoGeometry')  
from Autodesk.DesignScript.Geometry import * 
clr.AddReference('DSCoreNodes') 
import DSCore 
from DSCore import List  
import sys 
sys.path.append(r'C:\Program Files (x86)\IronPython 2.7\Lib')
import random 
import time 
import math
import itertools
from itertools import islice,chain

# custom list splittling definition
def splitByLengths( seq, num ): 
        newList = []
        if sum(num) >= len(seq):
                min = 0
                for n in num:
                        newN = min + n
                        newList.append(seq[min:newN])
                        min += n
        else:
                num.append(len(seq)-sum(num))
                min = 0
                for n in num:
                        newN = min + n
                        newList.append(seq[min:newN])
                        min += n
        return newList

# Custom surface splitting definition
def splitSrf( surface, cutCrv, offsetDist ):  #Inputs of 'surface' (Singular), cutCurve that will slice the
    #surfaces and an offset distance
    rebuildCrv = Line.ByStartPointEndPoint( cutCrv.StartPoint, cutCrv.EndPoint )  #Rebuilding the curve as the
    #origin curve sometimes fails (No idea why)
    focusPoint = surface.PointAtParameter( 0.5, 0.5 )  #Creating a centroidal point to offset towards with our
    #splitting line
    offsetCrv = sorted( [ rebuildCrv.Offset( offsetDist ), rebuildCrv.Offset( -offsetDist ) ], 
    key = lambda x : Geometry.DistanceTo( x, focusPoint ) )[0]  #Creating an offset curve for both the positive
    #and negative directions, based off our rebuilt curve, then sorting that list based on the Distance To the
    #focus point (surface point) and from the curve geometry and taking the first value (Closest to our chosen
    #point)
    crvLen = offsetCrv.Length  #Calling the Length value of our chosen offset curve (Internal to surface)
    extendCrv = offsetCrv.ExtendStart( crvLen * 20 ).ExtendEnd( crvLen * 20  )  #Extending the start and end of 
    #our chosen curve by 3 x the length so that no matter the site constraints, we'll push out beyond it. 
    # NOTE: This may not be a viable approach but didn't fail in all prototype options
    extrudeCrv = extendCrv.Extrude( Vector.ByCoordinates( 0, 0, 1), 500).Translate( 0, 0, -250 )  #We then extrude
    #our extended curve in the Z-direction up 500 units, then translate that back down by half it's value (-250) as
    #simply cutting the surface with a 'child' object of that surface (i.e our offset periemter curve) seems to 
    #fail often. So we have to generate a new, non-relational object
    splitSrf = sorted( Geometry.Split( surface, extrudeCrv ), key = lambda x : x.Area )[-1]  #Splitting our surface
    #using Geometry.Split, and then sorting that list by the Area of the surfaces.
    # NOTE: This may not be a viable approach and would be better served using another approach
    [ i.Dispose() for i in [ rebuildCrv, focusPoint, offsetCrv, extendCrv, extrudeCrv ] ]  #Disposing of the 
    #geometry will clear up RAM but is ___SUPER DANGEROUS___ when not used corretly as you can dispose of things not
    #internal to the Python node but to the Dynamo graph itself. 
    return splitSrf  #Return the chosen split surface

# Creating a bespoke rounding definition
def roundToPrecision( crv, num, precision ):  #Creating a defintion that uses a 'curve', 'number' and 'precison' value
    return math.floor( ( crv.Length / num ) / precision ) * precision  #Returning a precision value on a custom divided
    #line. i.e we want to divide our curve by 3 and then precision it to 100
    #crv.Length = 23078.987, num = 3, precision = 100
    # (23078.987 / 3) => 7692.995 / 100 => 76.929 * 100 => math.floor(7692.995 ) => 7692

# Creating a Remap-Range Definition
def remap( x, nMin, nMax ):  #Just find a C# version or build one to remap the range :) 
    #range check
    if 0 == 1:
        print("Warning: Zero input range")
        return None

    if nMin == nMax:
        print("Warning: Zero output range")
        return None

    #check reversed input range
    reverseInput = False
    oldMin = min( 0, 1 )
    oldMax = max( 0, 1 )
    if not oldMin == 0:
        reverseInput = True

    #check reversed output range
    reverseOutput = False   
    newMin = min( nMin, nMax )
    newMax = max( nMin, nMax )
    if not newMin == nMin :
        reverseOutput = True

    portion = ( x - oldMin ) * ( newMax - newMin ) / ( oldMax - oldMin )
    if reverseInput:
        portion = ( oldMax - x ) * ( newMax - newMin ) / ( oldMax - oldMin )

    result = portion + newMin
    if reverseOutput:
        result = newMax - portion

    return result

# Splitting up our floors
def splitNums( num, floorRange ):  #Creating a custom definition to split up our floor numbers
    startList = [ random.randint( 0, max( floorRange )) ]  #Creating a list comprehension of
    #a random integer between zero and the maximum number of our 'floorRange' variabble
    for n in range( num - 1 ):  #Creating a For Loop across a range from zero to our number minus 1
        #i.e n = [0, 1, 2] as an xrange object (Generator)
        _int = random.randint(0, ( max( floorRange ) - sum( startList )) )  #Creating an integer
        #randomly between zero and our maximum 'floorRange' 
        startList.append(_int)  #Append this random integer to our start list
    return startList 
    
def _flatten(l, result = None):  #Creating a custom flatten function, with a default None (null) result
    if result is None:  #If the result is None (null) then... 
        result = []  #return an empty list
    for i in l:  #Otherwise, for index inside of our list-to-flatten
        if isinstance(i, list):  #If the index item is an instance of the 'list' object
            _flatten(i, result)  #Then recursively call our custom function on that list, and populate the 
            #'result' variable with it 
        else:  #Otherwise
            result.append(i)  #Simply append the index to the result
    return result  #And return the result

# Input Ports
surface = IN[0]
maxBuildingHeight = IN[1]
floorHeight = IN[2]
siteBoundary = IN[3]

# Demarcating a precision value
precision = 100

# Surface randomisation
srfCount = round( remap( random.random(), 2, 5 ) )  #Remapping a random value between 0.0 and 1.0 to between 
# 2 and 5 and then rounding it. This gives us an overall surface count for our Tower

numOfFloors = math.floor( round( maxBuildingHeight / floorHeight ) )  #Random number of floors

towerFloorRange = range( 0, numOfFloors )  #Creating a tower floor range between

#Floor splits randomised
floorSplitNums = splitNums( srfCount, towerFloorRange )  #Calling our custom 'splitNums' definition

#While loop to discount any variation that contains a zero 
#NOTE: This is the intention, but may not have worked correctly. We also want to while loop min/max floor area
#fencing
while 0 in floorSplitNums:
    newList = splitNums( srfCount, towerFloorRange )  #Calling our 'splitNums' definition inside the
    #while loop if said condition exists
    floorSplitNums = newList  #Reapplying to the same variable 'newList' data
    
# Floor Offset values
#podiumOffsets = [ i * floorHeight for i in xrange( 0, topPodiumFloor ) ]  #Using a 'List Comprehension' for generating
#a new value list based off index values times the floor height inside of a range starting at zero and finishing at
#the 'topPodiumFloor'
floorOffsets = [ ( i * floorHeight ) for i in range( 1, max(towerFloorRange) + 1 ) ]  #Using a 
#'List Comprehension' for generating floor offsets of the index value times the floor height plus the maximum value of
#the podium offsets (This generates the tower levels)

splitUpperFloors = splitByLengths( floorOffsets, floorSplitNums )  #We then use our custom definition called
#'splitByLengths' and split up our values into sublists by the 'floorSplitNums'
splitUpperFloors[0].insert(0,0)


floorZLength = len( splitUpperFloors )  #Getting the length of our floorZOffsets list

# Overall Building Height
buildingHeight = max( floorOffsets ) + floorHeight  #Getting the maximum floorZoffsets, taking the last item in
#the list and adding the floor Height for the total building height

# Origin Surface and catchment list
srfList = [ surface ]  #We populate this as a list (Wrapped in square brackets) for later use



modeCounter = 0  #A counter for surface replication
while modeCounter < srfCount:  #While the counter is lower than the 'srfCount' then run the following
        crvs = srfList[ modeCounter ].PerimeterCurves()  #Get the modeCounter index of the 'srfList' and pull out perimeter curves
     
        mode = List.Shuffle( crvs )[0]  #Fully randomise the curves list and pull out the first Curve
               
        if modeCounter == 0:  #ModeCounter will showcase the distance upon what the towers will offset by (The offsets
        #get smaller the higher you go up the tower)
        # NOTE: This may want to be changed as it get's pretty subtle
                offsetDist = roundToPrecision(mode, 3, precision)  #Divide chosen seed curve by 3, round to precision
        if modeCounter == 1:
            offsetDist = roundToPrecision(mode, 4, precision)  #Divide chosen seed curve by 4, round to precision
        if modeCounter == 2:
            offsetDist = roundToPrecision(mode, 5, precision)  #Divide chosen seed curve by 5, round to precision
        else:
            offsetDist = roundToPrecision(mode, 8, precision)  #Divide chosen seed curve by 8, round to precision
            
        srfSplit = splitSrf( srfList[modeCounter], mode, offsetDist )  #Split our surfaces based off the Mode Counter
        #and return the surface closer to the centroid always
        srfList.append( srfSplit )  #Append this split surface to our 'srfList' for re-run of the loop
        
        [ i.Dispose() for i in crvs ]  #Dispose of the curve geometry
        modeCounter += 1  #Add 1 to the modeCounter
        
srfs = srfList  #Output a new list called 'srfs' that contains all of our Surfaces for the tower

sAreas = [ ( s.Area / 1000000 ) for s in srfs ]  #Calculate the areas for each surface using 'List Comprehension'

OUT = srfs, splitUpperFloors, numOfFloors
# ----------------------------------------
code_block_5 = CodeBlock(x=python_script_generate) { x[2]; x[0]; x[1]; }
translate = Geometry.Translate(geometry=code_block_5.out1, zTranslation=code_block_5.out2)
perimeterCurves = Surface.PerimeterCurves(surface=translate)

# group: Math: Calculate public realm area, total building area and lift provision area
flatten_3 = List.Flatten(list=translate)
area = Surface.Area(surface=flatten_3)
sum = Math.Sum(values=area)
code_block_6 = CodeBlock(x=sum) { Math.Round(x/1000000); }
area_2 = Surface.Area(surface=byPatch)
area_3 = Surface.Area(surface=python_script_external_polycurve_2)
code_block_7 = CodeBlock(site=area_2, bldg=area_3) { pr = (site-bldg); prc = Math.Round((pr/site)*100); }

# group: Outputs: Output information can be used to filter results in Refinery
out_total_building_area = Watch(code_block_6)  # graph output
# note: NOTE:
# In order to see an "Output" in Generative Design, you have to right-click on a compatible node and check the "is Output" option. Rename the node to see a legible output name in Generative Design.
out_public_realm_area = Watch(code_block_7.prc)  # graph output

# group (continued): Math: Calculate public realm area, total building area and lift provision area
python_script_lift_provision = Python(IN[0]=code_block_5.out0, IN[1]=out_total_building_area)  # CPython3
# ---------- python_script_lift_provision.python (14 lines) ----------
__author__ = 'Antonio Rodriguez'
__version__ = '1.0.0'

import clr
clr.AddReference('ProtoGeometry')
from Autodesk.DesignScript.Geometry import *
import math

nFloors = IN[0]
buildingTotalArea = IN[1]

liftProvision = (buildingTotalArea*(-0.18))/(nFloors-47.5)

OUT = abs(liftProvision)
# ----------------------------------------

# group (continued): Outputs: Output information can be used to filter results in Refinery
out_lift_provision_area = Watch(python_script_lift_provision)  # graph output

# group: Geometry [Dynamo]: Generate entire floors based on floorplates and combine them into a single solid
byJoinedCurves_2 = PolyCurve.ByJoinedCurves(curves=perimeterCurves)
lastItem = List.LastItem(list=byJoinedCurves_2@L2)
ZAxis = Vector.ZAxis()
translate_2 = Geometry.Translate(geometry=lastItem, direction=ZAxis, distance=IN_FloorHeight)
count = List.Count(list=byJoinedCurves_2@L2)
insert = List.Insert(list=byJoinedCurves_2@L2, element=translate_2@L1, index=count@L1)
byLoft = Solid.ByLoft(crossSections=insert)
byUnion = Solid.ByUnion(solids=byLoft)

# group: Visualization: Colourizes Dynamo geometry in the Background preview window
code_block_8 = CodeBlock { white = DSCore.Color.ByARGB(255,255,255,255); glass = DSCore.Color.ByARGB(150,60,145,190); }
byGeometryColor = Modifiers.GeometryColor.ByGeometryColor(geometry=translate, color=code_block_8.white)
byGeometryColor_2 = Modifiers.GeometryColor.ByGeometryColor(geometry=byUnion, color=code_block_8.glass)

code_block_9 = CodeBlock { 250; }
extrudeAsSolid = Curve.ExtrudeAsSolid(curve=byJoinedCurves_2, distance=code_block_9)
gate = Data.Gate(false, extrudeAsSolid)

# group: Geometry [Dynamo/Revit]: Converts Dynamo geometry into a direct shape to be visualized inside Revit
categories = Categories("OST_Floors")
code_block_10 = CodeBlock { "Default"; }
byName = Material.ByName(name=code_block_10)
code_block_11 = CodeBlock { "Selected Building"; }
# note: NOTE:
# Unfreeze this node to generate a direct shape of the selected building in the Revit enviroment.
byGeometry = DirectShape.ByGeometry(geometry=gate, category=categories, material=byName, name=code_block_11)

# group: Geometry [Dynamo/Revit]: Converts Dynamo geometry into a direct shape to be visualized inside Revit
categories_2 = Categories("OST_Floors")
code_block_12 = CodeBlock { "Default"; }
byName_2 = Material.ByName(name=code_block_12)
code_block_13 = CodeBlock { "Selected Building"; }
# note: NOTE:
# Unfreeze this node to generate a direct shape of the selected building in the Revit enviroment.
byGeometry_2 = DirectShape.ByGeometry(geometry=gate, category=categories_2, material=byName_2, name=code_block_13)
