# Dynamo graph SolarAnalysis.dyn (Dynamo 2.5.0.7460)
# packages: Solar Analysis for Dynamo 1.12.0

# group: Creates the Base Service
code_block = CodeBlock { 100; }
byWidthLength = Rectangle.ByWidthLength(width=code_block, length=code_block)
byPatch = Surface.ByPatch(closedCurve=byWidthLength)

# group: Get Weather for Analysis
code_block_2 = CodeBlock()
# ---------- code_block_2.designscript (3 lines) ----------
// Latitude & Longitude
42.35;
-71.05;
# ----------------------------------------
byLatitudeLongitude = DynamoSolarAnalysis.Weather.Weather.ByLatitudeLongitude(latitude=code_block_2.out0, longitude=code_block_2.out1)

number_slider = DoubleSlider(46.6, range=10..100 step 0.1)  # graph input

# group: Creates the Aligned Surface
origin = Point.Origin()
ZAxis = Vector.ZAxis()
XAxis = Vector.XAxis()
rotate = Vector.Rotate(vector=ZAxis, axis=XAxis, degrees=code_block_2.out1)
number = DoubleInput(50)
byStartPointDirectionLength = Line.ByStartPointDirectionLength(startPoint=origin, direction=rotate, length=number)
number_2 = DoubleInput(0.5)
pointAtParameter = Curve.PointAtParameter(curve=byStartPointDirectionLength, param=number_2)
byOriginNormal = Plane.ByOriginNormal(origin=pointAtParameter, normal=rotate)
byWidthLength_2 = Rectangle.ByWidthLength(plane=byOriginNormal, width=number_slider, length=number_slider)
byPatch_2 = Surface.ByPatch(closedCurve=byWidthLength_2)
number_3 = DoubleInput(10)

create = List.Create(item0=byPatch, item1=byPatch_2)
code_block_3 = CodeBlock()
# ---------- code_block_3.designscript (5 lines) ----------
cyan=Color.ByARGB(255,0,255,255);
orange=Color.ByARGB(255,255,255,0);
red=Color.ByARGB(255,255,0,0);
colors=[cyan,orange,red];
indices=[0,0.5,1];
# ----------------------------------------
date_time = DateTime("2004-06-01T13:00:00Z")
boolean = BoolSelector(false)
still = DynamoSolarAnalysis.Analysis.TimeStudy.Still(dateTime=date_time, usesDST=boolean)
number_slider_2 = DoubleSlider(2, range=0..100 step 0.1)
analyze = DynamoSolarAnalysis.Analysis.SolarAnalysis.Analyze(weather=byLatitudeLongitude, analysisSurfaces=create, shadingSurfaces=create, timeStudy=still, spacing=number_slider_2)
flatten = List.Flatten(list=analyze.Peak)
maximumItem = List.MaximumItem(list=flatten)
code_block_4 = CodeBlock(n=analyze.Peak, max=maximumItem) { n/max; }
color_range = ColorRange(colors=code_block_3.colors, indices=code_block_3.indices, value=code_block_4)
bySurfaceColors = Modifiers.GeometryColor.BySurfaceColors(surface=create, colors=color_range)
date_time_2 = DateTime("2004-06-01T12:12:00Z")
fromSunriseToSunset = DynamoSolarAnalysis.Analysis.TimeStudy.FromSunriseToSunset(startDateTime=date_time, endDateTime=date_time_2, usesDST=boolean)
flatten_2 = List.Flatten(list=code_block_4)
sum = Math.Sum(values=flatten_2)
watch = Watch(sum)  # graph output
