# Dynamo graph TimeStudies.dyn (Dynamo 2.5.0.7460)

date_time = DateTime("2017-01-18T14:46:00Z")  # graph input
boolean = BoolSelector(true)  # graph input
still = DynamoSolarAnalysis.Analysis.TimeStudy.Still(dateTime=date_time, usesDST=boolean)
startDateTime = DynamoSolarAnalysis.Analysis.TimeStudy.StartDateTime(timeStudy=still)
watch = Watch(startDateTime)
endDateTime = DynamoSolarAnalysis.Analysis.TimeStudy.EndDateTime(timeStudy=still)
watch_2 = Watch(endDateTime)
isStillStudy = DynamoSolarAnalysis.Analysis.TimeStudy.IsStillStudy(timeStudy=still)
watch_3 = Watch(isStillStudy)
date_time_2 = DateTime("2017-01-18T14:46:00Z")  # graph input
date_time_3 = DateTime("2017-01-19T16:46:00Z")  # graph input
boolean_2 = BoolSelector(false)  # graph input
fromSunriseToSunset = DynamoSolarAnalysis.Analysis.TimeStudy.FromSunriseToSunset(startDateTime=date_time_2, endDateTime=date_time_3, usesDST=boolean_2)
endDateTime_2 = DynamoSolarAnalysis.Analysis.TimeStudy.EndDateTime(timeStudy=fromSunriseToSunset)
watch_4 = Watch(endDateTime_2)
isStillStudy_2 = DynamoSolarAnalysis.Analysis.TimeStudy.IsStillStudy(timeStudy=fromSunriseToSunset)
watch_5 = Watch(isStillStudy_2)
# note: Note: The StartDateTime and EndDateTime returns the startDateTime and endDateTime that is input to the FromSunriseToSunset node. However the output time study has a flag for solar analysis to be performed from the sunrise of the startDateTime input to sunset of the endDateTime input.
startDateTime_2 = DynamoSolarAnalysis.Analysis.TimeStudy.StartDateTime(timeStudy=fromSunriseToSunset)
watch_6 = Watch(startDateTime_2)
date_time_4 = DateTime("2017-01-18T14:46:00Z")  # graph input
date_time_5 = DateTime("2017-01-18T16:46:00Z")  # graph input
boolean_3 = BoolSelector(false)  # graph input
fromStartTimeToEndTime = DynamoSolarAnalysis.Analysis.TimeStudy.FromStartTimeToEndTime(startDateTime=date_time_4, endDateTime=date_time_5, usesDST=boolean_3)
endDateTime_3 = DynamoSolarAnalysis.Analysis.TimeStudy.EndDateTime(timeStudy=fromStartTimeToEndTime)
watch_7 = Watch(endDateTime_3)
isStillStudy_3 = DynamoSolarAnalysis.Analysis.TimeStudy.IsStillStudy(timeStudy=fromStartTimeToEndTime)
watch_8 = Watch(isStillStudy_3)
startDateTime_3 = DynamoSolarAnalysis.Analysis.TimeStudy.StartDateTime(timeStudy=fromStartTimeToEndTime)
watch_9 = Watch(startDateTime_3)
