# Dynamo graph 02-02_Primer_sample_BuildingPositioning.dyn (Dynamo 2.5.0.7460)
# packages: Solar Analysis for Dynamo 1.2.2, GenerativeDesign 1.3.0

# group: BUILDING POSITIONING Refinery Graph Example
# note: DYNAMO VERSION
# 2.0.2
# note: REQUIRED DYNAMO PACKAGES
# Solar Analysis for Dynamo, v1.2.2
# note: ADDITIONAL COMMENTS
# 1) Set the Manual Inputs:
#     a) Select surrounding buildings.
#     b) Select building mass.
#     c) Select site boundary model lines.
#     d) Set average floor to floor height in millimeters.
#     e) Define site coordinates (latitude and longitude).
# 2) Open Dynamo Refinery (View > Refinery...)
# 3) Create a New Study
# 4) Under generation method select Optimize
# 5) Under Inputs, all inputs should be selected.
# 6) On the outputs tab:
#     a) [OUT] Area Out (m2)- Set to Minimize
#     b) [OUT] Free Area (m2) - Set to Maximize
#     c) [OUT] Avg. Incidence / m2- Set to Minimize.
# 7) Fix any possible problems on the issues section
# 8) Click generate and wait for the outputs
# note: DYNAMO PROJECT
# REFINERY_BUILDING_POSITIONING
# note: ASSOCIATED FILE(S)
# dt_BuildingPositioning_02.rvt
# note: AUTHOR(S) / CREATION DATE
# designtech.io for Autodesk Refinery Team / Feb 2018
# note: DESCRIPTION
# The graph will iterate the position and rotation of the selected tower design, so it falls within the site boundary while minimizing the Solar Indicence by Area ratio.
# To avoid options that don't comply (outside of site boundary), the results are heavily penalized, saving computational time by making the analysis to fail on purpose.

# group: Dynamo Inputs
# note: Working / Functions
# Green indicates the working of the script. No changes should be made in these groups unless advised.
# note: Checking / Outputs
# Orange indicates checking nodes to ensure the script has deployed correctly.
select_site_boundary_lines = DSModelElementMutlipleSelection()  # nothing selected; graph input
# note: NOTE:
# Testing point location close to the edges of the actual boundary will fail as the building's footprint will lay outside of the plot.
# Setting a boundary offset inwards will limit the space where to position the building, returning more valid results (building inside of plot) for each generation.
# A HIGH offset results on a more limited space and therefore more valid options.
select_main_building = DSModelElementSelection()  # nothing selected; graph input
# note: Variables / Inputs
# Red indicates Variables that can be altered per project and must be set accordingly before running the script.
select_surrounding_buildings = DSModelElementMutlipleSelection()  # nothing selected; graph input

# group: Geometry [Revit/Dynamo]: Recreate site boundary line and surface
curve = CurveElement.Curve(curveElement=select_site_boundary_lines)
startPoint = Curve.StartPoint(curve=curve)

# group: Remember Site Boundary
remember = Data.Remember(startPoint)
code_block = CodeBlock(points=remember) { sitePolygon = Autodesk.DesignScript.Geometry.Polygon.ByPoints(points); }

# group: Geometry +Data [Revit/Dynamo]: Retrieve solid geometry from main building
solids = Element.Solids(element=select_main_building)
byUnion = Solid.ByUnion(solids=solids)
id = Element.Id(element=select_main_building)
centroid = Solid.Centroid(solid=solids)
X = Point.X(point=centroid)
Y = Point.Y(point=centroid)
boundingBox = Geometry.BoundingBox(geometry=solids)
minPoint = BoundingBox.MinPoint(boundingBox=boundingBox)
Z = Point.Z(point=minPoint)
byCoordinates = Point.ByCoordinates(x=X, y=Y, z=Z)

# group: Remember Building
remember_2 = Data.Remember(byUnion)
remember_3 = Data.Remember(id)
remember_4 = Data.Remember(byCoordinates)

# group: Project Units
string = StringInput("DUT_MILLIMETERS")
python_script = Python()
# ---------- python_script.python (21 lines) ----------
# Load the Python Standard and DesignScript Libraries
import clr
#imports the Revit API
clr.AddReference('RevitAPI')
from Autodesk.Revit.DB import *
#imports revit services and the document manager
clr.AddReference('RevitServices')
import RevitServices
from RevitServices.Persistence import DocumentManager

#gets the current document
doc = DocumentManager.Instance.CurrentDBDocument

# The inputs to this node will be stored as a list in the IN variables.
dataEnteringNode = IN

# Place your code below this line
unitType = str(Document.GetUnits(doc).GetFormatOptions(UnitType.UT_Length).DisplayUnits)

# Assign your output to the OUT variable.
OUT = unitType
# ----------------------------------------

remember_5 = Data.Remember(python_script)

# group (continued): Project Units
code_block_2 = CodeBlock(projectUnits=remember_5) { projectUnits; }
get_scale_factor_python = Python(IN[0]=string, IN[1]=code_block_2)
# ---------- get_scale_factor_python.python (31 lines) ----------
import clr
import sys

#sets the distance to convert as input 0
originalUnit = IN[0]
unitToConvert = IN[1]

#builds a hard coded list of dictionary values for the conversion factors
conversionToFeet = {
	"DUT_METERS":1/3.28084,
	"DUT_METERS_CENTIMETERS": 1/3.28084,
	"DUT_MILLIMETERS" : 304.8, 
	"DUT_CENTIMETERS" : 30.48, 
	"DUT_DECIMAL_FEET" : 1,
	"DUT_FEET_FRACTIONAL_INCHES": 1,
	"DUT_DECIMAL_INCHES" : 1/12.0, 
	"DUT_FRACTIONAL_INCHES" : 1/12.0
}

originalUnitInFeet = 1/conversionToFeet[originalUnit]

convertedUnit = originalUnitInFeet * conversionToFeet[unitToConvert]
convertedUnit = round(convertedUnit,10)
#gets the relevant conversion factor from the hard coded dictionary for the display units
#conversion = conversionFactors[unitType]/304.8

#multiplies the conversion factor by the distance to convert
#convertedValue = distance * conversion

# return the converted length value
OUT = convertedUnit
# ----------------------------------------

boundary_offset_mm = DoubleSlider(15000, range=0..35000 step 0.1)
average_floor_to_floor_distance = DoubleSlider(3000, range=0..3000 step 0.1)  # "Average Floor to Floor Distance (mm)"
code_block_3 = CodeBlock(scale=get_scale_factor_python, offset=boundary_offset_mm, avFloorToFloor=average_floor_to_floor_distance) { scale*offset; scale*avFloorToFloor; }

# group: Refinery Inputs
# note: POSITION INPUTS:
# These parameter will define the location of the building within the site boundary.
# note: NOTE:
# In order to see an 'Input' in Refinery, you have to right-click on a compatible node and check the 'Is Input' option. Rename the node to see a legible input name in Refinery.
in_u_parameter = DoubleSlider(0.51, range=0..1 step 0.01)  # graph input
in_v_parameter = DoubleSlider(0.24, range=0..1 step 0.01)  # graph input
in_building_rotation = IntegerSlider(15, range=0..360 step 5)  # graph input

code_block_4 = CodeBlock(buildingSolid=remember_2, buildingId=remember_3, buildingLocation=remember_4, offset=code_block_3.out0, avgFloorToFloor=code_block_3.out1, parameterU=in_u_parameter, parameterV=in_v_parameter, rotationDegrees=in_building_rotation) { buildingSolid; buildingId; buildingLocation; offset; avgFloorToFloor; parameterU; parameterV; rotationDegrees; }
code_block_5 = CodeBlock(rotationDegrees=code_block_4.rotationDegrees) { rotationDegrees; -rotationDegrees; }

# group: Visualize Geometry
code_block_6 = CodeBlock(sitePolygon=code_block, offset=code_block_4.offset, uParameter=code_block_4.parameterU, vParameter=code_block_4.parameterV)
# ---------- code_block_6.designscript (11 lines) ----------
sitePolygon;
offset;
uParameter;
vParameter;

// Offseting the boundary to limit the positioning space to a smaller scope.
offsetBoundary = Curve.Offset(sitePolygon, -offset);
siteSurface = Surface.ByPatch(offsetBoundary);

// Calculating surface point by parameters
surfacePoint = Surface.PointAtParameter(siteSurface,uParameter, vParameter);
# ----------------------------------------
code_block_7 = CodeBlock(surfacePoint=code_block_6.surfacePoint, avgFloorToFloor=code_block_4.avgFloorToFloor) { surfacePoint; avgFloorToFloor; }
byTwoPoints = Vector.ByTwoPoints(start=code_block_4.buildingLocation, end=code_block_7.surfacePoint)
translate = Geometry.Translate(geometry=code_block_4.buildingSolid, direction=byTwoPoints)
ZAxis = Vector.ZAxis()
rotate = Geometry.Rotate(geometry=translate, origin=code_block_7.surfacePoint, axis=ZAxis, degrees=code_block_5.rotationDegrees)
code_block_8 = CodeBlock(surfacePoint=code_block_7.surfacePoint, buildingSolid=rotate, avgFloorToFloor=code_block_7.avgFloorToFloor) { surfacePoint; buildingSolid; avgFloorToFloor; }

# group: Geometry [Dynamo]: Calculate the area of building outside site boundary
code_block_9 = CodeBlock(sitePolygon=code_block_6.sitePolygon, surfacePoint=code_block_8.surfacePoint, building=code_block_8.buildingSolid)
# ---------- code_block_9.designscript (5 lines) ----------
sitePolygon;
siteSurface = Surface.ByPatch(sitePolygon);
siteArea = siteSurface.Area;
cutPlane = Plane.ByOriginNormal(surfacePoint, Vector.ZAxis());
building;
# ----------------------------------------
intersect = Geometry.Intersect(geometry=code_block_9.building, other=code_block_9.cutPlane)
split = Geometry.Split(geometry=intersect, other=code_block_9.sitePolygon)
flatten = List.Flatten(list=split)
code_block_10 = CodeBlock(plotPolygon=code_block_9.sitePolygon, trimmed=flatten) { plotPolygon; trimmed; }
area = Surface.Area(surface=code_block_10.trimmed)
# note: INPUTS
# IN[0] = Site Boundary [plygn]
# IN[1] = Trimmed Surfaces [srf]
# OUPUT
# OUT = Is Inside The Site [bool]
surfaces_inside_plot = Python(IN[0]=code_block_10.plotPolygon, IN[1]=code_block_10.trimmed)
# ---------- surfaces_inside_plot.python (25 lines) ----------
# Enable Python support and load DesignScript library
import clr
clr.AddReference('ProtoGeometry')
from Autodesk.DesignScript.Geometry import *

# The inputs to this node will be stored as a list in the IN variables.
sitePolygon = IN[0]
trimmedSurfaces = IN[1]

def SurfaceInsidePolygon(surface, polygon):
	isInside = True
	
	for crv in surface.PerimeterCurves():
		midPoint = crv.PointAtParameter(0.5)
		
		isInside = Polygon.ContainmentTest(polygon, midPoint)
		
		if not isInside:
			break;
	
	return isInside
	
	
	
OUT = [SurfaceInsidePolygon(srf, sitePolygon) for srf in trimmedSurfaces]
# ----------------------------------------
filterByBoolMask = List.FilterByBoolMask(list=area, mask=surfaces_inside_plot)
sum = Math.Sum(values=filterByBoolMask.out)
sum_2 = Math.Sum(values=filterByBoolMask.in)
code_block_11 = CodeBlock(areaOutOfSite=sum, siteArea=code_block_9.siteArea, occupiedArea=sum_2)
# ---------- code_block_11.designscript (10 lines) ----------
// If building is out of site, the option is invalid and
// we'll penalize the results so to not be considered in Refinery
invalid = areaOutOfSite > 0;

// If invalid, penalize area out of side by 1000.
areaOut = invalid ?  areaOutOfSite * 1000 : areaOutOfSite;

// If invalid, penalize free area by -1000.
freeAreaOnPlot = (siteArea - occupiedArea) / 1000;
freaArea = invalid ? freeAreaOnPlot * -1 : freeAreaOnPlot;
# ----------------------------------------

location_coordinates = CodeBlock { latitude = 51.51304; longitude = -0.08655; }
code_block_12 = CodeBlock(buildingSolid=code_block_8.buildingSolid, buildingId=code_block_4.buildingId, rotationDegrees=code_block_5.out1, latitude=location_coordinates.latitude, longitude=location_coordinates.longitude, surfacePoint=code_block_8.surfacePoint) { buildingSolid; buildingId; rotationDegrees; latitude; longitude; surfacePoint; }
code_block_13 = CodeBlock(buildingSolid=code_block_12.buildingSolid, buildingId=code_block_12.buildingId, rotationDegree=code_block_12.rotationDegrees, latitude=code_block_12.latitude, longitude=code_block_12.longitude) { buildingSolid; buildingId; rotationDegree; latitude; longitude; }

# group: Math: Calculate intersection by level
code_block_14 = CodeBlock(buildingSolid=code_block_8.buildingSolid, surfacePoint=code_block_8.surfacePoint, averageF2F=code_block_8.avgFloorToFloor)
# ---------- code_block_14.designscript (13 lines) ----------
buildingSolid;
surfacePoint;
averageF2F;


// Calculating cut building height
buildingBbox = BoundingBox.ByGeometry(buildingSolid);
vector = Vector.ByTwoPoints(surfacePoint, buildingBbox.MaxPoint);
buildingHeight = vector.Z;

// Calculating avg levels and heights;
levels = Math.Floor(buildingHeight / averageF2F);
levelHeight = buildingHeight / levels;
# ----------------------------------------
code_block_15 = CodeBlock(buildingSolid=code_block_14.buildingSolid)
# ---------- code_block_15.designscript (9 lines) ----------
surfaces = Autodesk.Geometry.Explode(buildingSolid);
vectors = Surface.NormalAtParameter(surfaces, 0.5,0.5);

// Glazing surfaces are offset to avoid intersection with original faces
offsetSurfaces = Autodesk.Geometry.Translate(surfaces, vectors, 500);

// Filtering out horizontal surfaces
noHorizontal = !Vector.IsParallel(Vector.ZAxis(), vectors);
angles = Vector.AngleAboutAxis(vectors, Vector.YAxis(), Vector.ZAxis());
# ----------------------------------------
filterByBoolMask_2 = List.FilterByBoolMask(list=code_block_15.offsetSurfaces, mask=code_block_15.noHorizontal)
# note: INPUTS
# IN[0] = Angles with North [double]
# OUPUT
# OUT = Orientations [double]
orientation_mapping = Python(IN[0]=code_block_15.angles)
# ---------- orientation_mapping.python (31 lines) ----------
# Enable Python support and load DesignScript library
import clr
clr.AddReference('ProtoGeometry')
from Autodesk.DesignScript.Geometry import *

# The inputs to this node will be stored as a list in the IN variables.
dataEnteringNode = IN

# Place your code below this line
def Orientation(angle):

	if 360-22.5 < angle <= 22.5:
		return "N"		
	elif 22.5 < angle <= 67.5:
		return "NE"
	elif 67.5 < angle <= 112.5:
		return "E"
	elif 112.5 < angle <= 157.5:
		return "SE"
	elif 157.5 < angle <= 202.5:
		return "S"
	elif 202.5 < angle <= 247.5:
		return "SW"
	elif 247.5 < angle <= 292.5:
		return "W"
	else:
		return "NW"
	

# Assign your output to the OUT variable.
OUT = [Orientation(angle) for angle in IN[0]]
# ----------------------------------------
filterByBoolMask_3 = List.FilterByBoolMask(list=orientation_mapping, mask=code_block_15.noHorizontal)
code_block_16 = CodeBlock(analysisSurfaces=filterByBoolMask_2.in, selfShadingSurfaces=filterByBoolMask_2.out, orientations=filterByBoolMask_3.in, levelHeight=code_block_14.levelHeight) { analysisSurfaces; selfShadingSurfaces; orientations; levelHeight; }

# group: Geometry [Revit/Dynamo]: Retrieve solid geometry and height from surrounding buildings
code_block_17 = CodeBlock(surroundingBuildings=select_surrounding_buildings) { surroundingBuildings; }
elementType = Element.ElementType(element=code_block_17)
code_block_18 = CodeBlock { "Model"; "Height"; }
getParameterValueByName = Element.GetParameterValueByName(element=elementType, parameterName=code_block_18.out0)
code_block_19 = CodeBlock(model=getParameterValueByName) { model == "Building"; }
filterByBoolMask_4 = List.FilterByBoolMask(list=code_block_17, mask=code_block_19)
solids_2 = Element.Solids(element=filterByBoolMask_4.in)
flatten_2 = List.Flatten(list=solids_2)
getParameterValueByName_2 = Element.GetParameterValueByName(element=elementType, parameterName=code_block_18.out1)

# group: Remember Solids and Heights
remember_6 = Data.Remember(flatten_2)
remember_7 = Data.Remember(getParameterValueByName_2)
code_block_20 = CodeBlock(buildingSolids=remember_6, heights=remember_7) { buildingSolids; heights; }

# group: Filter: Get buildings higher than 30 meters
code_block_21 = CodeBlock(height=code_block_20.heights) { height >= 30 * 1000; }
filterByBoolMask_5 = List.FilterByBoolMask(list=code_block_20.buildingSolids, mask=code_block_21)
explode = Geometry.Explode(geometry=filterByBoolMask_5.in)
flatten_3 = List.Flatten(list=explode)

code_block_22 = CodeBlock(surroundingShading=flatten_3) { surroundingShading; }

# group: Logic: Generate Solar Analysis
code_block_23 = CodeBlock(invalidOption=code_block_11.invalid, latitud=code_block_13.latitude, longitud=code_block_13.longitude, analysisSurfaces=code_block_16.analysisSurfaces, surroundingShading=code_block_22, selfShading=code_block_16.selfShadingSurfaces, levelHeight=code_block_16.levelHeight)
# ---------- code_block_23.designscript (11 lines) ----------
invalidOption;

latitud;
longitud;

analysisSurfaces;

analysis = invalidOption ? null : analysisSurfaces;
shadings = DSCore.List.Join([surroundingShading, selfShading]);

spacing = levelHeight;
# ----------------------------------------
date_time = DateTime("2019-01-01T00:00:00Z")
date_time_2 = DateTime("2019-12-31T23:59:00Z")

byLatitudeLongitude = DynamoSolarAnalysis.Weather.Weather.ByLatitudeLongitude(latitude=code_block_23.latitud, longitude=code_block_23.longitud)
fromStartTimeToEndTime = DynamoSolarAnalysis.Analysis.TimeStudy.FromStartTimeToEndTime(startDateTime=date_time, endDateTime=date_time_2)
analyze = DynamoSolarAnalysis.Analysis.SolarAnalysis.Analyze(weather=byLatitudeLongitude, analysisSurfaces=code_block_23.analysis, shadingSurfaces=code_block_23.shadings, timeStudy=fromStartTimeToEndTime, spacing=code_block_23.spacing)

# group (continued): Logic: Generate Solar Analysis
# note: NOTE:
# This Solar Analisys node makes a call to a web service to calculate the solar incidence and depending on the amount of data it can take a while.
# As we don't want to calculate options when the building lies outside the boundary, we input a null value making the component fail, and penalizing the outputs later on.
code_block_24 = CodeBlock(surfaces=code_block_23.analysisSurfaces, calculationResult=analyze.Cumulative, analysisPoints=analyze.Calculation_Points) { surfaceAreas = surfaces.Area; calculationResult; analysisPoints; }

# group: Visualization: Solar Analysis Points
flatten_4 = List.Flatten(list=code_block_24.analysisPoints)
code_block_25 = CodeBlock()
# ---------- code_block_25.designscript (6 lines) ----------
// Colors
red = Color.ByARGB(100,255, 0, 0);
yellow = Color.ByARGB(100, 255, 255, 0);

colors = [yellow, red];
indices = [0,1];
# ----------------------------------------
flatten_5 = List.Flatten(list=code_block_24.calculationResult)
code_block_26 = CodeBlock { 0; 1; }
remapRange = Math.RemapRange(numbers=flatten_5, newMin=code_block_26.out0, newMax=code_block_26.out1)
color_range = ColorRange(colors=code_block_25.colors, indices=code_block_25.indices, value=remapRange)
byGeometryColor = Modifiers.GeometryColor.ByGeometryColor(geometry=flatten_4, color=color_range)
code_block_27 = CodeBlock(buildingSolid=code_block_13.rotationDegree) { buildingSolid; }

# group: Math: Analysis Results
code_block_28 = CodeBlock(surfaceAreas=code_block_24.surfaceAreas, calculationResult=code_block_24.calculationResult, analysisPoints=code_block_24.analysisPoints) { surfaceAreas; calculationResult; analysisPoints; }
flatten_6 = List.Flatten(list=code_block_28.surfaceAreas)
flatten_7 = List.Flatten(list=code_block_28.calculationResult@L3)
sum_3 = Math.Sum(values=flatten_7)
code_block_29 = CodeBlock(surfaceAreaByFace=flatten_6, resultsByFace=sum_3)  # unwired: glazingAreaByFace
# ---------- code_block_29.designscript (15 lines) ----------
surfaceAreaByFace;
resultsByFace;
glazingAreaByFace;

// If SolarIncidence is null,
// means is not a valid option
invalid = resultsByFace == null;

// Analysed areas in square meters
squareMeters = surfaceAreaByFace / 1000;

// If invalid, penalize incidence by 100000
incidenceByArea = invalid ? squareMeters * 100000 : resultsByFace/squareMeters;
avgSolar = Math.Average(incidenceByArea);
solarRounded = Math.Round(avgSolar,2);
# ----------------------------------------

# group: Outputs
# note: If Area Out is greater than 0, the options is invalid and all the outputs are penalized depending if they are to be maximized or minimized.
# note: NOTE:
# In order to see an "Output" in Refinery, you have to right-click on a compatible node and check the "is Output" option. Rename the node to see a legible output name in Refinery.
out_area_out_m2 = Watch(code_block_11.areaOut)  # graph output
out_free_area_m2 = Watch(code_block_11.freaArea)  # graph output
out_avg_incidence_m2 = Watch(code_block_29.solarRounded)  # graph output

watch = Watch(code_block_11.freeAreaOnPlot)

# group: Data Gate Building ID
gate = Data.Gate(false, code_block_13.buildingId)

code_block_30 = CodeBlock(degrees=code_block_13.rotationDegree) { degrees; }

# group: Create Revit Building
elements_from_id = Python(IN[0]=gate)
# ---------- elements_from_id.python (29 lines) ----------
import clr
clr.AddReference('RevitAPI')
clr.AddReference("RevitNodes")
clr.AddReference("RevitServices")
from Autodesk.Revit.DB import *
import Revit
clr.ImportExtensions(Revit.Elements)
import RevitServices
from RevitServices.Persistence import DocumentManager
from RevitServices.Transactions import TransactionManager

doc = DocumentManager.Instance.CurrentDBDocument
TransactionManager.Instance.EnsureInTransaction(doc)

ids = IN[0]
if not isinstance(ids, list):
	ids = [ids]

elemIds = []
for id in ids:
    elemIds.append(ElementId(id))

elems = []
for elemId in elemIds:
	elems.append(doc.GetElement(elemId))
	
TransactionManager.Instance.TransactionTaskDone()

OUT = elems
# ----------------------------------------
code_block_31 = CodeBlock(x=elements_from_id) { x[0]; }
elementType_2 = Element.ElementType(element=code_block_31)
byPoint = FamilyInstance.ByPoint(familyType=elementType_2, point=code_block_12.surfacePoint)
setRotation = FamilyInstance.SetRotation(familyInstance=byPoint, degree=code_block_30)

code_block_32 = CodeBlock(offsetBoundary=code_block_6.offsetBoundary) { offsetBoundary; }
