# Dynamo graph dt_GenerativeToolkit_Visibility_LinesTest(RVT).dyn "dt_Refinery Toolkit_Visibility_LinesTest(RVT)" (Dynamo 2.0.2.6826)

# group: Get Desk point
select_model_element = DSModelElementSelection()  # 1 picked in the model
family_types = FamilyTypes(index=24)
all_elements_of_family_type = ElementsOfFamilyType(Family_Type=family_types)
getLocation = Element.GetLocation(element=all_elements_of_family_type)
code_block = CodeBlock { 100; }
byCenterPointRadius = Circle.ByCenterPointRadius(centerPoint=getLocation, radius=code_block)

# group: Translate Window location points to the right plane
categories = Categories(index=619)
all_elements_of_category = ElementsOfCategory(Category=categories)
getLocation_2 = Element.GetLocation(element=all_elements_of_category)
X = Point.X(point=getLocation_2)
Y = Point.Y(point=getLocation_2)
byCoordinates = Point.ByCoordinates(x=X, y=Y)

# group: Get Room boundaries as Polygons
categories_2 = Categories(index=425)
all_elements_of_category_2 = ElementsOfCategory(Category=categories_2)
area = Room.Area(room=all_elements_of_category_2)
code_block_2 = CodeBlock { 0; }
le = area <= code_block_2
filterByBoolMask = List.FilterByBoolMask(list=all_elements_of_category_2, mask=le)
coreBoundary = Room.CoreBoundary(room=filterByBoolMask.out)
buildPolygons = GraphicalDynamo.Geometry.Curves.BuildPolygons(lines=coreBoundary)
flatten = List.Flatten(list=buildPolygons.polygons)

# group: Combine intersecting rooms seperated only by boundary lines
byPatch = Surface.ByPatch(closedCurve=flatten)
thicken = Surface.Thicken(surface=byPatch)
byUnion = Solid.ByUnion(solids=thicken)
byOriginNormal = Plane.ByOriginNormal()
intersect = Geometry.Intersect(geometry=byUnion, other=byOriginNormal)
perimeterCurves = Surface.PerimeterCurves(surface=intersect)
startPoint = Curve.StartPoint(curve=perimeterCurves)
byPoints = Polygon.ByPoints(points=startPoint)

# group: Translate points to wall internal side
getHost = FamilyInstance.GetHost(familyInstance=all_elements_of_category)
getLocation_3 = Element.GetLocation(element=getHost)
direction = Line.Direction(line=getLocation_3)
code_block_3 = CodeBlock { DesignScript.Vector.ZAxis(); 90; }
rotate = Vector.Rotate(vector=direction, axis=code_block_3.out0, degrees=code_block_3.out1)
elementType = Element.ElementType(element=getHost)
code_block_4 = CodeBlock { "Width"; }
getParameterValueByName = Element.GetParameterValueByName(element=elementType, parameterName=code_block_4)
code_block_5 = CodeBlock(x=getParameterValueByName) { [x/2,x/-2]; }
translate = Geometry.Translate(geometry=byCoordinates, direction=rotate, distance=code_block_5@L2)
transpose = List.Transpose(lists=translate)
transpose_2 = List.Transpose(lists=translate)
doesIntersect = Geometry.DoesIntersect(geometry=transpose_2@@L1, other=byPoints@L2, lacing=Longest)
boolean = BoolSelector(true)
eq = _ == boolean  # unwired: x
trueForAny = List.TrueForAny(list=doesIntersect@@L2, predicate=eq, lacing=Longest)
filterByBoolMask_2 = List.FilterByBoolMask(list=transpose, mask=trueForAny, lacing=Shortest)
flatten_2 = List.Flatten(list=filterByBoolMask_2.in)

# group: Create window segments
elementType_2 = Element.ElementType(element=all_elements_of_category)
code_block_6 = CodeBlock { "Width"; }
getParameterValueByName_2 = Element.GetParameterValueByName(element=elementType_2, parameterName=code_block_6)
code_block_7 = CodeBlock(windowWidth=getParameterValueByName_2) { [windowWidth/2,-windowWidth/2]; }
translate_2 = Geometry.Translate(geometry=flatten_2, direction=direction, distance=code_block_7@L2)
code_block_8 = CodeBlock(x=translate_2) { startPt = x[0]; endPt = x[1]; }
byStartPointEndPoint = Line.ByStartPointEndPoint(startPoint=code_block_8.startPt, endPoint=code_block_8.endPt)

# group: Internals - Column Polygons
categories_3 = Categories(index=122)
all_elements_of_category_3 = ElementsOfCategory(Category=categories_3)
getLocation_4 = Element.GetLocation(element=all_elements_of_category_3)
byOrigin = CoordinateSystem.ByOrigin(origin=getLocation_4)
type = archilab.Revit.Elements.Elements.Type(element=all_elements_of_category_3)
code_block_9 = CodeBlock { "Depth"; "Width"; }
getParameterValueByName_3 = Element.GetParameterValueByName(element=type, parameterName=code_block_9.out1)
getParameterValueByName_4 = Element.GetParameterValueByName(element=type, parameterName=code_block_9.out0)
byWidthLength = Rectangle.ByWidthLength(cs=byOrigin, width=getParameterValueByName_3, length=getParameterValueByName_4)

# group: Refinery Toolkit - Views to outside
ofLinesFromOrigin = Autodesk.RefineryToolkits.SpacePlanning.Analyze.Visibility.OfLinesFromOrigin(origin=byCenterPointRadius, targetLines=byStartPointEndPoint, boundary=byPoints, obstructions=byWidthLength)
watch = Watch(ofLinesFromOrigin.Percentage_visible)
