# Dynamo graph ThreeSolidTower_SolarAnalysis_Final_2PT.dyn (Dynamo 2.3.0.5885)
# packages: Solar Analysis for Dynamo 1.2.2, Refinery 0.35.0, Refinery Toolkit for Massing [Revit] 0.0.1

# group: ThreeSolidTower-04 Solar Analysis
# note: ADDITIONAL COMMENTS
# N/A
# note: REQUIRED DYNAMO PACKAGES
# -Package Manager
# Ampersand
# Solar Analysis for Dynamo
# -Manual Install
# Refinery Toolkit for Massing
# Refinery Toolkit for Space Planning
# https://github.com/DynamoDS/RefineryToolkits
# note: DYNAMO PROJECT
# ThreeSolidTower_SolarAnalysis_Final_2PT.dyn
# ThreeSolidTower_SolarAnalysis_Final_4PT.dyn
# note: ASSOCIATED FILE(S)
# UrbanContextWithPark_2020_Final_I
# note: AUTHOR(S) / CREATION DATE
# Varvara Toulkeridou, Refinery Team; varvara.toulkeridou@autodesk.com
# Vina Rahimian, Sustainability and Foundation team / Penn State; vina.rahimian@autodesk.com, vina@psu.edu
# Justin Elliott, MG aec; justin.elliott@mg-aec.com
# Jarod Schultz, MG aec; jarod.schultz@mg-aec.com
# November 2019
# note: DESCRIPTION
# This example uses site context and a zoning boundary created in Revit to create a generative building form with solar radiation as the key focus. With the building form you can vary different options; parcel and zoning restrictions, floor to floor height, window to wall ratio (WWR), corner distance inputs (building shape), date/time, and more. Outputs include; solar exposure on roof/floors, floor area ratio (FAR), floor space index (FSI), and WWR.
# With these metrics established it will help inform us of our goals for minimizing WWR, maximize exposure on floors and roofs, and computing the FAR.
# note: DYNAMO VERSION
# 2.0.2+

# group: INPUT: Select site volume from Revit
# note: Select a Revit mass representing the volumetric constraints of a site (heights, setbacks, etc)
select_model_element = DSModelElementSelection()  # 1 picked in the model

# group: INPUT: Tower corner locations
base_corner_selection = IntegerSlider(2, range=1..2 step 1)  # graph input
base_corner_adjustment = DoubleSlider(0.5, range=0.5..1 step 0.1)  # graph input
middle_corner_selection = IntegerSlider(2, range=1..2 step 1)  # graph input
middle_corner_adjustment = DoubleSlider(0.5, range=0.5..1 step 0.1)  # graph input
top_corner_selection = IntegerSlider(2, range=1..2 step 1)  # graph input
top_corner_adjustment = DoubleSlider(0.5, range=0.5..1 step 0.1)  # graph input

# group: INPUT: Floor heights
floorHeight = DoubleSlider(12, range=10..16 step 1)

# group: ANALYZE: Finding the north vector from revit
YAxis = Vector.YAxis()
ZAxis = Vector.ZAxis()
categories = Categories("OST_ProjectBasePoint")
all_elements_of_category = ElementsOfCategory(Category=categories)
code_block = CodeBlock(x=all_elements_of_category) { x[0]; }
code_block_2 = CodeBlock { "Angle to True North"; }
getParameterValueByName = Element.GetParameterValueByName(element=code_block, parameterName=code_block_2)
remember = Data.Remember(getParameterValueByName)
rotate = Vector.Rotate(vector=YAxis, axis=ZAxis, degrees=remember)
code_block_3 = CodeBlock(northVector=rotate) { northVector; }

# group: INPUT: WWR
wwr_east = IntegerSlider(40, range=5..95 step 5)  # graph input
wwr_north = IntegerSlider(40, range=5..95 step 5)  # graph input
wwr_west = IntegerSlider(40, range=5..95 step 5)  # graph input
wwr_south = IntegerSlider(40, range=5..95 step 5)  # graph input

# group: INPUT: Select urban context from Revit
# note: Select a Revit mass representing the urban context.
select_model_element_2 = DSModelElementSelection()  # 1 picked in the model

# group: INTEGRATE: Convert to Dynamo objects
solids = Element.Solids(element=select_model_element)
remember_2 = Data.Remember(solids)
byUnion = Solid.ByUnion(solids=remember_2)
solids_2 = Element.Solids(element=select_model_element_2)
remember_3 = Data.Remember(solids_2)

# group: DISPLAY: Color zoning boundary
bySolid = PolySurface.BySolid(solid=byUnion)
surfaces = PolySurface.Surfaces(polySurface=bySolid)
perimeterCurves = Surface.PerimeterCurves(surface=surfaces)
color_palette = ColorPalette({R: 255, G: 20, B: 147, A: 255})
byGeometryColor = Modifiers.GeometryColor.ByGeometryColor(geometry=perimeterCurves, color=color_palette)

# group: EXTRACT: Upper limits of zoning boundary
code_block_4 = CodeBlock { 0.5; }
pointAtParameter = Surface.PointAtParameter(surface=surfaces, u=code_block_4, v=code_block_4)
normalAtParameter = Surface.NormalAtParameter(surface=surfaces, u=code_block_4, v=code_block_4)
Z = Vector.Z(vector=normalAtParameter)
string_from_object = FromObject(obj=Z)
code_block_5 = CodeBlock { "1"; }
contains = String.Contains(str=string_from_object, searchFor=code_block_5)
filterByBoolMask = List.FilterByBoolMask(list=pointAtParameter, mask=contains)

# group: CREATE
list_create = List.Create(item0=filterByBoolMask.in)
Z_2 = Point.Z(point=list_create)
sort = List.Sort(list=Z_2)
flatten = List.Flatten(list=sort)

# group: EXTRACT: Creating tower locations based on zoning
watch = Watch(remember_2)
explode = Geometry.Explode(geometry=watch)
code_block_6 = CodeBlock { 0.5; }
normalAtParameter_2 = Surface.NormalAtParameter(surface=explode, u=code_block_6, v=code_block_6)
Z_3 = Vector.Z(vector=normalAtParameter_2)
string_from_object_2 = FromObject(obj=Z_3)
code_block_7 = CodeBlock { "1"; }
contains_2 = String.Contains(str=string_from_object_2, searchFor=code_block_7)
filterByBoolMask_2 = List.FilterByBoolMask(list=explode, mask=contains_2)
pointAtParameter_2 = Surface.PointAtParameter(surface=filterByBoolMask_2.in, u=code_block_6, v=code_block_6)
Z_4 = Point.Z(point=pointAtParameter_2)
code_block_8 = CodeBlock { -1; }
# note: Z values of all but top plane of zoning.
dropItems = List.DropItems(list=flatten, amount=code_block_8)
eq = Z_4@L2 == dropItems@L1
filterByBoolMask_3 = List.FilterByBoolMask(list=filterByBoolMask_2.in, mask=eq)
list_create_2 = List.Create(item0=filterByBoolMask_3.in)

# group: EXTRACT
code_block_9 = CodeBlock { 2; }
# note: Bottom Zoning surfaces
flatten_2 = List.Flatten(list=list_create_2, amt=code_block_9)
perimeterCurves_2 = Surface.PerimeterCurves(surface=flatten_2)
endPoint = Curve.EndPoint(curve=perimeterCurves_2)
code_block_10 = CodeBlock { 0.5; }
# note: Centers of surfaces
pointAtParameter_3 = Surface.PointAtParameter(surface=flatten_2, u=code_block_10, v=code_block_10)

# group: CREATE: Tower Base
code_block_11 = CodeBlock { 0; }
getItemAtIndex = List.GetItemAtIndex(list=endPoint, index=code_block_11)
code_block_12 = CodeBlock { 2; }
shiftIndices = List.ShiftIndices(list=getItemAtIndex, amount=code_block_12)
# note: Center point.
getItemAtIndex_2 = List.GetItemAtIndex(list=pointAtParameter_3, index=code_block_11)
# note: Corner point we are changing.
getItemAtIndex_3 = List.GetItemAtIndex(list=shiftIndices, index=base_corner_selection)
byStartPointEndPoint = Line.ByStartPointEndPoint(startPoint=getItemAtIndex_2, endPoint=getItemAtIndex_3)
pointAtParameter_4 = Curve.PointAtParameter(curve=byStartPointEndPoint, param=base_corner_adjustment)
replaceItemAtIndex = List.ReplaceItemAtIndex(list=shiftIndices, index=base_corner_selection, item=pointAtParameter_4)
code_block_13 = CodeBlock { true; }
byPoints = PolyCurve.ByPoints(points=replaceItemAtIndex, connectLastToFirst=code_block_13)

# group: CREATE: Middle Tower
code_block_14 = CodeBlock { 1; }
getItemAtIndex_4 = List.GetItemAtIndex(list=endPoint, index=code_block_14)
# note: Center point.
getItemAtIndex_5 = List.GetItemAtIndex(list=pointAtParameter_3, index=code_block_14)
# note: Corner point we are changing.
getItemAtIndex_6 = List.GetItemAtIndex(list=getItemAtIndex_4, index=middle_corner_selection)
byStartPointEndPoint_2 = Line.ByStartPointEndPoint(startPoint=getItemAtIndex_5, endPoint=getItemAtIndex_6)
pointAtParameter_5 = Curve.PointAtParameter(curve=byStartPointEndPoint_2, param=middle_corner_adjustment)
replaceItemAtIndex_2 = List.ReplaceItemAtIndex(list=getItemAtIndex_4, index=middle_corner_selection, item=pointAtParameter_5)
code_block_15 = CodeBlock { true; }
byPoints_2 = PolyCurve.ByPoints(points=replaceItemAtIndex_2, connectLastToFirst=code_block_15)

# group: CREATE: Top Tower
code_block_16 = CodeBlock { 2; }
getItemAtIndex_7 = List.GetItemAtIndex(list=endPoint, index=code_block_16)
# note: Center point.
getItemAtIndex_8 = List.GetItemAtIndex(list=pointAtParameter_3, index=code_block_16)
# note: Corner point we are changing.
getItemAtIndex_9 = List.GetItemAtIndex(list=getItemAtIndex_7, index=top_corner_selection)
byStartPointEndPoint_3 = Line.ByStartPointEndPoint(startPoint=getItemAtIndex_8, endPoint=getItemAtIndex_9)
pointAtParameter_6 = Curve.PointAtParameter(curve=byStartPointEndPoint_3, param=top_corner_adjustment)
replaceItemAtIndex_3 = List.ReplaceItemAtIndex(list=getItemAtIndex_7, index=top_corner_selection, item=pointAtParameter_6)
code_block_17 = CodeBlock { true; }
byPoints_3 = PolyCurve.ByPoints(points=replaceItemAtIndex_3, connectLastToFirst=code_block_17)

# group: CREATE: List of three floor plates with Z of 0
byPatch = Surface.ByPatch(closedCurve=byPoints)
byPatch_2 = Surface.ByPatch(closedCurve=byPoints_2)
code_block_18 = CodeBlock { 0.5; }
pointAtParameter_7 = Surface.PointAtParameter(surface=byPatch_2, u=code_block_18, v=code_block_18)
Z_5 = Point.Z(point=pointAtParameter_7)
code_block_19 = CodeBlock(x=Z_5) { -x; }
translate = Geometry.Translate(geometry=byPatch_2, zTranslation=code_block_19)
byPatch_3 = Surface.ByPatch(closedCurve=byPoints_3)
code_block_20 = CodeBlock { 0.5; }
pointAtParameter_8 = Surface.PointAtParameter(surface=byPatch_3, u=code_block_20, v=code_block_20)
Z_6 = Point.Z(point=pointAtParameter_8)
code_block_21 = CodeBlock(x=Z_6) { -x; }
translate_2 = Geometry.Translate(geometry=byPatch_3, zTranslation=code_block_21)
list_create_3 = List.Create(item0=byPatch, item1=translate, item2=translate_2)

# group: EXTRACT: zoning volume top z value
restOfItems = List.RestOfItems(list=flatten)

# group: EXTRACT: Creating an accurate list of floor heights based on zoning allowances.
code_block_22 = CodeBlock { 0; }
watch_2 = Watch(restOfItems)
deconstruct = List.Deconstruct(list=watch_2)
watch_3 = Watch(floorHeight)
div = deconstruct.first / watch_3
floor = Math.Floor(number=div)
sequence = Sequence(start=code_block_22, amount=floor, step=watch_3)
lastItem = List.LastItem(list=sequence)
code_block_23 = CodeBlock(x=lastItem, f=watch_3) { x+f; }
deconstruct_2 = List.Deconstruct(list=deconstruct.rest)
sub = deconstruct_2.first - code_block_23
div_2 = sub / watch_3
floor_2 = Math.Floor(number=div_2)
sequence_2 = Sequence(start=code_block_23, amount=floor_2, step=watch_3)
lastItem_2 = List.LastItem(list=sequence_2)
code_block_24 = CodeBlock(x=lastItem_2, f=watch_3) { x+f; }
deconstruct_3 = List.Deconstruct(list=deconstruct_2.rest)
sub_2 = deconstruct_3.first - code_block_24
div_3 = sub_2 / watch_3
floor_3 = Math.Floor(number=div_3)
sequence_3 = Sequence(start=code_block_24, amount=floor_3, step=watch_3)
list_create_4 = List.Create(item0=sequence, item1=sequence_2, item2=sequence_3)

# group: CREATE: Move floor plates to floor levels.
translate_3 = Geometry.Translate(geometry=list_create_3, zTranslation=list_create_4@L3)
flatten_3 = List.Flatten(list=translate_3)

# group: ANALYZE: Direction of all floors
code_block_25 = CodeBlock(floors=flatten_3) { floors; }
code_block_26 = CodeBlock { 0.5; }
normalAtParameter_3 = Surface.NormalAtParameter(surface=code_block_25, u=code_block_26, v=code_block_26)
Z_7 = Vector.Z(vector=normalAtParameter_3)
code_block_27 = CodeBlock { -1; }
eq_2 = Z_7 == code_block_27
# note: This step is an important one in running solar analysis. If the z parameter of surface normals are -1 (meaning they’re facing down) the analysis values will be all the same (blank). This if condition evaluates the direction of the surfaces and mirrors them if they're facing downwards.
code_block_28 = CodeBlock { 0.5; }
pointAtParameter_9 = Surface.PointAtParameter(surface=code_block_25, u=code_block_28, v=code_block_28)
byOriginNormal = Plane.ByOriginNormal(origin=pointAtParameter_9, normal=normalAtParameter_3)
mirror = Geometry.Mirror(geometry=code_block_25, mirrorPlane=byOriginNormal)
if_ = If(test=eq_2, true=mirror, false=code_block_25)

# group: CREATE: Create floor slice
code_block_29 = CodeBlock(depth=floorHeight) { depth; }
code_block_30 = CodeBlock { false; }
thicken = Surface.Thicken(surface=if_, thickness=code_block_29, both_sides=code_block_30)
deconstructFacadeShell = Autodesk.RefineryToolkits.MassingSandbox.Generate.Building.DeconstructFacadeShell(solid=thicken)

# group: CREATE: Grouping facades by north-south-east-west directions
flatten_4 = List.Flatten(list=deconstructFacadeShell.verticalSrfList)
code_block_31 = CodeBlock { 0.5; }
normalAtParameter_4 = Surface.NormalAtParameter(surface=deconstructFacadeShell.verticalSrfList, u=code_block_31, v=code_block_31)
dot = Vector.Dot(vector=normalAtParameter_4, vec=code_block_3)
cross = Vector.Cross(vector=normalAtParameter_4, cross=code_block_3)
Z_8 = Vector.Z(vector=cross)
code_block_32 = CodeBlock(dot=dot, cross=Z_8) { x = Math.Sin(45); dot>=x ? "North" : (dot<=-x ? "South" : (cross>x ? "East" : "West")); }
flatten_5 = List.Flatten(list=code_block_32.out1)
groupByKey = List.GroupByKey(list=flatten_4, keys=flatten_5)

north = CodeBlock(a=groupByKey.groups) { a[0]; }

# group: CREATE: Create openings on north-facing facades
code_block_33 = CodeBlock(surface=north) { surface; }
list_create_5 = List.Create(item0=code_block_33)
flatten_6 = List.Flatten(list=list_create_5)
code_block_34 = CodeBlock { 0.5; }
pointAtParameter_10 = Surface.PointAtParameter(surface=flatten_6, u=code_block_34, v=code_block_34)
normalAtPoint = Surface.NormalAtPoint(surface=flatten_6, point=pointAtParameter_10)
byOriginNormal_2 = Plane.ByOriginNormal(origin=pointAtParameter_10, normal=normalAtPoint)
code_block_35 = CodeBlock(WWR=wwr_east) { WWR/100; }
sqrt = Math.Sqrt(number=code_block_35)
scale = Geometry.Scale(geometry=flatten_6, plane=byOriginNormal_2, xamount=sqrt, yamount=sqrt)
perimeterCurves_3 = Surface.PerimeterCurves(surface=scale)
byJoinedCurves = PolyCurve.ByJoinedCurves(curves=perimeterCurves_3)
byPatch_4 = Surface.ByPatch(closedCurve=byJoinedCurves)
code_block_36 = CodeBlock { 2; }
thicken_2 = Surface.Thicken(surface=byPatch_4, thickness=code_block_36)
subtractFrom = Surface.SubtractFrom(surface=code_block_33, trimmingEntity=thicken_2)
flatten_7 = List.Flatten(list=subtractFrom)

west = CodeBlock(a=groupByKey.groups) { a[1]; }

# group: CREATE: Create openings on west-facing facades
code_block_37 = CodeBlock(surface=west) { surface; }
list_create_6 = List.Create(item0=code_block_37)
flatten_8 = List.Flatten(list=list_create_6)
code_block_38 = CodeBlock { 0.5; }
pointAtParameter_11 = Surface.PointAtParameter(surface=flatten_8, u=code_block_38, v=code_block_38)
normalAtPoint_2 = Surface.NormalAtPoint(surface=flatten_8, point=pointAtParameter_11)
byOriginNormal_3 = Plane.ByOriginNormal(origin=pointAtParameter_11, normal=normalAtPoint_2)
code_block_39 = CodeBlock(WWR=wwr_north) { WWR/100; }
sqrt_2 = Math.Sqrt(number=code_block_39)
scale_2 = Geometry.Scale(geometry=flatten_8, plane=byOriginNormal_3, xamount=sqrt_2, yamount=sqrt_2)
perimeterCurves_4 = Surface.PerimeterCurves(surface=scale_2)
byJoinedCurves_2 = PolyCurve.ByJoinedCurves(curves=perimeterCurves_4)
byPatch_5 = Surface.ByPatch(closedCurve=byJoinedCurves_2)
code_block_40 = CodeBlock { 2; }
thicken_3 = Surface.Thicken(surface=byPatch_5, thickness=code_block_40)
subtractFrom_2 = Surface.SubtractFrom(surface=code_block_37, trimmingEntity=thicken_3)
flatten_9 = List.Flatten(list=subtractFrom_2)

south = CodeBlock(a=groupByKey.groups) { a[2]; }

# group: CREATE: Create openings on south-facing facades
code_block_41 = CodeBlock(surface=south) { surface; }
code_block_42 = CodeBlock { 0.5; }
code_block_43 = CodeBlock(WWR=wwr_west) { WWR/100; }
sqrt_3 = Math.Sqrt(number=code_block_43)
code_block_44 = CodeBlock { 2; }

list_create_7 = List.Create(item0=code_block_41)

# group (continued): CREATE: Create openings on south-facing facades
flatten_10 = List.Flatten(list=list_create_7)
pointAtParameter_12 = Surface.PointAtParameter(surface=flatten_10, u=code_block_42, v=code_block_42)
normalAtPoint_3 = Surface.NormalAtPoint(surface=flatten_10, point=pointAtParameter_12)
byOriginNormal_4 = Plane.ByOriginNormal(origin=pointAtParameter_12, normal=normalAtPoint_3)
scale_3 = Geometry.Scale(geometry=flatten_10, plane=byOriginNormal_4, xamount=sqrt_3, yamount=sqrt_3)

perimeterCurves_5 = Surface.PerimeterCurves(surface=scale_3)

# group (continued): CREATE: Create openings on south-facing facades
byJoinedCurves_3 = PolyCurve.ByJoinedCurves(curves=perimeterCurves_5)
byPatch_6 = Surface.ByPatch(closedCurve=byJoinedCurves_3)
thicken_4 = Surface.Thicken(surface=byPatch_6, thickness=code_block_44)
subtractFrom_3 = Surface.SubtractFrom(surface=code_block_41, trimmingEntity=thicken_4)
flatten_11 = List.Flatten(list=subtractFrom_3)

east = CodeBlock(a=groupByKey.groups) { a[3]; }

# group: CREATE: Create openings on east-facing facades
code_block_45 = CodeBlock(surface=east) { surface; }
list_create_8 = List.Create(item0=code_block_45)
flatten_12 = List.Flatten(list=list_create_8)
code_block_46 = CodeBlock { 0.5; }
pointAtParameter_13 = Surface.PointAtParameter(surface=flatten_12, u=code_block_46, v=code_block_46)
normalAtPoint_4 = Surface.NormalAtPoint(surface=flatten_12, point=pointAtParameter_13)
byOriginNormal_5 = Plane.ByOriginNormal(origin=pointAtParameter_13, normal=normalAtPoint_4)
code_block_47 = CodeBlock(WWR=wwr_south) { WWR/100; }
sqrt_4 = Math.Sqrt(number=code_block_47)
scale_4 = Geometry.Scale(geometry=flatten_12, plane=byOriginNormal_5, xamount=sqrt_4, yamount=sqrt_4)
perimeterCurves_6 = Surface.PerimeterCurves(surface=scale_4)
byJoinedCurves_4 = PolyCurve.ByJoinedCurves(curves=perimeterCurves_6)
byPatch_7 = Surface.ByPatch(closedCurve=byJoinedCurves_4)
code_block_48 = CodeBlock { 2; }
thicken_5 = Surface.Thicken(surface=byPatch_7, thickness=code_block_48)
subtractFrom_4 = Surface.SubtractFrom(surface=code_block_45, trimmingEntity=thicken_5)
flatten_13 = List.Flatten(list=subtractFrom_4)

list_create_9 = List.Create(item0=byPatch_4, item1=byPatch_5, item2=byPatch_6, item3=byPatch_7)

# group: OUTPUT - Compute Window to Wall Ratio for Entire Building
flatten_14 = List.Flatten(list=list_create_9)
area = Surface.Area(surface=flatten_14)
sum = Math.Sum(values=area)
area_2 = Surface.Area(surface=deconstructFacadeShell.verticalSrfList)
flatten_15 = List.Flatten(list=area_2)
sum_2 = Math.Sum(values=flatten_15)
div_4 = sum / sum_2
WWR = Watch(div_4)  # graph output

list_create_10 = List.Create(item0=remember_3)

# group: EXTRACT: Urban context
code_block_49 = CodeBlock(urbanContextSolids=list_create_10) { urbanContextSolids; }
explode_2 = Geometry.Explode(geometry=code_block_49)
flatten_16 = List.Flatten(list=explode_2)

byUnion_2 = Solid.ByUnion(solids=thicken)

# group: EXTRACT: Solar analysis evaluator; get horizontal surfaces
deconstructFacadeShell_2 = Autodesk.RefineryToolkits.MassingSandbox.Generate.Building.DeconstructFacadeShell(solid=byUnion_2)
lastItem_3 = List.LastItem(list=deconstructFacadeShell_2.horizontalSrfList)
code_block_50 = CodeBlock { -1; }
dropItems_2 = List.DropItems(list=deconstructFacadeShell_2.horizontalSrfList, amount=code_block_50)
code_block_51 = CodeBlock(groundLevel=lastItem_3, topLevels=dropItems_2) { groundLevel; topLevels; }

list_create_11 = List.Create(item0=flatten_7, item1=flatten_9, item2=flatten_11, item3=flatten_13)
flatten_17 = List.Flatten(list=list_create_11)

# group: DISPLAY: All shading objects
# note: Make sure all shading object are 'surfaces'
code_block_52 = CodeBlock(contextSurfaces=flatten_16, floors=if_, roofs=code_block_51.topLevels, facades=flatten_17) { contextSurfaces; floors; roofs; facades; }
list_create_12 = List.Create(item0=code_block_52.contextSurfaces, item1=code_block_52.floors, item2=code_block_52.roofs, item3=code_block_52.facades)
flatten_18 = List.Flatten(list=list_create_12)

# group: INPUT: Still: Soltices
summer_soltice = DateTime("2019-06-20T12:00:00")
still = DynamoSolarAnalysis.Analysis.TimeStudy.Still(dateTime=summer_soltice)
winter_soltice = DateTime("2019-12-21T12:00:00")

# group: INPUT: Feed Date Time Here
code_block_53 = CodeBlock(TimeSelection=still) { TimeSelection; }

# group: INPUT: Set the location - Denver, CO
code_block_54 = CodeBlock { 39.750412; -105.000558; }
byLatitudeLongitude = DynamoSolarAnalysis.Weather.Weather.ByLatitudeLongitude(latitude=code_block_54.out0, longitude=code_block_54.out1)

spacing = DoubleSlider(10, range=0..100 step 0.1)

# group: DISPLAY: Solar analysis for floors
code_block_55 = CodeBlock(floors=code_block_52.floors, shadingSurfaces=flatten_18, timeStudy=code_block_53, weather=byLatitudeLongitude, analysisSpacing=spacing) { floors; shadingSurfaces; timeStudy; weather; analysisSpacing; }
code_block_56 = CodeBlock { yellow=Color.ByARGB(255,255,255,0); black=Color.ByARGB(0,0,0,0); colors = [black, yellow]; indices=[0,1]; }
analyze = DynamoSolarAnalysis.Analysis.SolarAnalysis.Analyze(weather=code_block_55.weather, analysisSurfaces=code_block_55.floors, shadingSurfaces=code_block_55.shadingSurfaces, timeStudy=code_block_55.timeStudy, spacing=code_block_55.analysisSpacing)
flatten_19 = List.Flatten(list=analyze.Cumulative)
maximumItem = List.MaximumItem(list=flatten_19)
code_block_57 = CodeBlock(n=analyze.Cumulative, max=maximumItem) { n/max; }
color_range = ColorRange(colors=code_block_56.colors, indices=code_block_56.indices, value=code_block_57)
bySurfaceColors = Modifiers.GeometryColor.BySurfaceColors(surface=code_block_55.floors, colors=color_range)

# group: OUTPUT - Exposure on Floors
average = Math.Average(numbers=flatten_19)
aef_average_exposure_on_floors = Watch(average)  # graph output

# group: ANALYZE: Total Surface Area
list_create_13 = List.Create(item0=north, item1=west, item2=south, item3=east)
flatten_20 = List.Flatten(list=list_create_13)
byJoinedSurfaces = PolySurface.ByJoinedSurfaces(surfaces=flatten_20)
area_3 = Surface.Area(surface=byJoinedSurfaces)

# group: DISPLAY: Self shading for roofs.
list_create_14 = List.Create(item0=code_block_52.contextSurfaces, item1=flatten_20)
flatten_21 = List.Flatten(list=list_create_14)

# group: DISPLAY: Solar analysis on roofs
code_block_58 = CodeBlock(roofTops=code_block_52.roofs, contextSurfaces=flatten_21, timeStudy=code_block_53, weather=byLatitudeLongitude, analysisSpacing=spacing) { roofTops; contextSurfaces; timeStudy; weather; analysisSpacing; }
code_block_59 = CodeBlock { yellow=Color.ByARGB(255,255,255,0); black=Color.ByARGB(0,0,0,0); colors = [black, yellow]; indices=[0,1]; }
analyze_2 = DynamoSolarAnalysis.Analysis.SolarAnalysis.Analyze(weather=code_block_58.weather, analysisSurfaces=code_block_58.roofTops, shadingSurfaces=code_block_58.contextSurfaces, timeStudy=code_block_58.timeStudy, spacing=code_block_58.analysisSpacing)
flatten_22 = List.Flatten(list=analyze_2.Cumulative)
maximumItem_2 = List.MaximumItem(list=flatten_22)
code_block_60 = CodeBlock(n=analyze_2.Cumulative, max=maximumItem_2) { n/max; }
color_range_2 = ColorRange(colors=code_block_59.colors, indices=code_block_59.indices, value=code_block_60)
bySurfaceColors_2 = Modifiers.GeometryColor.BySurfaceColors(surface=code_block_58.roofTops, colors=color_range_2)

# group: OUTPUT - Exposure on Roofs
average_2 = Math.Average(numbers=flatten_22)
aer_average_exposure_on_roof = Watch(average_2)  # graph output

# group: EXTRACT: Largest context surface that does not have a negative z value.
flatten_23 = List.Flatten(list=remember_3)
deconstructFacadeShell_3 = Autodesk.RefineryToolkits.MassingSandbox.Generate.Building.DeconstructFacadeShell(solid=flatten_23)
flatten_24 = List.Flatten(list=deconstructFacadeShell_3.horizontalSrfList)
area_4 = Surface.Area(surface=flatten_24)
sortByKey = List.SortByKey(list=flatten_24, keys=area_4)
reverse = List.Reverse(list=sortByKey.sorted_list)
code_block_61 = CodeBlock { 2; }
takeItems = List.TakeItems(list=reverse, amount=code_block_61)
list_create_15 = List.Create(item0=takeItems)
code_block_62 = CodeBlock { 0.5; }
pointAtParameter_14 = Surface.PointAtParameter(surface=list_create_15, u=code_block_62, v=code_block_62)
Z_9 = Point.Z(point=pointAtParameter_14)
sign = Math.Sign(number=Z_9)
code_block_63 = CodeBlock { 0; }
indexOf = List.IndexOf(list=sign@L2, element=code_block_63)
getItemAtIndex_10 = List.GetItemAtIndex(list=list_create_15@L2, index=indexOf)

# group: DISPLAY: color site context (Vertical Surfaces)
color_palette_2 = ColorPalette({R: 211, G: 211, B: 211, A: 255})
byGeometryColor_2 = Modifiers.GeometryColor.ByGeometryColor(geometry=deconstructFacadeShell_3.verticalSrfList, color=color_palette_2)

# group: DISPLAY: Color mass
join = List.Join(list0=code_block_51.topLevels, list1=flatten_17)
color_palette_3 = ColorPalette({R: 64, G: 224, B: 208, A: 150})
byGeometryColor_3 = Modifiers.GeometryColor.ByGeometryColor(geometry=join, color=color_palette_3)

# group: EXTRACT: Site outline
bySolid_2 = PolySurface.BySolid(solid=byUnion)
surfaces_2 = PolySurface.Surfaces(polySurface=bySolid_2)
number = DoubleInput(0.5)
pointAtParameter_15 = Surface.PointAtParameter(surface=surfaces_2, u=number, v=number)
Z_10 = Point.Z(point=pointAtParameter_15)
sortByKey_2 = List.SortByKey(list=surfaces_2, keys=Z_10)
number_2 = DoubleInput(0)
getItemAtIndex_11 = List.GetItemAtIndex(list=sortByKey_2.sorted_list, index=number_2)

# group: OUTPUT - Floor Area Ratio (FAR)
# note: Gross Floor Area / Total Ground Area
area_5 = Surface.Area(surface=flatten_3)
sum_3 = Math.Sum(values=area_5)
area_6 = Surface.Area(surface=getItemAtIndex_11)
div_5 = sum_3 / area_6
far_floor_area_ratio = Watch(div_5)  # graph output

# group: OUTPUT - Floor Space Index (FSI)
# note: Gross Area of Building Footprint on the Ground / Total Ground Area
area_7 = Surface.Area(surface=byPatch)
div_6 = area_7 / area_6
fsi_floor_space_index = Watch(div_6)  # graph output

# group: ANALYZE: Total Solid Area
list_create_16 = List.Create(item0=flatten_7, item1=flatten_9, item2=flatten_11, item3=flatten_13)
area_8 = Surface.Area(surface=list_create_16)
sum_4 = Math.Sum(values=area_8)

sum_5 = Math.Sum(values=sum_4)

# group: ANALYZE: Total Glass Area
list_create_17 = List.Create(item0=byPatch_4, item1=byPatch_5, item2=byPatch_6, item3=byPatch_7)
area_9 = Surface.Area(surface=list_create_17)
sum_6 = Math.Sum(values=area_9)

sum_7 = Math.Sum(values=sum_6)

# group: ANALYZE: Math Check
add = sum_5 + sum_7
eq_3 = add == area_3

# group: INPUT
solid_sf = DoubleInput(0)
glass_sf = DoubleInput(0)

total_solid_cost = solid_sf * sum_5
total_glass_cost = glass_sf * sum_7

# group: OUTPUT
total_envelope_cost = total_solid_cost + total_glass_cost

# group: ANALYZE: Percent Solid
div_7 = sum_5 / area_3
code_block_64 = CodeBlock { 100; }
mul = div_7 * code_block_64
percent_solid = Watch(mul)

# group: ANALYZE: Percent Glass
div_8 = sum_7 / area_3
code_block_65 = CodeBlock { 100; }
mul_2 = div_8 * code_block_65
percent_solid_2 = Watch(mul_2)

# group: INPUT: Summer Solitice
date_time = DateTime("2019-06-21T06:29:00")
date_time_2 = DateTime("2019-06-21T20:16:00")
fromSunriseToSunset = DynamoSolarAnalysis.Analysis.TimeStudy.FromSunriseToSunset(startDateTime=date_time, endDateTime=date_time_2)

# group: INPUT: Entire Year
date_time_3 = DateTime("2019-01-01T08:00:00")
date_time_4 = DateTime("2019-12-31T18:00:00")
fromStartTimeToEndTime = DynamoSolarAnalysis.Analysis.TimeStudy.FromStartTimeToEndTime(startDateTime=date_time_3, endDateTime=date_time_4)

# group: INPUT: Winter Solitice
date_time_5 = DateTime("2019-12-21T07:04:00")
date_time_6 = DateTime("2019-12-21T17:34:00")
fromSunriseToSunset_2 = DynamoSolarAnalysis.Analysis.TimeStudy.FromSunriseToSunset(startDateTime=date_time_5, endDateTime=date_time_6)

# group: ANALYZE: Direction of ground plane
code_block_66 = CodeBlock(floors=getItemAtIndex_10) { floors; }
code_block_67 = CodeBlock { 0.5; }
normalAtParameter_5 = Surface.NormalAtParameter(surface=code_block_66, u=code_block_67, v=code_block_67)
Z_11 = Vector.Z(vector=normalAtParameter_5)
code_block_68 = CodeBlock { -1; }
eq_4 = Z_11 == code_block_68
# note: This step is an important one in running solar analysis. If the z parameter of surface normals are -1 (meaning they’re facing down) the analysis values will be all the same (blank). This if condition evaluates the direction of the surfaces and mirrors them if they're facing downwards.
code_block_69 = CodeBlock { 0.5; }
pointAtParameter_16 = Surface.PointAtParameter(surface=code_block_66, u=code_block_69, v=code_block_69)
byOriginNormal_6 = Plane.ByOriginNormal(origin=pointAtParameter_16, normal=normalAtParameter_5)
mirror_2 = Geometry.Mirror(geometry=code_block_66, mirrorPlane=byOriginNormal_6)
if_2 = If(test=eq_4, true=mirror_2, false=code_block_66)

code_block_70 = CodeBlock(v=spacing) { v/3; }  # frozen

# group: DISPLAY: Solar analysis on site ground plane
code_block_71 = CodeBlock(GroundPlane=if_2, contextSurfaces=flatten_21, timeStudy=code_block_53, weather=byLatitudeLongitude, analysisSpacing=code_block_70) { GroundPlane; contextSurfaces; timeStudy; weather; analysisSpacing; }
code_block_72 = CodeBlock { yellow=Color.ByARGB(175,175,175,0); black=Color.ByARGB(0,0,0,0); colors = [black, yellow]; indices=[0,1]; }
analyze_3 = DynamoSolarAnalysis.Analysis.SolarAnalysis.Analyze(weather=code_block_71.weather, analysisSurfaces=code_block_71.GroundPlane, shadingSurfaces=code_block_71.contextSurfaces, timeStudy=code_block_71.timeStudy, spacing=code_block_71.analysisSpacing)
flatten_25 = List.Flatten(list=analyze_3.Cumulative)
maximumItem_3 = List.MaximumItem(list=flatten_25)
code_block_73 = CodeBlock(n=analyze_3.Cumulative, max=maximumItem_3) { n/max; }
color_range_3 = ColorRange(colors=code_block_72.colors, indices=code_block_72.indices, value=code_block_73)
bySurfaceColors_3 = Modifiers.GeometryColor.BySurfaceColors(surface=code_block_71.GroundPlane, colors=color_range_3)

# group: EXTRACT: Site building roofs
restOfItems_2 = List.RestOfItems(list=reverse)
restOfItems_3 = List.RestOfItems(list=restOfItems_2)
code_block_74 = CodeBlock { 0.5; }
pointAtParameter_17 = Surface.PointAtParameter(surface=restOfItems_3, u=code_block_74, v=code_block_74)
Z_12 = Point.Z(point=pointAtParameter_17)
code_block_75 = CodeBlock { 1; }
indexOf_2 = List.IndexOf(list=Z_12@L2, element=code_block_75)
removeItemAtIndex = List.RemoveItemAtIndex(list=restOfItems_3, indices=indexOf_2)

# group: ANALYZE: Direction of surrounding roofs
code_block_76 = CodeBlock(floors=removeItemAtIndex) { floors; }
code_block_77 = CodeBlock { 0.5; }
normalAtParameter_6 = Surface.NormalAtParameter(surface=code_block_76, u=code_block_77, v=code_block_77)
Z_13 = Vector.Z(vector=normalAtParameter_6)
code_block_78 = CodeBlock { -1; }
eq_5 = Z_13 == code_block_78
# note: This step is an important one in running solar analysis. If the z parameter of surface normals are -1 (meaning they’re facing down) the analysis values will be all the same (blank). This if condition evaluates the direction of the surfaces and mirrors them if they're facing downwards.
code_block_79 = CodeBlock { 0.5; }
pointAtParameter_18 = Surface.PointAtParameter(surface=code_block_76, u=code_block_79, v=code_block_79)
byOriginNormal_7 = Plane.ByOriginNormal(origin=pointAtParameter_18, normal=normalAtParameter_6)
mirror_3 = Geometry.Mirror(geometry=code_block_76, mirrorPlane=byOriginNormal_7)
if_3 = If(test=eq_5, true=mirror_3, false=code_block_76)

# group: DISPLAY: Solar analysis on site roof planes
code_block_80 = CodeBlock(Roofs=if_3, contextSurfaces=flatten_21, timeStudy=code_block_53, weather=byLatitudeLongitude, analysisSpacing=code_block_70) { Roofs; contextSurfaces; timeStudy; weather; analysisSpacing; }
code_block_81 = CodeBlock { yellow=Color.ByARGB(220,220,220,0); black=Color.ByARGB(0,0,0,0); colors = [black, yellow]; indices=[0,1]; }
analyze_4 = DynamoSolarAnalysis.Analysis.SolarAnalysis.Analyze(weather=code_block_80.weather, analysisSurfaces=code_block_80.Roofs, shadingSurfaces=code_block_80.contextSurfaces, timeStudy=code_block_80.timeStudy, spacing=code_block_80.analysisSpacing)
flatten_26 = List.Flatten(list=analyze_4.Cumulative)
maximumItem_4 = List.MaximumItem(list=flatten_26)
code_block_82 = CodeBlock(n=analyze_4.Cumulative, max=maximumItem_4) { n/max; }
color_range_4 = ColorRange(colors=code_block_81.colors, indices=code_block_81.indices, value=code_block_82)
bySurfaceColors_4 = Modifiers.GeometryColor.BySurfaceColors(surface=code_block_80.Roofs, colors=color_range_4)

# group: ANALYZE: Percentage Check!
code_block_83 = CodeBlock { 100; }
window_area = Surface.Area(surface=scale)
wall_area = Surface.Area(surface=flatten_6)
div_9 = window_area / wall_area
mul_3 = code_block_83 * div_9

# group: ANALYZE: Percentage Check!
code_block_84 = CodeBlock { 100; }
window_area_2 = Surface.Area(surface=scale_2)
wall_area_2 = Surface.Area(surface=flatten_8)
div_10 = window_area_2 / wall_area_2
mul_4 = code_block_84 * div_10

# group: ANALYZE: Percentage Check!
code_block_85 = CodeBlock { 100; }
window_area_3 = Surface.Area(surface=scale_3)
wall_area_3 = Surface.Area(surface=flatten_10)
div_11 = window_area_3 / wall_area_3
mul_5 = code_block_85 * div_11

# group: ANALYZE: Percentage Check!
code_block_86 = CodeBlock { 100; }
window_area_4 = Surface.Area(surface=scale_4)
wall_area_4 = Surface.Area(surface=flatten_12)
div_12 = window_area_4 / wall_area_4
mul_6 = code_block_86 * div_12

# group: DISPLAY: color site context (Horizontal Surfaces)
color_palette_4 = ColorPalette({R: 211, G: 211, B: 211, A: 255})
byGeometryColor_4 = Modifiers.GeometryColor.ByGeometryColor(geometry=deconstructFacadeShell_3.horizontalSrfList, color=color_palette_4)

# group: INPUT: Choose Date Time
choose_date_time = DateTime("2019-03-20T09:00:00")
still_2 = DynamoSolarAnalysis.Analysis.TimeStudy.Still(dateTime=choose_date_time)

# group: Model Generation
categories_2 = Categories("OST_Mass")
string = StringInput("Mass1")
byGeometry = DirectShape.ByGeometry(category=categories_2, name=string)  # unwired: geometry
byGeometry_2 = ImportInstance.ByGeometry()  # unwired: geometry
