# Dynamo graph AddThumbnailURLs.dyn "AddThumbs" (Dynamo 2.12.0.5650)

# group: USER INPUTS

# group: Directory of Images
string = StringInput("C:\Users\johnpierson\OneDrive - Parallax Team Inc\FacadeExample\Staggered Curtain Wall 001")
directory_from_path = DirectoryObject(path=string)

# group: Modified Excel File
code_block = CodeBlock(directory=directory_from_path) { directory + "\\DataWithThumbnails.xlsx"; }

# group: Your github URL
string_2 = StringInput("https://github.com/johnpierson/Generative-Design-Curtain-Wall-Thumbnails/raw/main/")

# group: Read images from directory and get their filename
code_block_2 = CodeBlock { "*.png"; }
getDirectoryContents = FileSystem.GetDirectoryContents(directory=directory_from_path, searchString=code_block_2)
code_block_3 = CodeBlock { true; }
fileName = FileSystem.FileName(path=getDirectoryContents.files, withExtension=code_block_3)

# group: Combine URL and Add Headers
code_block_4 = CodeBlock { "Thumbnails"; }
code_block_5 = CodeBlock(url=string_2, name=fileName) { url + name; }
addItemToFront = List.AddItemToFront(item=code_block_4, list=code_block_5)

# group: CSV from Generative Design
file_path = Filename("C:\Users\johnpierson\OneDrive - Parallax Team Inc\FacadeExample\Staggered Curtain Wall 001\Staggered Curtain Wall 001.csv")
importCSV = Data.ImportCSV(filePath=file_path)

# group: Add thumbnail Column & swap rows and columns with transpose
addItemToEnd = List.AddItemToEnd(item=addItemToFront, list=importCSV)
transpose = List.Transpose(lists=addItemToEnd)

# group: Write to excel
code_block_6 = CodeBlock { "Data"; 0; true; }
exportToExcel = Data.ExportToExcel(filePath=code_block, sheetName=code_block_6.out0, startRow=code_block_6.out1, startColumn=code_block_6.out1, data=transpose, overWrite=code_block_6.out2)
