# Dynamo graph DynaSpace GDIR Example.dyn (Dynamo 2.6.0.8481)
# packages: DynaShape 0.6.1.0, GenerativeDesign 1.3.1, DynaShape (for Dynamo 2.7 or newer) 0.7.0.0

# group: Boundary Polygon (IMPORTANT: Must be convex)
number_slider = DoubleSlider(-16.474, range=-31.212..100 step 0.1)
number_slider_2 = DoubleSlider(-29.877, range=-29.877..100 step 0.1)
byCoordinates = Point.ByCoordinates(x=number_slider, y=number_slider_2)
number_slider_3 = DoubleSlider(35.445, range=-31.212..100 step 0.1)
number_slider_4 = DoubleSlider(-29.877, range=-29.877..100 step 0.1)
byCoordinates_2 = Point.ByCoordinates(x=number_slider_3, y=number_slider_4)
number_slider_5 = DoubleSlider(39.089, range=-31.212..100 step 0.1)
number_slider_6 = DoubleSlider(13.485, range=-29.877..100 step 0.1)
byCoordinates_3 = Point.ByCoordinates(x=number_slider_5, y=number_slider_6)
number_slider_7 = DoubleSlider(31.641, range=-31.212..100 step 0.1)
number_slider_8 = DoubleSlider(34.19, range=-29.877..100 step 0.1)
byCoordinates_4 = Point.ByCoordinates(x=number_slider_7, y=number_slider_8)
number_slider_9 = DoubleSlider(-28.608, range=-31.212..100 step 0.1)
number_slider_10 = DoubleSlider(7.361, range=-29.877..100 step 0.1)
byCoordinates_5 = Point.ByCoordinates(x=number_slider_9, y=number_slider_10)
list_create = List.Create(item0=byCoordinates, item1=byCoordinates_2, item2=byCoordinates_3, item3=byCoordinates_4, item4=byCoordinates_5)
boolean = BoolSelector(true)
byPoints = PolyCurve.ByPoints(points=list_create, connectLastToFirst=boolean)

# group: Bring in the space specification data from the CSV file
file_path = Filename(".\SampleBuildingProgram-Clinic.csv")
file_from_path = FileObject(path=file_path)
code_block = CodeBlock { "SampleBuildingProgram-Clinic"; false; }
importExcel = Data.ImportExcel(file=file_from_path, sheetName=code_block.out0, showExcel=code_block.out1)
flatten = List.Flatten(list=importExcel)
watch = Watch(flatten)

# group: Cache the data
remember = Data.Remember(watch)

# group: Generate random initial positions for the space bubbles
code_block_2 = CodeBlock { -25.0; 25.0; 62; }
seed_for_initial_positions = IntegerSlider(6, range=0..999 step 1)  # graph input
randomNumbers = DynaSpace.Util.RandomNumbers(min=code_block_2.out0, max=code_block_2.out1, count=code_block_2.out2, seed=seed_for_initial_positions)
code_block_3 = CodeBlock { 31; }
chop = List.Chop(list=randomNumbers, lengths=code_block_3)
code_block_4 = CodeBlock { 0; 1; }
getItemAtIndex = List.GetItemAtIndex(list=chop, index=code_block_4.out0)
getItemAtIndex_2 = List.GetItemAtIndex(list=chop, index=code_block_4.out1)
byCoordinates_6 = Point.ByCoordinates(x=getItemAtIndex, y=getItemAtIndex_2)

# group: Engine settings for GDIR mode
code_block_5 = CodeBlock { 200000; 0.0001; 30000; 60000; 90000; }
create = DynaSpace.SilentModeSettings.Create(maxIterationCount=code_block_5.out0, terminationThreshold=code_block_5.out1, sphereCollisionKickin=code_block_5.out2, planarConstraintKickin=code_block_5.out3, boundaryKickin=code_block_5.out4)

create_2 = DynaSpace.Settings.Create()

# group: Run the DynaSpace engine
createWithInitialPositions = DynaSpace.Engine.CreateWithInitialPositions(data=remember, initialPositions=byCoordinates_6)
execute = DynaSpace.Engine.Execute(engine=createWithInitialPositions, boundaryVertices=list_create, silentModeSettings=create, settings=create_2)

# group: Visualization
code_block_6 = CodeBlock(a=execute.spaceCircles) { a[0]; a[1]; a[2]; a[3]; }
list_create_2 = List.Create(item0=code_block_6.out0, item1=code_block_6.out1, item2=code_block_6.out2, item3=code_block_6.out3)
color_palette = ColorPalette({R: 0, G: 100, B: 0, A: 255})
color_palette_2 = ColorPalette({R: 139, G: 0, B: 0, A: 255})
color_palette_3 = ColorPalette({R: 0, G: 0, B: 205, A: 255})
color_palette_4 = ColorPalette({R: 218, G: 165, B: 32, A: 255})
list_create_3 = List.Create(item0=color_palette, item1=color_palette_2, item2=color_palette_3, item3=color_palette_4)
byGeometryColor = Modifiers.GeometryColor.ByGeometryColor(geometry=list_create_2, color=list_create_3)

sum = Math.Sum(values=execute.spaceAdjErrors)  # graph output
