# Dynamo graph 01-VASA-Overview.dyn (Dynamo 2.12.0.5650)
# packages: VASA 0.1.0

# group: VASA Workflow 01: Overview
# note: DYNAMO PROJECT
# 01-VASA-Overview.dyn
# note: ASSOCIATED FILE(S)
# sample-data : 2 STL files
# note: REQUIRED DYNAMO PACKAGES
# VASA
# note: DYNAMO VERSION
# 2.12.0
# note: AUTHOR(S) / CREATION DATE
# Autodesk Research 2021
# note: DESCRIPTION
# A demonstration of the main features of the Voxel-based Architectural Space Analysis (VASA) package: (1) direct daylight, (2) visibility from a point, (3) travel distance from a point, (4) pathfinding in 3D.
# note: ADDITIONAL COMMENTS
# To explore the example, toggle on and off the preview for the display nodes on the right-hand side of the graph. Also adjust the crop depth parameter near the top-right of the graph to see into the lower floors of the building.

# group: STL File Paths
# note: Input Variables
# Pink indicates variables that can be altered per project and must be set accordingly before running the script.
# note: In this example, building geometry is imported from STL files and then voxelized. Input geometry can also come from Dynamo or Revit.
building_geometry_file_path = Filename(".\TechnicalSchool_building_mm_bin.stl")
# note: Functional Logic
# Cyan indicates the logic of the script. No changes should be made in these groups unless advised.
glazing_geometry_file_path = Filename(".\TechnicalSchool_glazing_mm_bin.stl")

# group: Triangle Data
# note: The data from the STL files is imported as lists of triangle vertex coordinates. The triangles can be viewed using TrianglesAsNineNumbers.ToMesh.
importFromSTL = VASA.Utils.TrianglesAsNineNumbers.ImportFromSTL(filePath=building_geometry_file_path)
code_block = CodeBlock(buildingTriangles=importFromSTL) { buildingTriangles; }
importFromSTL_2 = VASA.Utils.TrianglesAsNineNumbers.ImportFromSTL(filePath=glazing_geometry_file_path)
code_block_2 = CodeBlock(glazingTriangles=importFromSTL_2) { glazingTriangles; }

# group: Coarse Voxel Width
# note: Output Values
# Orange indicates key resulting values of nodes that should be observed after running the graph.
# note: Display Objects
# Blue indicates objects that can be previewed in the 3D background after running the graph.
# note: The coarse voxel width should generally be 1 meter (or possibly 4 feet if using imperial length units). In this example, the imported building geometry is in millimeters, so the coarse voxel width is 1000. With a default level of detail (LOD) of 4, the width of the finest voxels is 6.25 cm (1 meter divided in half 4 times). The height of each voxel is 25 cm.
code_block_3 = CodeBlock { 1000; }

# group: Context Geometry Parameters
# note: In this example, context geometry is generated using Dynamo according to these parameters.
tree_x_coordinate_number_slider = DoubleSlider(28000, range=18000..38000 step 10)
tree_y_coordinate_number_slider = DoubleSlider(8000, range=4000..12000 step 10)
tree_foliage_height_number = DoubleSlider(6000, range=4800..7200 step 10)  # "Tree Foliage Height - Number Slider"
tree_trunk_radius_number_slider = DoubleSlider(450, range=400..500 step 10)
tree_foliage_radius_number = DoubleSlider(3600, range=2400..4800 step 10)  # "Tree Foliage Radius - Number Slider"

# group: Context Geometry
# note: The context geometry includes the ground (Cuboid) and a tree consisting of a trunk (Cylinder) and foliage (Sphere).
code_block_4 = CodeBlock { 20000; 6000; -1001; 79998; 69998; 1998; -2; }
byCoordinates = Point.ByCoordinates(x=code_block_4.out0, y=code_block_4.out1, z=code_block_4.out2)
byLengths = Cuboid.ByLengths(origin=byCoordinates, width=code_block_4.out3, length=code_block_4.out4, height=code_block_4.out5)
byCoordinates_2 = Point.ByCoordinates(x=tree_x_coordinate_number_slider, y=tree_y_coordinate_number_slider, z=code_block_4.out6)
byCoordinates_3 = Point.ByCoordinates(x=tree_x_coordinate_number_slider, y=tree_y_coordinate_number_slider, z=tree_foliage_height_number)
byPointsRadius = Cylinder.ByPointsRadius(startPoint=byCoordinates_2, endPoint=byCoordinates_3, radius=tree_trunk_radius_number_slider)
byCenterPointRadius = Sphere.ByCenterPointRadius(centerPoint=byCoordinates_3, radius=tree_foliage_radius_number)
list_create = List.Create(item0=byLengths, item1=byPointsRadius, item2=byCenterPointRadius)

# group: Voxel Models
# note: The first key step in using VASA is to create voxel models from the input geometry. All of VASA's analysis features are performed on voxel models. Voxel models can be created from triangle data or Dynamo geometry, and both approaches are demonstrated here.
byTriangles = VASA.Core.VoxelModel.ByTriangles(trianglesAsNineNumbers=code_block, coarseVoxelWidth=code_block_3)
code_block_5 = CodeBlock(buildingVoxels=byTriangles) { buildingVoxels; }
byGeometry = VASA.Core.VoxelModel.ByGeometry(geometry=list_create, coarseVoxelWidth=code_block_3)
byTriangles_2 = VASA.Core.VoxelModel.ByTriangles(trianglesAsNineNumbers=code_block_2, coarseVoxelWidth=code_block_3)
code_block_6 = CodeBlock(glazingVoxels=byTriangles_2) { glazingVoxels; }

union = VASA.Operations.SolidOperations.Union(voxelModels=byGeometry)

# group (continued): Voxel Models
code_block_7 = CodeBlock(contextVoxels=union) { contextVoxels; }

# group: Voxel Model for Visibility
# note: The building voxels and context voxels are combined into a single voxel model for visibility analysis. Voxels representing glazing are excluded.
list_create_2 = List.Create(item0=code_block_5, item1=code_block_7)
union_2 = VASA.Operations.SolidOperations.Union(voxelModels=list_create_2)

# group: Crop Depth
integer_slider = IntegerSlider(9, range=0..60 step 1)

# group: Crop Voxel Model
# note: The top several layers of voxels are removed for visualization purposes, allowing the user to see into the building.
crop = VASA.Core.VoxelModel.Crop(voxelModel=union_2, upperZDepth=integer_slider)
extents = VASA.Core.VoxelModel.Extents(voxelModel=crop)

# group: Display Building and Context Voxels
displayVoxels = VASA.Core.VoxelModel.DisplayVoxels(voxelModel=crop)

# group: Glazing Color
color_palette = ColorPalette({R: 100, G: 149, B: 237, A: 63})

# group: Daylight Direction
x_number_slider = DoubleSlider(-3, range=-10..10 step 0.1)
y_number_slider = DoubleSlider(4, range=0..10 step 0.1)
z_number_slider = DoubleSlider(-6, range=-10..0 step 0.1)
byCoordinates_4 = Vector.ByCoordinates(x=x_number_slider, y=y_number_slider, z=z_number_slider)

# group: Direct Daylight
# note: Direct daylight is approximated by computing visibility from a direction.
visibilityFromDirection = VASA.Operations.VisibilityOperations.VisibilityFromDirection(voxelModel=union_2, direction=byCoordinates_4)

# group: Shadows
# note: To make the daylight approximation easier to visualize, it is inverted to produce shadows.
invert = VASA.Operations.SolidOperations.Invert(voxelModel=visibilityFromDirection)
subtract = VASA.Operations.SolidOperations.Subtract(voxelModel0=invert, voxelModel1=union_2)

# group: Shadow Color
color_palette_2 = ColorPalette({R: 138, G: 43, B: 226, A: 16})

# group: View Parameters
view_point_x_number_slider = DoubleSlider(15000, range=14000..16000 step 10)
view_point_y_number_slider = DoubleSlider(25000, range=24000..26000 step 10)
view_point_z_number_slider = DoubleSlider(5000, range=4500..5500 step 10)
byCoordinates_5 = Point.ByCoordinates(x=view_point_x_number_slider, y=view_point_y_number_slider, z=view_point_z_number_slider)
view_radius_number_slider = DoubleSlider(27000, range=0..50000 step 10)

# group: View from a Point
# note: The view from a location in the building is approximated by computing visibility from a point.
visibilityFromPoint = VASA.Operations.VisibilityOperations.VisibilityFromPoint(voxelModel=union_2, point=byCoordinates_5, maxRadius=view_radius_number_slider)

# group: View Color
color_palette_3 = ColorPalette({R: 127, G: 255, B: 212, A: 255})

# group: Voxel Model for Pathfinding
# note: All voxel models are combined for pathfinding, including the one representing glazing.
list_create_3 = List.Create(item0=union_2, item1=code_block_6)
union_3 = VASA.Operations.SolidOperations.Union(voxelModels=list_create_3)

# group: Path Model
# note: Voxel models must be converted into path models to create distance fields or perform pathfinding.
byVoxelModel = VASA.Pathfinding.PathModel.ByVoxelModel(voxelModel=union_3)

# group: Path Endpoints
source_point_x_number_slider = DoubleSlider(32000, range=30000..34000 step 10)
source_point_y_number_slider = DoubleSlider(10000, range=0..20000 step 10)
source_point_z_number_slider = DoubleSlider(2000, range=1500..2500 step 10)
byCoordinates_6 = Point.ByCoordinates(x=source_point_x_number_slider, y=source_point_y_number_slider, z=source_point_z_number_slider)
sample_point_x_number_slider = DoubleSlider(6800, range=6700..6900 step 10)
sample_point_y_number_slider = DoubleSlider(3500, range=1000..6000 step 10)
sample_point_z_number_slider = DoubleSlider(9000, range=8500..9500 step 10)
byCoordinates_7 = Point.ByCoordinates(x=sample_point_x_number_slider, y=sample_point_y_number_slider, z=sample_point_z_number_slider)

# group: Path
# note: A shortest path is calculated between two endpoints. The path is produced by computing a distance field outward from the source point until the sample point is reached.
byPathModelAndPoints = VASA.Pathfinding.Path.ByPathModelAndPoints(pathModel=byVoxelModel, sourcePoint=byCoordinates_6, samplePoint=byCoordinates_7)
curveFromSourceToSample = VASA.Pathfinding.Path.CurveFromSourceToSample(path=byPathModelAndPoints)

# group: Path Color
color_palette_4 = ColorPalette({R: 255, G: 255, B: 0, A: 255})

# group: Display Path
byGeometryColor = Modifiers.GeometryColor.ByGeometryColor(geometry=curveFromSourceToSample, color=color_palette_4)

# group: Distance Field Parameters
source_point_x_number_slider_2 = DoubleSlider(23000, range=20000..26000 step 10)
source_point_y_number_slider_2 = DoubleSlider(20700, range=20000..21400 step 10)
source_point_z_number_slider_2 = DoubleSlider(5000, range=4500..5500 step 10)
byCoordinates_8 = Point.ByCoordinates(x=source_point_x_number_slider_2, y=source_point_y_number_slider_2, z=source_point_z_number_slider_2)
distance_number_slider = DoubleSlider(27000, range=0..54000 step 10)

# group: Distance Field
# note: A field of travel distances is computed from a point. Distance fields can be visualized, as in this example, or used to find paths with a common endpoint.
byPathModelAndSourcePoint = VASA.Pathfinding.DistanceField.ByPathModelAndSourcePoint(pathModel=byVoxelModel, sourcePoint=byCoordinates_8, maxDistance=distance_number_slider)
reachableVoxels = VASA.Pathfinding.DistanceField.ReachableVoxels(distanceField=byPathModelAndSourcePoint)

# group: Resize Voxel Models
# note: All voxel models are resized to the same extents before being displayed.
resize = VASA.Core.VoxelModel.Resize(voxelModel=code_block_6, newExtents=extents)
resize_2 = VASA.Core.VoxelModel.Resize(voxelModel=subtract, newExtents=extents)
resize_3 = VASA.Core.VoxelModel.Resize(voxelModel=visibilityFromPoint, newExtents=extents)
resize_4 = VASA.Core.VoxelModel.Resize(voxelModel=reachableVoxels, newExtents=extents)

# group: Display Glazing Voxels
displayVoxels_2 = VASA.Core.VoxelModel.DisplayVoxels(voxelModel=resize, color=color_palette)

# group: Display Shadow Voxels
displayVoxels_3 = VASA.Core.VoxelModel.DisplayVoxels(voxelModel=resize_2, color=color_palette_2)

# group: Display View Voxels
displayVoxels_4 = VASA.Core.VoxelModel.DisplayVoxels(voxelModel=resize_3, color=color_palette_3)

# group: Distance Field Color
color_palette_5 = ColorPalette({R: 255, G: 127, B: 80, A: 255})

# group: Display Distance Field Voxels
displayVoxels_5 = VASA.Core.VoxelModel.DisplayVoxels(voxelModel=resize_4, color=color_palette_5)
