# Dynamo graph 02-VASA-Pathfinding-in-3D.dyn (Dynamo 2.12.0.5650)
# packages: VASA 0.1.0

# note: Output Values
# Orange indicates key resulting values of nodes that should be observed after running the graph.
# note: Display Objects
# Blue indicates objects that can be previewed in the 3D background after running the graph.

# group: VASA Workflow 02: Pathfinding in 3D
# note: DYNAMO PROJECT
# 02-VASA-Pathfinding-in-3D.dyn
# note: ASSOCIATED FILE(S)
# sample-data : 2 STL files
# note: REQUIRED DYNAMO PACKAGES
# VASA
# note: DYNAMO VERSION
# 2.12.0
# note: AUTHOR(S) / CREATION DATE
# Autodesk Research 2021
# note: DESCRIPTION
# A demonstration of pathfinding in 3D using the Voxel-based Architectural Space Analysis (VASA) package.
# note: ADDITIONAL COMMENTS
# This example includes a slider that changes the level of detail (LOD) of the voxel models. Voxel models have a LOD of 4 by default. This means that a model with a coarse voxel width of 1 m will resolve voxels down to 6.25 cm in the horizontal direction (1 m divided in half 4 times). If the LOD is reduced to 3, the agent diameter for pathfinding will have to be lowered as well to ensure the path can go up and down the staircases.

# group: STL File Paths
# note: Input Variables
# Pink indicates variables that can be altered per project and must be set accordingly before running the script.
# note: In this example, building geometry is imported from STL files and then voxelized. Input geometry can also come from Dynamo or Revit.
building_geometry_file_path = Filename(".\TechnicalSchool_building_mm_bin.stl")
# note: Functional Logic
# Cyan indicates the logic of the script. No changes should be made in these groups unless advised.
glazing_geometry_file_path = Filename(".\TechnicalSchool_glazing_mm_bin.stl")

# group: Triangle Data
# note: The data from the STL files is imported as lists of triangle vertex coordinates. The triangles can be viewed using TrianglesAsNineNumbers.ToMesh.
importFromSTL = VASA.Utils.TrianglesAsNineNumbers.ImportFromSTL(filePath=building_geometry_file_path)
code_block = CodeBlock(buildingTriangles=importFromSTL) { buildingTriangles; }
importFromSTL_2 = VASA.Utils.TrianglesAsNineNumbers.ImportFromSTL(filePath=glazing_geometry_file_path)
code_block_2 = CodeBlock(glazingTriangles=importFromSTL_2) { glazingTriangles; }

# group: Coarse Voxel Width
# note: The coarse voxel width should generally be 1 meter (or possibly 4 feet if using imperial length units). In this example, the imported building geometry is in millimeters, so the coarse voxel width is 1000.
code_block_3 = CodeBlock { 1000; }

# group: Level of Detail
# note: The level of detail (LOD) determines the voxel width (assuming the coarse voxel width is always 1 m). If the default LOD of 4 is used, then the default agent diameter of 7 should work well for pathfinding. If the LOD is reduced to 3, then the agent diameter should be reduced to somewhere around 3 to ensure paths can negotiate narrow passageways and staircases.
integer_slider = IntegerSlider(4, range=0..5 step 1)

# group: Voxel Models
# note: Voxel models are created from the triangle data.
byTriangles = VASA.Core.VoxelModel.ByTriangles(trianglesAsNineNumbers=code_block, coarseVoxelWidth=code_block_3, finestLOD=integer_slider)
code_block_4 = CodeBlock(buildingVoxels=byTriangles) { buildingVoxels; }
byTriangles_2 = VASA.Core.VoxelModel.ByTriangles(trianglesAsNineNumbers=code_block_2, coarseVoxelWidth=code_block_3, finestLOD=integer_slider)
code_block_5 = CodeBlock(glazingVoxels=byTriangles_2) { glazingVoxels; }

# group: Voxel Model for Pathfinding
# note: All voxel models are combined for pathfinding.
list_create = List.Create(item0=code_block_4, item1=code_block_5)
union = VASA.Operations.SolidOperations.Union(voxelModels=list_create)

# group: Crop Depth
integer_slider_2 = IntegerSlider(10, range=0..60 step 1)

# group: Crop Voxel Model
# note: The top several layers of voxels are removed for visualization purposes, allowing the user to see into the building.
crop = VASA.Core.VoxelModel.Crop(voxelModel=union, upperZDepth=integer_slider_2)

# group: Building Voxel Color
color_palette = ColorPalette({R: 255, G: 255, B: 255, A: 127})

# group: Display Building Voxels
displayVoxels = VASA.Core.VoxelModel.DisplayVoxels(voxelModel=crop, color=color_palette)

# group: Agent Diameter
# note: The approximate diameter of an agent, specified in horizontal voxel spacings, determines whether paths can be found through narrow passageways or up/down steep slopes and staircases. If the voxel model level of detail (LOD) is reduced from 4 to 3, then the agent diameter should also be reduced to somewhere around 3. If the LOD is reduced too far, no path will be found regardless of the diameter.
integer_slider_3 = IntegerSlider(7, range=1..7 step 1)

# group: Path Model
# note: Voxel models must be converted into path models to create distance fields or perform pathfinding.
byVoxelModel = VASA.Pathfinding.PathModel.ByVoxelModel(voxelModel=union, agentDiameterOffset=integer_slider_3)

# group: Path Endpoints
source_point_x_number_slider = DoubleSlider(12000, range=10000..14000 step 10)
source_point_y_number_slider = DoubleSlider(10000, range=2000..18000 step 10)
source_point_z_number_slider = DoubleSlider(2000, range=1500..2500 step 10)
byCoordinates = Point.ByCoordinates(x=source_point_x_number_slider, y=source_point_y_number_slider, z=source_point_z_number_slider)
sample_point_x_number_slider = DoubleSlider(-6000, range=-8000..-4000 step 10)
sample_point_y_number_slider = DoubleSlider(23000, range=20000..26000 step 10)
sample_point_z_number_slider = DoubleSlider(9000, range=8500..9500 step 10)
byCoordinates_2 = Point.ByCoordinates(x=sample_point_x_number_slider, y=sample_point_y_number_slider, z=sample_point_z_number_slider)

# group: Path
# note: A shortest path is calculated between two endpoints. The path is produced by computing a distance field outward from the source point until the sample point is reached.
byPathModelAndPoints = VASA.Pathfinding.Path.ByPathModelAndPoints(pathModel=byVoxelModel, sourcePoint=byCoordinates, samplePoint=byCoordinates_2)
curveFromSourceToSample = VASA.Pathfinding.Path.CurveFromSourceToSample(path=byPathModelAndPoints)

# group: Path Color
color_palette_2 = ColorPalette({R: 255, G: 255, B: 0, A: 255})

# group: Display Path
byGeometryColor = Modifiers.GeometryColor.ByGeometryColor(geometry=curveFromSourceToSample, color=color_palette_2)

# group: Path Length
# note: Path lengths can be computed directly from path objects.
pathLength = VASA.Pathfinding.Path.PathLength(path=byPathModelAndPoints)
watch = Watch(pathLength)
