# Dynamo graph 05-VASA-Rotated-Axes.dyn (Dynamo 2.12.0.5650)
# packages: VASA 0.1.0

# group: VASA Workflow 05: Rotated Axes
# note: DYNAMO PROJECT
# 05-VASA-Rotated-Axes.dyn
# note: ASSOCIATED FILE(S)
# sample-data : 1 STL file
# note: REQUIRED DYNAMO PACKAGES
# VASA
# note: DYNAMO VERSION
# 2.12.0
# note: AUTHOR(S) / CREATION DATE
# Autodesk Research 2021
# note: DESCRIPTION
# A demonstration of how to create a set of axes in the Voxel-based Architectural Space Analysis (VASA) package. Axes in VASA are useful for rotating the orientation of voxels with respect to the scene geometry.
# note: ADDITIONAL COMMENTS
# Adjust the voxel rotation slider to see different possible orientations of voxels.

# group: STL File Path
main_geometry_file_path = Filename(".\ResidentialSample_main_ft.stl")

# group: Triangle Data
importFromSTL = VASA.Utils.TrianglesAsNineNumbers.ImportFromSTL(filePath=main_geometry_file_path)

# group: Axes Parameters
# note: The required parameters of a set of axes include the length unit of the scene (1 foot, in this case) and a length unit describing the maximum voxel width (1 meter in this case, though 4 feet could also be used). Axes can also be created from a coarse voxel width parameter rather than the two Length objects used here. The other parameters are optional.
inFeet = VASA.Utils.Length.InFeet()
# note: Output Values
# Orange indicates key resulting values of nodes that should be observed after running the graph.
# note: Display Objects
# Blue indicates objects that can be previewed in the 3D background after running the graph.
code_block = CodeBlock { 1; }
inMeters = VASA.Utils.Length.InMeters(number=code_block)
vertical_level_of_detail_integer = IntegerSlider(2, range=0..5 step 1)  # "Vertical Level of Detail - Integer Slider"

# group: Voxel Rotation
# note: Input Variables
# Pink indicates variables that can be altered per project and must be set accordingly before running the script.
# note: Functional Logic
# Cyan indicates the logic of the script. No changes should be made in these groups unless advised.
# note: The voxel rotation parameters is the angle in degrees from the X axis of the scene to the X axis in the voxel coordinate system.
number_slider = DoubleSlider(15, range=-90..90 step 5)

# group: Axes
byUnitLengthsAndVoxelOrigin = VASA.Core.Axes.ByUnitLengthsAndVoxelOrigin(sceneUnitLength=inFeet, voxelUnitLength=inMeters, voxelRotation=number_slider, verticalLOD=vertical_level_of_detail_integer)

# group: Level of Detail
integer_slider = IntegerSlider(4, range=0..5 step 1)

# group: Voxel Model
byTrianglesAndAxes = VASA.Core.VoxelModel.ByTrianglesAndAxes(trianglesAsNineNumbers=importFromSTL, axes=byUnitLengthsAndVoxelOrigin, finestLOD=integer_slider)

# group: Crop Depth
integer_slider_2 = IntegerSlider(0, range=0..50 step 1)

# group: Cropped Voxels
crop = VASA.Core.VoxelModel.Crop(voxelModel=byTrianglesAndAxes, upperZDepth=integer_slider_2)

# group: Display Voxels
displayVoxels = VASA.Core.VoxelModel.DisplayVoxels(voxelModel=crop)

# group: Voxel Model Extents
extents = VASA.Core.VoxelModel.Extents(voxelModel=byTrianglesAndAxes)

# group: Display Extents
displayExtents = VASA.Core.Extents.DisplayExtents(extents=extents)
displayCornerVoxels = VASA.Core.Extents.DisplayCornerVoxels(extents=extents)

# group: Display Axes
displayOriginVoxels = VASA.Core.Axes.DisplayOriginVoxels(axes=byUnitLengthsAndVoxelOrigin)
displayAxes = VASA.Core.Axes.DisplayAxes(axes=byUnitLengthsAndVoxelOrigin)
