# Dynamo graph 08-VASA-Sky-Visibility.dyn (Dynamo 2.12.0.5650)
# packages: VASA 0.1.0

# group: VASA Workflow 08: Sky Visibility
# note: DYNAMO PROJECT
# 08-VASA-Sky-Visibility.dyn
# note: ASSOCIATED FILE(S)
# sample-data : 2 STL files
# note: REQUIRED DYNAMO PACKAGES
# VASA
# note: DYNAMO VERSION
# 2.12.0
# note: AUTHOR(S) / CREATION DATE
# Autodesk Research 2021
# note: DESCRIPTION
# A demonstration of how one can approximate the Vertical Sky Component metric using the Voxel-based Architectural Space Analysis (VASA) package.
# note: ADDITIONAL COMMENTS
# The Vertical Sky Component is the fraction of the sky that is visible from a point on a window of a building. It is approximated here by computing visibility from a point, then intersecting the resulting voxels with a voxelized dome representing the sky. The skydome is given a thickness to improve the accuracy of the final output.

# group: STL File Paths
# note: Input Variables
# Pink indicates variables that can be altered per project and must be set accordingly before running the script.
building_geometry_file_path = Filename(".\TechnicalSchool_building_mm_bin.stl")
# note: Functional Logic
# Cyan indicates the logic of the script. No changes should be made in these groups unless advised.
context_geometry_file_path = Filename(".\TechnicalSchool_context_mm_bin.stl")

# group: Triangle Data
importFromSTL = VASA.Utils.TrianglesAsNineNumbers.ImportFromSTL(filePath=building_geometry_file_path)
importFromSTL_2 = VASA.Utils.TrianglesAsNineNumbers.ImportFromSTL(filePath=context_geometry_file_path)
list_create = List.Create(item0=importFromSTL, item1=importFromSTL_2)

# group: Voxel Model Parameters
# note: Output Values
# Orange indicates key resulting values of nodes that should be observed after running the graph.
coarse_voxel_width_code_block = CodeBlock { 1000; }
voxel_rotation_number_slider = DoubleSlider(0, range=-90..90 step 5)
# note: Display Objects
# Blue indicates objects that can be previewed in the 3D background after running the graph.
vertical_level_of_detail_integer = IntegerSlider(2, range=0..5 step 1)  # "Vertical Level of Detail - Integer Slider"
finest_level_of_detail_integer = IntegerSlider(2, range=0..5 step 1)  # "Finest Level of Detail - Integer Slider"

# group: Voxel Model Axes
# note: A set of axes is to created for all voxel models.
byCoarseVoxelWidthAndOrigin = VASA.Core.Axes.ByCoarseVoxelWidthAndOrigin(coarseVoxelWidth=coarse_voxel_width_code_block, voxelRotation=voxel_rotation_number_slider, verticalLOD=vertical_level_of_detail_integer)
code_block = CodeBlock(voxelLOD=finest_level_of_detail_integer) { voxelLOD; }

# group: Building and Context Voxels
byTrianglesAndAxes = VASA.Core.VoxelModel.ByTrianglesAndAxes(trianglesAsNineNumbers=list_create, axes=byCoarseVoxelWidthAndOrigin, finestLOD=code_block)
union = VASA.Operations.SolidOperations.Union(voxelModels=byTrianglesAndAxes)

# group: Display Building and Context Voxels
displayVoxels = VASA.Core.VoxelModel.DisplayVoxels(voxelModel=union)

# group: View Point
view_point_x_number_slider = DoubleSlider(7525, range=7500..7550 step 5)
view_point_y_number_slider = DoubleSlider(3375, range=3000..3750 step 5)
view_point_z_number_slider = DoubleSlider(2000, range=1000..3000 step 5)
byCoordinates = Point.ByCoordinates(x=view_point_x_number_slider, y=view_point_y_number_slider, z=view_point_z_number_slider)

# group: Ground Level
number_slider = DoubleSlider(0, range=-500..500 step 5)

# group: Skydome Parameters
skydome_inner_radius_number = DoubleSlider(80000, range=60000..100000 step 5)  # "Skydome Inner Radius - Number Slider"
skydome_thickness_number_slider = DoubleSlider(1000, range=0..2000 step 5)

# group: Padding
number_slider_2 = DoubleSlider(2000, range=0..4000 step 5)

# group: Analysis Parameters
code_block_2 = CodeBlock(viewPoint=byCoordinates) { viewPoint; }
code_block_3 = CodeBlock(groundZ=number_slider) { groundZ; }
code_block_4 = CodeBlock(viewPoint=code_block_2, groundZ=code_block_3) { viewPoint.X; viewPoint.Y; groundZ; }
byCoordinates_2 = Point.ByCoordinates(x=code_block_4.out0, y=code_block_4.out1, z=code_block_4.groundZ)
code_block_5 = CodeBlock(groundPoint=byCoordinates_2) { groundPoint; }
code_block_6 = CodeBlock(innerRadius=skydome_inner_radius_number, thickness=skydome_thickness_number_slider) { innerRadius; innerRadius + thickness; }
code_block_7 = CodeBlock(innerRadius=code_block_6.innerRadius) { innerRadius; }
code_block_8 = CodeBlock(outerRadius=code_block_6.out1) { outerRadius; }
code_block_9 = CodeBlock(padding=number_slider_2) { padding; }
add = code_block_6.out1 + code_block_9
code_block_10 = CodeBlock(maxRadius=add) { maxRadius; }
code_block_11 = CodeBlock(viewPoint=code_block_2) { viewPoint; }

# group: Skydome Geometry
# note: The geometry needed to construct the skydome is produced from the parameters. The geometry consistents primarily of an inner and outer sphere. These is also a point between the spheres that is used to fill the region between them.
code_block_12 = CodeBlock(groundPoint=code_block_5) { groundPoint; }
list_create_2 = List.Create(item0=code_block_7, item1=code_block_8)
byCenterPointRadius = Sphere.ByCenterPointRadius(centerPoint=code_block_12, radius=list_create_2)
average = Math.Average(numbers=list_create_2)
translate = Geometry.Translate(geometry=code_block_12, zTranslation=average)

# group: Analysis Geometry
# note: A cylinder is created to infer the extents of the visibility analysis. Also, a line is created to help visualize the position of the view point.
translate_2 = Geometry.Translate(geometry=code_block_5, zTranslation=code_block_10)
byPointsRadius = Cylinder.ByPointsRadius(startPoint=code_block_5, endPoint=translate_2, radius=code_block_10)
byStartPointEndPoint = Line.ByStartPointEndPoint(startPoint=code_block_5, endPoint=translate_2)

# group: Analysis Extents
# note: A set of extents large enough to contain the skydome plus padding is created to ensure the visibility computation has sufficient range.
byGeometryAndAxes = VASA.Core.VoxelModel.ByGeometryAndAxes(geometry=byPointsRadius, axes=byCoarseVoxelWidthAndOrigin, finestLOD=code_block)
extents = VASA.Core.VoxelModel.Extents(voxelModel=byGeometryAndAxes)
finestLOD = VASA.Core.VoxelModel.FinestLOD(voxelModel=byGeometryAndAxes)

# group: Skydome Voxels
# note: The skydome voxels are identifed by voxelizing the spheres and filling the region between them.
byGeometryAndExtents = VASA.Core.VoxelModel.ByGeometryAndExtents(geometry=byCenterPointRadius, extents=extents, finestLOD=finestLOD)
union_2 = VASA.Operations.SolidOperations.Union(voxelModels=byGeometryAndExtents)
fillFromPoint = VASA.Operations.FillOperations.FillFromPoint(voxelModel=union_2, point=translate)

# group: View Color
color_palette = ColorPalette({R: 0, G: 255, B: 255, A: 31})

# group: Display Skydome Voxels
displayVoxels_2 = VASA.Core.VoxelModel.DisplayVoxels(voxelModel=fillFromPoint, color=color_palette)

# group: Voxels for Visibility
# note: The voxel model representing the building and context is resized to contain the entire skydome.
resize = VASA.Core.VoxelModel.Resize(voxelModel=union, newExtents=extents)

# group: View from a Point
# note: The view from a point on a window is computed.
visibilityFromPoint = VASA.Operations.VisibilityOperations.VisibilityFromPoint(voxelModel=resize, point=code_block_11)

# group: Visible Skydome Voxels
# note: The visible part of the skydome is approximated by intersecting the voxels visible from a point with all voxels that are part of the skydome.
list_create_3 = List.Create(item0=visibilityFromPoint, item1=fillFromPoint)
intersect = VASA.Operations.SolidOperations.Intersect(voxelModels=list_create_3)

# group: Visible Sky Color
color_palette_2 = ColorPalette({R: 255, G: 20, B: 147, A: 255})

# group: Display Visible Skydome Voxels
displayVoxels_3 = VASA.Core.VoxelModel.DisplayVoxels(voxelModel=intersect, color=color_palette_2)

# group: Vertical Sky Component
# note: The Vertical Sky Component metric is approximated by dividing the number of visible skydome voxels by the total number of skydome voxels.
countFilled = VASA.Core.VoxelModel.CountFilled(voxelModel=intersect)
countFilled_2 = VASA.Core.VoxelModel.CountFilled(voxelModel=fillFromPoint)
div = countFilled / countFilled_2
vertical_sky_component_watch = Watch(div)

# group: Display Analysis Extents
displayExtents = VASA.Core.Extents.DisplayExtents(extents=extents)

# group: View Color
color_palette_3 = ColorPalette({R: 255, G: 255, B: 0, A: 255})

# group: Display Vertical Line
byGeometryColor = Modifiers.GeometryColor.ByGeometryColor(geometry=byStartPointEndPoint, color=color_palette_3)
