# Dynamo graph 09-VASA-Target-Visibility.dyn (Dynamo 2.12.0.5650)
# packages: VASA 0.1.0

# group: VASA Workflow 09: Target Visibility
# note: DYNAMO PROJECT
# 09-VASA-Target-Visibility.dyn
# note: ASSOCIATED FILE(S)
# sample-data : 2 STL files
# note: REQUIRED DYNAMO PACKAGES
# VASA
# note: DYNAMO VERSION
# 2.12.0
# note: AUTHOR(S) / CREATION DATE
# Autodesk Research 2021
# note: DESCRIPTION
# A demonstration of how one can approximate the fraction of a target that is visible from a point, using the Voxel-based Architectural Space Analysis (VASA) package.
# note: ADDITIONAL COMMENTS
# In this example, the target object is a tree represented by a sphere and a cylinder. The target could also be a historical building, a park, or a waterfront area. The computation works by projecting the visible and concealed portions of the target onto an imaginary surface behind it. This projection surface is a voxel-based sphere created by subtracting the results of two unobstructed visibility computations with slightly different radii. The final output is a result of several visibility computations combined using solid operations.

# group: STL File Paths
building_geometry_file_path = Filename(".\TechnicalSchool_building_mm_bin.stl")
context_geometry_file_path = Filename(".\TechnicalSchool_context_mm_bin.stl")

# group: Triangle Data
importFromSTL = VASA.Utils.TrianglesAsNineNumbers.ImportFromSTL(filePath=building_geometry_file_path)
importFromSTL_2 = VASA.Utils.TrianglesAsNineNumbers.ImportFromSTL(filePath=context_geometry_file_path)
list_create = List.Create(item0=importFromSTL, item1=importFromSTL_2)

# group: Voxel Model Parameters
# note: Input Variables
# Pink indicates variables that can be altered per project and must be set accordingly before running the script.
coarse_voxel_width_code_block = CodeBlock { 1000; }
# note: Functional Logic
# Cyan indicates the logic of the script. No changes should be made in these groups unless advised.
voxel_rotation_number_slider = DoubleSlider(0, range=-90..90 step 5)
# note: Output Values
# Orange indicates key resulting values of nodes that should be observed after running the graph.
vertical_level_of_detail_integer = IntegerSlider(2, range=0..5 step 1)  # "Vertical Level of Detail - Integer Slider"
finest_level_of_detail_integer = IntegerSlider(2, range=0..5 step 1)  # "Finest Level of Detail - Integer Slider"

# group: Axes
byCoarseVoxelWidthAndOrigin = VASA.Core.Axes.ByCoarseVoxelWidthAndOrigin(coarseVoxelWidth=coarse_voxel_width_code_block, voxelRotation=voxel_rotation_number_slider, verticalLOD=vertical_level_of_detail_integer)
code_block = CodeBlock(voxelLOD=finest_level_of_detail_integer) { voxelLOD; }

# group: Building and Context Voxels
byTrianglesAndAxes = VASA.Core.VoxelModel.ByTrianglesAndAxes(trianglesAsNineNumbers=list_create, axes=byCoarseVoxelWidthAndOrigin, finestLOD=code_block)
union = VASA.Operations.SolidOperations.Union(voxelModels=byTrianglesAndAxes)

# group: Target Geometry Parameters
# note: Display Objects
# Blue indicates objects that can be previewed in the 3D background after running the graph.
tree_x_coordinate_number_slider = DoubleSlider(28000, range=18000..38000 step 10)
tree_y_coordinate_number_slider = DoubleSlider(8000, range=4000..12000 step 10)
tree_foliage_height_number = DoubleSlider(6000, range=4800..7200 step 10)  # "Tree Foliage Height - Number Slider"
tree_trunk_radius_number_slider = DoubleSlider(450, range=400..500 step 10)
tree_foliage_radius_number = DoubleSlider(3600, range=2400..4800 step 10)  # "Tree Foliage Radius - Number Slider"

# group: Target Geometry
# note: The target geometry is a tree consisting of a trunk (Cylinder) and foliage (Sphere).
code_block_2 = CodeBlock { -2; }
byCoordinates = Point.ByCoordinates(x=tree_x_coordinate_number_slider, y=tree_y_coordinate_number_slider, z=code_block_2)
byCoordinates_2 = Point.ByCoordinates(x=tree_x_coordinate_number_slider, y=tree_y_coordinate_number_slider, z=tree_foliage_height_number)
byPointsRadius = Cylinder.ByPointsRadius(startPoint=byCoordinates, endPoint=byCoordinates_2, radius=tree_trunk_radius_number_slider)
byCenterPointRadius = Sphere.ByCenterPointRadius(centerPoint=byCoordinates_2, radius=tree_foliage_radius_number)
list_create_2 = List.Create(item0=byPointsRadius, item1=byCenterPointRadius)

# group: Target Voxels
byGeometryAndAxes = VASA.Core.VoxelModel.ByGeometryAndAxes(geometry=list_create_2, axes=byCoarseVoxelWidthAndOrigin, finestLOD=code_block)
union_2 = VASA.Operations.SolidOperations.Union(voxelModels=byGeometryAndAxes)

# group: Extents
list_create_3 = List.Create(item0=union, item1=union_2)
union_3 = VASA.Operations.SolidOperations.Union(voxelModels=list_create_3)
extents = VASA.Core.VoxelModel.Extents(voxelModel=union_3)
code_block_3 = CodeBlock(voxelLOD=finest_level_of_detail_integer) { voxelLOD; }

# group: Empty Voxel Model
byExtents = VASA.Core.VoxelModel.ByExtents(extents=extents, finestLOD=code_block_3)

# group: View Parameters
view_point_x_number_slider = DoubleSlider(2600, range=-6000..16000 step 10)
view_point_y_number_slider = DoubleSlider(19000, range=18500..26000 step 10)
view_point_z_number_slider = DoubleSlider(5500, range=4500..5500 step 10)
byCoordinates_3 = Point.ByCoordinates(x=view_point_x_number_slider, y=view_point_y_number_slider, z=view_point_z_number_slider)

# group: Projection Parameters
visibility_metric_inner_radius = DoubleSlider(32000, range=30000..100000 step 5)  # "Visibility Metric Inner Radius - Number Slider"
visibility_metric_thickness = DoubleSlider(1000, range=0..2000 step 5)  # "Visibility Metric Thickness - Number Slider"

# group: Projection Radii
code_block_4 = CodeBlock(innerRadius=visibility_metric_inner_radius, thickness=visibility_metric_thickness) { innerRadius; innerRadius + thickness; }

# group: Projection Surface Voxels
visibilityFromPoint = VASA.Operations.VisibilityOperations.VisibilityFromPoint(voxelModel=byExtents, point=byCoordinates_3, maxRadius=code_block_4.out1)
visibilityFromPoint_2 = VASA.Operations.VisibilityOperations.VisibilityFromPoint(voxelModel=byExtents, point=byCoordinates_3, maxRadius=code_block_4.innerRadius)
subtract = VASA.Operations.SolidOperations.Subtract(voxelModel0=visibilityFromPoint, voxelModel1=visibilityFromPoint_2)

# group: Resized Target Voxels
resize = VASA.Core.VoxelModel.Resize(voxelModel=union_2, newExtents=extents)

# group: View Point and Radius
code_block_5 = CodeBlock(viewPoint=byCoordinates_3) { viewPoint; }
code_block_6 = CodeBlock(maxRadius=code_block_4.out1) { maxRadius; }

# group: Unobstructed View to Target
visibilityFromPoint_3 = VASA.Operations.VisibilityOperations.VisibilityFromPoint(voxelModel=resize, point=code_block_5, maxRadius=code_block_6)

# group: Unobstructed Target Projection
subtract_2 = VASA.Operations.SolidOperations.Subtract(voxelModel0=subtract, voxelModel1=visibilityFromPoint_3)

# group: Resized Building and Context Voxels
resize_2 = VASA.Core.VoxelModel.Resize(voxelModel=union, newExtents=extents)

# group: View from a Point
visibilityFromPoint_4 = VASA.Operations.VisibilityOperations.VisibilityFromPoint(voxelModel=resize_2, point=code_block_5, maxRadius=code_block_6)

# group: Visible Target Projection
list_create_4 = List.Create(item0=visibilityFromPoint_4, item1=subtract_2)
intersect = VASA.Operations.SolidOperations.Intersect(voxelModels=list_create_4)

# group: Concealed Target Projection
subtract_3 = VASA.Operations.SolidOperations.Subtract(voxelModel0=subtract_2, voxelModel1=intersect)

# group: Concealed Target Projection Color
color_palette = ColorPalette({R: 138, G: 43, B: 226, A: 127})

# group: Display Concealed Target Projection
displayVoxels = VASA.Core.VoxelModel.DisplayVoxels(voxelModel=subtract_3, color=color_palette)

# group: Target Color
color_palette_2 = ColorPalette({R: 255, G: 255, B: 0, A: 255})

# group: Display Target Voxels
displayVoxels_2 = VASA.Core.VoxelModel.DisplayVoxels(voxelModel=resize, color=color_palette_2)

# group: View Color
color_palette_3 = ColorPalette({R: 127, G: 255, B: 212, A: 63})

# group: Display View
displayVoxels_3 = VASA.Core.VoxelModel.DisplayVoxels(voxelModel=visibilityFromPoint_4, color=color_palette_3)

# group: Visible Target Projection Color
color_palette_4 = ColorPalette({R: 255, G: 20, B: 147, A: 255})

# group: Display Visible Target Projection
displayVoxels_4 = VASA.Core.VoxelModel.DisplayVoxels(voxelModel=intersect, color=color_palette_4)

# group: Visible Fraction of Target
countFilled = VASA.Core.VoxelModel.CountFilled(voxelModel=intersect)
countFilled_2 = VASA.Core.VoxelModel.CountFilled(voxelModel=subtract_2)
div = countFilled / countFilled_2
vertical_sky_component_watch = Watch(div)

# group: Display Building Voxels
displayVoxels_5 = VASA.Core.VoxelModel.DisplayVoxels(voxelModel=resize_2)
