# Dynamo graph Optimized Room Tag Placement.dyn (Dynamo 2.12.0.5650)
# author: Parallax Team for Autodesk
# This workflow adds additional logic to room tagging. In this example we account for ideal placement locations (no overlap), proximity to room center and updating of already placed tags.
# packages: GenerativeDesign 1.10.10.0, DynaShape 0.7.30.0, Dynamo Text 2.0.1, MeshToolkit 3.0.0, Rhythm 2021.7.3, VASA 0.1.0

# note: Variables / Inputs
# Variables that can be altered per project and must be set accordingly before running the graph.

# group: User Inputs
select_room_s = DSModelElementsByCategorySelection("50383581-0df4-4a83-bafb-ea6cc3265f8b-0002b499,50383581-0df4-4a83-bafb-ea6cc3265f8b-0002b49a,50383581-0df4-4a83-bafb-ea6cc3265f8b-0002b49d,50383581-0df4-4a83-bafb-ea6cc3265f8b-0002b49e,50383581-0df4-4a83-bafb-ea6cc3265f8b-0002b49f,50383581-0df4-4a83-bafb-ea6cc3265f8b-0002b4a0,50383581-0df4-4a83-bafb-ea6cc3265f8b-0002b4a2")  # 7 picked in the model; graph input
option = IntegerSlider(36, range=0..100 step 1)  # graph input
select_existing_room_space_tag = DSModelElementSelection()  # 1 picked in the model; graph input

# group: Room Geometry and Data
getLocation = Element.GetLocation(element=select_room_s)
remember = Data.Remember(getLocation)
byOriginNormal = Plane.ByOriginNormal(origin=remember)
finishBoundary = Room.FinishBoundary(room=select_room_s)
remember_2 = Data.Remember(finishBoundary)
firstItem = List.FirstItem(list=remember_2@L3)
name = Room.Name(room=select_room_s)
remember_3 = Data.Remember(name)
solids = Element.Solids(element=select_room_s)
remember_4 = Data.Remember(solids)

# group: Object lookup by room
py_retrieveobjectsinroom = Python(IN[0]=select_room_s)  # CPython3
# ---------- py_retrieveobjectsinroom.python (68 lines) ----------
import clr

clr.AddReference('RevitAPI')
from Autodesk.Revit.DB import *
from Autodesk.Revit.DB.Structure import *

clr.AddReference('RevitAPIUI')
from Autodesk.Revit.UI import *

clr.AddReference('RevitNodes')
import Revit
clr.ImportExtensions(Revit.GeometryConversion)
clr.ImportExtensions(Revit.Elements)

clr.AddReference('RevitServices')
import RevitServices
from RevitServices.Persistence import DocumentManager
from RevitServices.Transactions import TransactionManager

doc = DocumentManager.Instance.CurrentDBDocument
uidoc=DocumentManager.Instance.CurrentUIApplication.ActiveUIDocument


def IntersectingElements(room):
    roomElements = []
    
    bBox = room.get_BoundingBox(doc.ActiveView)
    outline = Outline(bBox.Min,bBox.Max)
    
    boundingBoxIntersectionFilter = BoundingBoxIntersectsFilter(outline)
    familyInstanceFilter = ElementClassFilter(FamilyInstance)
    andFilter = LogicalAndFilter(boundingBoxIntersectionFilter,familyInstanceFilter)
	
    collector = FilteredElementCollector(doc,doc.ActiveView.Id)
    roomElements.extend(collector.WherePasses(andFilter).ToElements())
	
	
    # collect tags
    tagFilter = ElementClassFilter(IndependentTag)
    tagCollector = FilteredElementCollector(doc,doc.ActiveView.Id)
    tags = tagCollector.WherePasses(tagFilter).ToElements()
    roomElements.extend(filter(lambda t: room.IsPointInRoom(t.TagHeadPosition),tags))
    
    # collect dims
    dimFilter = ElementClassFilter(Dimension)
    dimCollector = FilteredElementCollector(doc,doc.ActiveView.Id)
    dims = dimCollector.WherePasses(dimFilter).ToElements()
    for d in dims:
        try:
            if d.NumberOfSegments > 1:
                for ds in d.Segments:
                    if room.IsPointInRoom(ds.TextPosition):
                        roomElements.append(d)
                        break
            else:
                if room.IsPointInRoom(d.TextPosition):
                    roomElements.append(d)
        except:
            s = "do nothing, this dim doesn't work"
            
    return roomElements
    
		
rooms = UnwrapElement(IN[0])

#return the results
if isinstance(IN[0], list): OUT = [IntersectingElements(x) for x in rooms]
else: OUT = IntersectingElements(rooms)
# ----------------------------------------

# group: Items with solid geometry
byUnion = Solid.ByUnion()  # unwired: solids
solids_2 = Element.Solids()  # unwired: element
function_apply = ApplyFunction(function=solids_2, argument0=py_retrieveobjectsinroom)
function_apply_2 = ApplyFunction(function=byUnion, argument0=function_apply)

# group: Items without solid geometry
isNull = Object.IsNull(object=function_apply_2)
boundingBox = Element.BoundingBox()  # unwired: element
code_block = CodeBlock { true; }
allIndicesOf = List.AllIndicesOf(list=isNull@L2, item=code_block)
getItemAtIndex = List.GetItemAtIndex(list=py_retrieveobjectsinroom@L2, index=allIndicesOf@L2)
function_apply_3 = ApplyFunction(function=boundingBox, argument0=getItemAtIndex)
toCuboid = BoundingBox.ToCuboid(boundingBox=function_apply_3)

# group: Items with solid geometry
filterByBoolMask = List.FilterByBoolMask(list=function_apply_2, mask=isNull)

# group: Recombine geometry per room (weave list)
list_create = List.Create(item0=filterByBoolMask.out, item1=toCuboid)
transpose = List.Transpose(lists=list_create)

# group: Cleanup and make single solid per room
flatten = List.Flatten(list=transpose@L3)
code_block_2 = CodeBlock { false; }
clean = List.Clean(list=flatten, preserveIndices=code_block_2)

# group: Room Object Solids
remember_5 = Data.Remember(clean)

# group: Generate Collision Vertices (where tags cannot be placed)
code_block_3 = CodeBlock(roomPlane=byOriginNormal) { roomPlane; }
byGeometry = BoundingBox.ByGeometry(geom=remember_5@@L1)
toCuboid_2 = BoundingBox.ToCuboid(boundingBox=byGeometry)
intersect = Geometry.Intersect(geometry=code_block_3, other=toCuboid_2)
code_block_4 = CodeBlock { false; }

flatten_2 = List.Flatten(list=intersect@L3)

# group (continued): Generate Collision Vertices (where tags cannot be placed)
perimeterCurves = Surface.PerimeterCurves(surface=flatten_2)
startPoint = Curve.StartPoint(curve=perimeterCurves)

# group: Display Obstructions
color_palette = ColorPalette({R: 220, G: 20, B: 20, A: 44})
byGeometryColor = Modifiers.GeometryColor.ByGeometryColor(geometry=perimeterCurves, color=color_palette)

# group: Starting Points - Work around the room elements
byJoinedCurves = PolyCurve.ByJoinedCurves(curves=firstItem)
code_block_5 = CodeBlock { 0..1..#101; }
pointAtParameter = Curve.PointAtParameter(curve=byJoinedCurves, param=code_block_5, lacing=CrossProduct)
getItemAtIndex_2 = List.GetItemAtIndex(list=pointAtParameter@L2, index=option)

code_block_6 = CodeBlock { 1000; }
code_block_7 = CodeBlock { 0.1; 0.95; }

# group: Room tag geometry extraction (for removing from layout grid)
boundingBox_2 = Element.BoundingBox(element=select_existing_room_space_tag)
maxPoint = BoundingBox.MaxPoint(boundingBox=boundingBox_2)
remember_6 = Data.Remember(maxPoint)
X = Point.X(point=remember_6)
Y = Point.Y(point=remember_6)
minPoint = BoundingBox.MinPoint(boundingBox=boundingBox_2)
remember_7 = Data.Remember(minPoint)
Y_2 = Point.Y(point=remember_7)
X_2 = Point.X(point=remember_7)
code_block_8 = CodeBlock(num1=X, num2=Y, num3=Y_2, num4=X_2)
# ---------- code_block_8.designscript (4 lines) ----------
point1 = Point.ByCoordinates(num1, num2, 0);
point2 = Point.ByCoordinates(num1, num3, 0);
point3 = Point.ByCoordinates(num4, num3, 0);
point4 = Point.ByCoordinates(num4, num2, 0);
# ----------------------------------------
byCornerPoints = Rectangle.ByCornerPoints(p1=code_block_8.point1, p2=code_block_8.point2, p3=code_block_8.point3, p4=code_block_8.point4)
width = Rectangle.Width(rectangle=byCornerPoints)
center = Polygon.Center(polygon=byCornerPoints)
byOrigin = CoordinateSystem.ByOrigin(origin=center)

# group: Create radii for room tags
count = List.Count(list=remember)
code_block_9 = CodeBlock(radius=width, count=count) { radius..radius..#count; }

byBestFitThroughPoints = Circle.ByBestFitThroughPoints(points=startPoint)
code_block_10 = CodeBlock { 0..1..#10; }
pointAtParameter_2 = Curve.PointAtParameter(curve=byBestFitThroughPoints@@L1, param=code_block_10)

# group (continued): Generate Collision Vertices (where tags cannot be placed)
clean_2 = List.Clean(list=pointAtParameter_2, preserveIndices=code_block_4)

# group: Goal creation
# note: This goal anchors the point to the room location
anchorGoal_Create = DynaShape.ZeroTouch.Goals.AnchorGoal_Create(startPosition=getItemAtIndex_2, anchor=remember, weight=code_block_6)
# note: Create length goal (this makes the tag try to be as close to room center as possible)
lengthGoal_Create = DynaShape.ZeroTouch.Goals.LengthGoal_Create(startPosition1=getItemAtIndex_2, startPosition2=remember, targetLength=code_block_7.out0, weight=code_block_7.out1)
# note: Create collisions with room objects
convexPolygonCollisionGoal_Create = DynaShape.ZeroTouch.Goals.ConvexPolygonCollisionGoal_Create(centers=getItemAtIndex_2, radii=code_block_9, polygonVertices=clean_2)

# group: Combine goals for DynaShape
list_create_2 = List.Create(item0=anchorGoal_Create, item1=lengthGoal_Create, item2=convexPolygonCollisionGoal_Create)
flatten_3 = List.Flatten(list=list_create_2)

# group: Circle visualization
circleBinder = DynaShape.ZeroTouch.GeometryBinders.CircleBinder(center=remember, radius=code_block_9)

# group: Solve for potential room tag location
boolean = BoolSelector(true)
executeSilently = DynaShape.ZeroTouch.Solver.ExecuteSilently(goals=flatten_3, geometryBinders=circleBinder, execute=boolean)
flatten_4 = List.Flatten(list=executeSilently.geometries)
centerPoint = Circle.CenterPoint(circle=flatten_4)

# group: Output - How close to room centers is the result?
distanceTo = Geometry.DistanceTo(geometry=remember, other=centerPoint)
sum = Math.Sum(values=distanceTo)
total_distance_to_room_center = Watch(sum)  # graph output

code_block_11 = CodeBlock(rectWidth=width) { rectWidth/2; }

# group: Display Room Tag Locations
fromStringOriginAndScale = DynamoText.Text.FromStringOriginAndScale(text=remember_3, origin=centerPoint, scale=code_block_11)
byOrigin_2 = CoordinateSystem.ByOrigin(origin=centerPoint)
transform = Geometry.Transform(geometry=byCornerPoints, fromCoordinateSystem=byOrigin, contextCoordinateSystem=byOrigin_2)

# group: MeshToolkit node to force dependency to load
# note: Remember / Gate Nodes
# Data that needs to be cached from Dynamo for Revit is stored here.
# note: Working / Functions
# Core Workings of the Dynamo Graph
# note: Display / Validation
# Logic used simply for visualization purposes, does not contain core logic.
# note: Checking / Outputs
# Orange indicates checking nodes to ensure the script has deployed correctly.
area = Autodesk.Dynamo.MeshToolkit.Mesh.Area()  # frozen; unwired: mesh

# group: Create/Update Room Tags
current = Document.Current()
activeView = Document.ActiveView(document=current)
gate = Data.Gate(false, select_room_s)
elementType = Element.ElementType(element=select_existing_room_space_tag)
code_block_12 = CodeBlock { true; }
ʳʰʸᵗʰᵐ_roomtag_placeorupdate = Rhythm.Revit.Elements.RoomTag.PlaceOrUpdate(view=activeView, room=gate, location=centerPoint, tagType=elementType, tryUpdateExisting=code_block_12)

byPatch = Surface.ByPatch(closedCurve=transform)

# group: Using voxels to see if tags are within the space and not intersecting other elements
code_block_13 = CodeBlock { 500; }
byGeometry_2 = VASA.Core.VoxelModel.ByGeometry(geometry=byPatch, coarseVoxelWidth=code_block_13)
flatten_5 = List.Flatten(list=remember_4)
byGeometry_3 = VASA.Core.VoxelModel.ByGeometry(geometry=flatten_5, coarseVoxelWidth=code_block_13)
byGeometry_4 = VASA.Core.VoxelModel.ByGeometry(geometry=remember_5, coarseVoxelWidth=code_block_13)
union = VASA.Operations.SolidOperations.Union(voxelModels=byGeometry_4)
subtract = VASA.Operations.SolidOperations.Subtract(voxelModel0=byGeometry_3, voxelModel1=union)
subtract_2 = VASA.Operations.SolidOperations.Subtract(voxelModel0=byGeometry_2, voxelModel1=subtract)
countFilled = VASA.Core.VoxelModel.CountFilled(voxelModel=subtract_2)
sum_2 = Math.Sum(values=countFilled)
countFilled_2 = VASA.Core.VoxelModel.CountFilled(voxelModel=byGeometry_2)
sum_3 = Math.Sum(values=countFilled_2)

# group: Checking if the tags overlap
div = sum_2 / sum_3
code_block_14 = CodeBlock(percent=div) { (percent)*100; 1; }
round = Math.Round(number=code_block_14.out0, digits=code_block_14.out1)

# group: Percentage of Overlap Output
percent_of_tag_overlap_with = Watch(round)  # "Percent of Tag Overlap with Model Elements"; graph output

# group: Display tags with color-coded feedback
isEmpty = VASA.Core.VoxelModel.IsEmpty(voxelModel=subtract_2)
color_palette_2 = ColorPalette({R: 34, G: 139, B: 34, A: 255})
color_palette_3 = ColorPalette({R: 255, G: 0, B: 0, A: 255})
if_ = RefactoredIf(test=isEmpty, true=color_palette_2, false=color_palette_3)
byGeometryColor_2 = Modifiers.GeometryColor.ByGeometryColor(geometry=byPatch, color=if_)
