# Dynamo graph 07-03_Primer_sample_CreateOfficeLayout.dyn (Dynamo 2.0.2.6826)

# group: OFFICE LAYOUT GENERATOR Refinery Graph Example
# note: ADDITIONAL COMMENTS
# 1) Select the floor geometry in your Revit file, on the 'Floor Plate' group
# 2) Select the boundary lines in the Revit model.
# 3) Open Dynamo Refinery (View > Refinery...)
# 4) Create a New Study
# 5) Under generation method select Randomize
# 6) Under Inputs, uncheck and set a value for the inputs that will not change during run
# 7) Under settings, select the number of solutions wanted
# 8) Fix any possible problems in the issues section
# 9) Click generate and wait for the outputs
# note: ASSOCIATED FILE(S)
# dt_CreateOfficeLayout_03.rvt
# note: AUTHOR(S) / CREATION DATE
# designtech.io for Autodesk Refinery Team / Feb 2018
# note: DESCRIPTION
# This Graph can be used with Dynamo Refinery to generate desk layouts on a floor plan. You can use Refinery to maximise the amount of desks placed while maintaining a larger area reserved for amenities.
# note: REQUIRED DYNAMO PACKAGES
# AutodeskGD 2.0.1
# note: DYNAMO PROJECT
# REFINERY_OFFICE_LAYOUT_GENERATOR
# note: DYNAMO VERSION
# 2.0.2

# group: Dynamo Inputs
select_floor_plate = DSModelElementSelection()  # 1 picked in the model
select_neighbourhood_boundaries = DSModelElementsSelection()  # 6 picked in the model
desk_width = DoubleSlider(1400, range=0..14000 step 1)
desk_depth = DoubleSlider(800, range=0..8000 step 1)
back_to_back_tolerance = DoubleSlider(2200, range=0..14000 step 1)

# group: Geometry [Revit/Dynamo]: Extract Floor Geometry
geometry = Element.Geometry(element=select_floor_plate)
explode = Geometry.Explode(geometry=geometry)
planarTop = AutodeskGdGeometry.Surface.PlanarTop(surfaces=explode)
flatten = List.Flatten(list=planarTop.topSurfaces)
# note: The Data.Remember node is installed with the Refinery Extension. It allows the graph to retain information extracted from Revit to enable scripts to be run in Sandbox.
remember = Data.Remember(flatten)
perimeterCurves = Surface.PerimeterCurves(surface=remember)
flatten_2 = List.Flatten(list=perimeterCurves)

# group: Geometry [Revit/Dynamo]: Extract Neighbourhood Boundary Points
geometry_2 = Element.Geometry(element=select_neighbourhood_boundaries)
flatten_3 = List.Flatten(list=geometry_2)
remember_2 = Data.Remember(flatten_3)
startPoint = Curve.StartPoint(curve=remember_2)
endPoint = Curve.EndPoint(curve=remember_2)

# group: Geometry [Dynamo]: Find which Points sit on which Curves
count = List.Count(list=startPoint)
ofRepeatedItem = List.OfRepeatedItem(item=flatten_2, amount=count)
doesIntersect = Geometry.DoesIntersect(geometry=startPoint, other=flatten_2, lacing=CrossProduct)
filterByBoolMask = List.FilterByBoolMask(list=ofRepeatedItem, mask=doesIntersect)
byJoinedCurves = PolyCurve.ByJoinedCurves(curves=filterByBoolMask.in)

# group: Refinery Inputs
# note: BOUNDARY LINES START POINT:
# These inputs are used by Refinery to determine how much the neighbourhood boundaries can move. They should be a number between 0 and 1. For each boundary curve there should be an input here to match.
# note: Variables / Inputs
# Red indicates Variables that can be altered per project and must be set accordingly before running the script.
IN_boundary1_stPt = DoubleSlider(0, range=0..1 step 0.1)  # graph input
IN_boundary2_stPt = DoubleSlider(0.7, range=0..1 step 0.1)  # graph input
# note: Working / Functions
# Green indicates the working of the script. No changes should be made in these groups unless advised.
IN_boundary3_stPt = DoubleSlider(1, range=0..1 step 0.1)  # graph input
IN_boundary4_stPt = DoubleSlider(0.6, range=0..1 step 0.1)  # graph input
# note: Checking / Outputs
# Orange indicates checking nodes to ensure the script has deployed correctly.
IN_boundary5_stPt = DoubleSlider(0.4, range=0..1 step 0.1)  # graph input
IN_boundary6_stPt = DoubleSlider(0.2, range=0..1 step 0.1)  # graph input
# note: BOUNDARY LINES END POINT:
# These inputs are used by Refinery to determine how much the neighbourhood boundaries can move. They should be a number between 0 and 1. For each boundary curve there should be an input here to match.
IN_boundary1_endPt = DoubleSlider(0.5, range=0..1 step 0.1)  # graph input
IN_boundary2_endPt = DoubleSlider(1, range=0..1 step 0.1)  # graph input
IN_boundary3_endPt = DoubleSlider(0.8, range=0..1 step 0.1)  # graph input
IN_boundary4_endPt = DoubleSlider(0.5, range=0..1 step 0.1)  # graph input
IN_boundary5_endPt = DoubleSlider(0.9, range=0..1 step 0.1)  # graph input
IN_boundary6_endPt = DoubleSlider(0.2, range=0..1 step 0.1)  # graph input

join = List.Join(list0=IN_boundary1_stPt, list1=IN_boundary2_stPt, list2=IN_boundary3_stPt, list3=IN_boundary4_stPt, list4=IN_boundary5_stPt, list5=IN_boundary6_stPt)

# group: Goemetry [Dynamo]: Find which Points sit on which Curves
count_2 = List.Count(list=endPoint)
ofRepeatedItem_2 = List.OfRepeatedItem(item=flatten_2, amount=count_2)
doesIntersect_2 = Geometry.DoesIntersect(geometry=endPoint, other=flatten_2, lacing=CrossProduct)
filterByBoolMask_2 = List.FilterByBoolMask(list=ofRepeatedItem_2, mask=doesIntersect_2)
byJoinedCurves_2 = PolyCurve.ByJoinedCurves(curves=filterByBoolMask_2.in)

join_2 = List.Join(list0=IN_boundary1_endPt, list1=IN_boundary2_endPt, list2=IN_boundary3_endPt, list3=IN_boundary4_endPt, list4=IN_boundary5_endPt, list5=IN_boundary6_endPt)

# group: Geometry [Dynamo]: Create New Neighbourhood Boundaries
code_block = CodeBlock { 1000; }
moveAlongCurve = AutodeskGdGeometry.Point.MoveAlongCurve(point=startPoint, polycurve=byJoinedCurves, length=code_block, param=join)
moveAlongCurve_2 = AutodeskGdGeometry.Point.MoveAlongCurve(point=endPoint, polycurve=byJoinedCurves_2, length=code_block, param=join_2)
byStartPointEndPoint = Line.ByStartPointEndPoint(startPoint=moveAlongCurve, endPoint=moveAlongCurve_2)

# group: Geometry [Dynamo]: Split Floor Surface into Multiple Surfaces
intersect = Geometry.Intersect(geometry=remember, other=byStartPointEndPoint, lacing=Longest)
type = Object.Type(obj=intersect)
code_block_2 = CodeBlock { "Autodesk.DesignScript.Geometry.Line"; }
eq = type == code_block_2
filterByBoolMask_3 = List.FilterByBoolMask(list=intersect, mask=eq)
flatten_4 = List.Flatten(list=filterByBoolMask_3.in)
splitPlanarSurfaceByMultipleCurves = AutodeskGdGeometry.Surface.SplitPlanarSurfaceByMultipleCurves(srf=remember, crvs=flatten_4)
flatten_5 = List.Flatten(list=splitPlanarSurfaceByMultipleCurves)

# group: Logic: Generate Amenity Spaces
code_block_3 = CodeBlock { 1000; 3000; }
create = Autodesk.RefineryToolkits.SpacePlanning.Generate.AmenitySpace.Create(surface=flatten_5, offset=code_block_3.out0, depth=code_block_3.out1)
perimeterCurves_2 = Surface.PerimeterCurves(surface=create.amenitySrf)
code_block_4 = CodeBlock(amenitySurfaces=create.amenitySrf) { amenitySurfaces; }

# group: Logic: Generate new Desk Layout
create_2 = Autodesk.RefineryToolkits.SpacePlanning.Generate.DeskLayout.Create(surface=create.remainSrf, deskWidth=desk_width, deskDepth=desk_depth, backToBack=back_to_back_tolerance)

# group: Math: Calculate Number of Desks
flatten_6 = List.Flatten(list=create_2)
count_3 = List.Count(list=flatten_6)

# group: Math: Calculate Areas
area = Surface.Area(surface=create.amenitySrf)
code_block_5 = CodeBlock(x=area) { Math.Sum(x); }
convert_between_units = DynamoConvert(code_block_5, MeasurementType="Area", FromConversion="SquareMillimeter", ToConversion="SquareMeter")
code_block_6 = CodeBlock(x=convert_between_units) { Math.Round(x,2); }

# group: Outputs
# note: NOTE:
# In order to see an "Output" in Refinery, you have to right-click on a compatible node and check the "is Output" option. Rename the node to see a legible output name in Refinery.
number_of_desks = Watch(count_3)  # graph output
total_amenity_space_area_m² = Watch(code_block_6)  # graph output
