# Dynamo graph 03-01_DistributingLightsInSpace.dyn (Dynamo 2.16.4.10216)
# author: Autodesk Dynamo Team
# This graph can be used to optimize light distribution in a hypothetical office layout by minimizing both the number of lighting fixtures and over-lit points, but simultaneously maximizing the number of lit points on the floor surface within the space.
# packages: GenerativeDesign 3.0.18.0

# group: Manual Inputs
select_model_element_by_category = DSModelElementByCategorySelection("OST_Rooms")  # 1 picked in the model
grid_size_mm = CodeBlock { 1000; }
light_power_maximum_distance_mm = DoubleSlider(9450, range=4000..12000 step 5)  # "Light Power - Maximum distance (mm) a ray can be cast"
light_intensity_luxes = DoubleSlider(50000, range=10000..70000 step 5000)

# group: Getting Context Geometry
faces = Element.Faces()  # unwired: element
function_apply = ApplyFunction(function=faces, argument0=select_model_element_by_category)
remember = Data.Remember(function_apply)
code_block = CodeBlock(surfaces=remember)
# ---------- code_block.designscript (4 lines) ----------
midParameter = 0.5;
surfaceVectors = Surface.NormalAtParameter(surfaces, midParameter, midParameter);
areHorizontal = Vector.IsParallel(surfaceVectors, Vector.ZAxis());
t3 = List.FilterByBoolMask(surfaces, areHorizontal)["in"];
# ----------------------------------------
area = Surface.Area()  # unwired: surface
sortByFunction = List.SortByFunction(list=code_block.t3, sortFunction=area)
code_block_2 = CodeBlock { -2; }
takeItems = List.TakeItems(list=sortByFunction, amount=code_block_2)
byGeometry = BoundingBox.ByGeometry(geom=takeItems)
code_block_3 = CodeBlock { 0.5; }
pointAtParameter = Surface.PointAtParameter(u=code_block_3, v=code_block_3)  # unwired: surface
Z = Point.Z()  # unwired: point
function_compose = ComposeFunctions(func0=pointAtParameter, func1=Z)
maximumItemByKey = List.MaximumItemByKey(list=takeItems, keyFunction=function_compose)
minimumItemByKey = List.MinimumItemByKey(list=takeItems, keyFunction=function_compose)
code_block_4 = CodeBlock(boundingBox=byGeometry, ceiling=maximumItemByKey, floor=minimumItemByKey) { boundingBox; ceiling; floor; }

code_block_5 = CodeBlock(gridSize=grid_size_mm) { gridSize; }

# group: Calculate Floor Analisys Points
code_block_6 = CodeBlock(floor=code_block_4.floor, gridSize=code_block_5) { floor; gridSize; }
byGeometry_2 = BoundingBox.ByGeometry(geom=code_block_6.floor)
minPoint = BoundingBox.MinPoint(boundingBox=byGeometry_2)
maxPoint = BoundingBox.MaxPoint(boundingBox=byGeometry_2)
byTwoPoints = Vector.ByTwoPoints(start=minPoint, end=maxPoint)
code_block_7 = CodeBlock(diagonal=byTwoPoints, gridSize=code_block_6.gridSize)
# ---------- code_block_7.designscript (8 lines) ----------
floorWidth = diagonal.X;
floorLength = diagonal.Y;

widthGrids = Math.Ceiling(floorWidth / gridSize);
lengthGrids = Math.Ceiling(floorLength / gridSize);

uParameters = 0..1..#widthGrids;
vParameters = 0..1..#lengthGrids;
# ----------------------------------------
pointAtParameter_2 = Surface.PointAtParameter(surface=code_block_6.floor, u=code_block_7.uParameters, v=code_block_7.vParameters, lacing=CrossProduct)
inside_points = CodeBlock(surf=code_block_6.floor, points=pointAtParameter_2) { FilterPointsOutsideFace(surf, points); }
analisys_points = List.Flatten(list=inside_points)

# group: Generative Design Inputs (Light locations)
U1 = DoubleSlider(0.24, range=0..1 step 0.02)  # graph input
U2 = DoubleSlider(0.36, range=0..1 step 0.02)  # graph input
U3 = DoubleSlider(0.58, range=0..1 step 0.02)  # graph input
U4 = DoubleSlider(0.74, range=0..1 step 0.02)  # graph input
list_create = List.Create(item0=U1, item1=U2, item2=U3, item3=U4)
# note: Variables / Inputs
# Green indicates Variables that can be altered per project and must be set accordingly before running the script.
V1 = DoubleSlider(0.16, range=0..1 step 0.02)  # graph input
# note: Working / Functions
# Orange indicates the working of the script. No changes should be made in these groups unless advised.
V2 = DoubleSlider(0.38, range=0..1 step 0.02)  # graph input
V3 = DoubleSlider(0.54, range=0..1 step 0.02)  # graph input
V4 = DoubleSlider(0.82, range=0..1 step 0.02)  # graph input
list_create_2 = List.Create(item0=V1, item1=V2, item2=V3, item3=V4)

# group: Create Light Location Points
pointAtParameter_3 = Surface.PointAtParameter(surface=code_block_4.ceiling, u=list_create, v=list_create_2, lacing=CrossProduct)

# group: Filtering Lighting outside ceiling
inside_points_2 = CodeBlock(surf=code_block_4.ceiling, points=pointAtParameter_3) { FilterPointsOutsideFace(surf, points); }
lighting_points = List.Flatten(list=inside_points_2)

# group: Get light blocking geometry from linked model
all_elements_in_active_view = ElementsInView()
getCategory = Element.GetCategory(element=all_elements_in_active_view)
code_block_8 = CodeBlock { ["Walls","Columns","Curtain Panels"]; }
byName = Category.ByName(name=code_block_8)
getElementsOfActiveFloorOfCategories = Python(IN[0]=all_elements_in_active_view, IN[1]=getCategory, IN[2]=byName)  # CPython3
# ---------- getElementsOfActiveFloorOfCategories.python (24 lines) ----------
# Load the Python Standard and DesignScript Libraries
import sys
import clr
clr.AddReference('ProtoGeometry')
from Autodesk.DesignScript.Geometry import *

# The inputs to this node will be stored as a list in the IN variables.
Elements = IN[0]
ElementsCategories = IN[1]
categoriesToSelect = IN[2]
listOut = []

def IsCategorySelected(category, categoriesToSelect):
        for c in categoriesToSelect:
                if category == c:
                        return True
        return False

for i,e in enumerate(Elements):
        elementCategory = ElementsCategories[i]
        if IsCategorySelected(elementCategory,categoriesToSelect):
                listOut.append(e)

OUT = listOut
# ----------------------------------------
geometry = Element.Geometry(element=getElementsOfActiveFloorOfCategories)
flatten = List.Flatten(list=geometry)
remember_2 = Data.Remember(flatten)

# group: Exclude geometry outside floor and ceiling space
code_block_9 = CodeBlock(obstacles=remember_2, contextBoundingBox=code_block_4.boundingBox) { obstacles; contextBoundingBox; }
byGeometry_3 = BoundingBox.ByGeometry(geom=code_block_9.obstacles@L1)
intersects = BoundingBox.Intersects(boundingBox=code_block_9.contextBoundingBox, other=byGeometry_3)
filterByBoolMask = List.FilterByBoolMask(list=code_block_9.obstacles, mask=intersects)
flatten_2 = List.Flatten(list=filterByBoolMask.in)

# group: Computing variables
# note: Use parallel processing (significant speed bost on my 4c/8t)
parallel = BoolSelector(false)
# note: Using pre filtering by Ray-Box intersection
use_improved_python = BoolSelector(true)

# group: Python, ray trace each light to each floor point to calculate recieved light
code_block_10 = CodeBlock(floorPoints=analisys_points, lightLocations=lighting_points, blockingGeometry=flatten_2, maxDistance=light_power_maximum_distance_mm, intensity=light_intensity_luxes, parallelComputing=parallel, improvedVersion=use_improved_python) { floorPoints; lightLocations; blockingGeometry; maxDistance; intensity; parallelComputing; improvedVersion; }
python_custom_ray_tracer = Python(IN[0]=code_block_10.lightLocations, IN[1]=code_block_10.floorPoints, IN[2]=code_block_10.blockingGeometry, IN[3]=code_block_10.maxDistance, IN[4]=code_block_10.intensity, IN[5]=code_block_10.parallelComputing, IN[6]=code_block_10.improvedVersion)  # CPython3
# ---------- python_custom_ray_tracer.python (210 lines) ----------
#By Jared Linden Jaredlindn@hoarelea.com
# Enable Python support and load DesignScript library
import clr
import math
clr.AddReference('ProtoGeometry')
from Autodesk.DesignScript.Geometry import *

from System.Threading.Tasks import *
import time

import _collections
from _collections import deque

#Classes
class Ray:
        EPS = 1e-5
        def __init__(self, point1, point2):
                self.origin = point1
                self.dir = Vector.ByTwoPoints(point1, point2)

                invX = 1/self.dir.X if math.fabs(self.dir.X) >= self.EPS else 0
                invY = 1/self.dir.Y if math.fabs(self.dir.Y) >= self.EPS else 0
                invZ = 1/self.dir.Z if math.fabs(self.dir.Z) >= self.EPS else 0

                self.invdir = Vector.ByCoordinates(invX, invY, invZ)
                self.sign = [self.invdir.X < 0, self.invdir.Y < 0, self.invdir.Z < 0]


class BoundedGeometry:
        EPS = 1e-5

        def __init__(self, geometry):
                self.geometry = geometry
                bbox = BoundingBox.ByGeometry(geometry)

                self.bounds = [bbox.MinPoint,bbox.MaxPoint]
                self.minPoint = bbox.MinPoint
                self.maxPoint = bbox.MaxPoint

        def inRange(self, value, min, max):
                return value >= min and value <= max

        def isInside(self, x, y, z):

                betweenX = x >= self.minPoint.X and x <= self.maxPoint.X
                betweenY = y >= self.minPoint.Y and y <= self.maxPoint.Y
                betweenZ = z >= self.minPoint.Z and z <= self.maxPoint.Z
                return betweenX and betweenY and betweenZ

        def intersects(self, ray):

                if self.isInside(ray.origin.X, ray.origin.Y, ray.origin.Z) or self.isInside(ray.origin.X + ray.dir.X, ray.origin.Y + ray.dir.Y, ray.origin.Z + ray.dir.Z):
                        return True

                signX = ray.sign[0]
                signY = ray.sign[1]
                signZ = ray.sign[2]

                intersectsX = intersectsY = intersectsZ = False
                planesIntersected = 0

                tmin = tymin = tzmin = float("-inf")
                tmax = tymax = tzmax = float("inf")

                if ray.invdir.X != 0:
                        intersectsX = True
                        planesIntersected += 1
                        tmin = (self.bounds[signX].X - ray.origin.X) * ray.invdir.X;
                        tmax = (self.bounds[1 - signX].X - ray.origin.X) * ray.invdir.X;

                if ray.invdir.Y != 0:
                        intersectsY = True
                        planesIntersected += 1
                        tymin = (self.bounds[signY].Y - ray.origin.Y) * ray.invdir.Y;
                        tymax = (self.bounds[1 - signY].Y - ray.origin.Y) * ray.invdir.Y;


                        if tmin > tymax or tymin > tmax:
                                return False

                        if tymin > tmin:
                                tmin = tymin

                        if tymax < tmax:
                                tmax = tymax


                if ray.invdir.Z != 0:
                        intersectsZ = True
                        planesIntersected += 1
                        tzmin = (self.bounds[signZ].Z - ray.origin.Z) * ray.invdir.Z;
                        tzmax = (self.bounds[1 - signZ].Z - ray.origin.Z) * ray.invdir.Z;

                        if tmin > tzmax or tzmin > tmax:
                                return False

                        if tzmin > tmin:
                                tmin = tzmin

                        if tzmax < tmax:
                                tmax = tzmax

                if planesIntersected <= 1:
                        if intersectsX:
                                return self.inRange(ray.origin.Y, self.minPoint.Y, self.maxPoint.Y) and self.inRange(ray.origin.Z, self.minPoint.Z, self.maxPoint.Z)

                        if intersectsY:
                                return self.inRange(ray.origin.X, self.minPoint.X, self.maxPoint.X) and self.inRange(ray.origin.Z, self.minPoint.Z, self.maxPoint.Z)

                        if intersectsY:
                                return self.inRange(ray.origin.X, self.minPoint.X, self.maxPoint.X) and self.inRange(ray.origin.Y, self.minPoint.Y, self.maxPoint.Y)

                return True


###



lightlocations = IN[0]
floorpoints = IN[1]
blockinggeometry = IN[2]
boundedgeometry = [BoundedGeometry(geo) for geo in blockinggeometry]
maxdist = IN[3]
intensity = IN[4]

parallel = IN[5]
improvedVersion = IN[6]


lines = []

#Using a dictionary shared between multiple threads... seems to be ok
resultdict = {}
execpts = []


# Place your code below this line
startime = round(time.time() * 1000)


def calclightpointscore(lightpoint, i):

        #Attempt to keep commonly clashing geometry at the front of the queue
        #Appears to makes little difference to speeed though
        geocache = deque([x for x in blockinggeometry if Geometry.DistanceTo(x, lightpoint) < maxdist])

        for fpi, floorpoint in enumerate(floorpoints):
                fps = 0
                if Geometry.DistanceTo(floorpoint, lightpoint) < maxdist:
                        try:
                                line = Line.ByStartPointEndPoint(lightpoint, floorpoint)
                                intersect = False
                                for gi, geo in enumerate(geocache):
                                        if Geometry.DoesIntersect(line, geo):
                                                if gi > 2:
                                                        del geocache[gi]
                                                        geocache.appendleft(geo)
                                                intersect = True
                                                break
                                if not intersect:
                                        fps = intensity * (line.Length ** -2)

                                        lines.append(line)
                        except Exception as inst:
                                execpts.append(inst)
                        resultdict[fpi] += fps

def calclightpointscoreImproved(lightpoint, i):

        #Attempt to keep commonly clashing geometry at the front of the queue
        #Appears to makes little difference to speeed though

        for fpi, floorpoint in enumerate(floorpoints):
                fps = 0
                ray = Ray(lightpoint, floorpoint)
                if ray.dir.Length < maxdist:

                        try:
                                line = Line.ByStartPointEndPoint(lightpoint, floorpoint)
                                intersect = False
                                for gi, bgeo in enumerate(boundedgeometry):
                                        if bgeo.intersects(ray) and Geometry.DoesIntersect(line, bgeo.geometry):
                                                intersect = True
                                                break
                                if not intersect:
                                        fps = intensity * (line.Length ** -2)
                                        lines.append(line)
                        except Exception as inst:
                                execpts.append(inst)

                        resultdict[fpi] += fps


methodSelected = calclightpointscoreImproved if improvedVersion else calclightpointscore

for i, point in enumerate(floorpoints):
        resultdict[i]=0

if parallel:
        Parallel.ForEach(lightlocations, lambda lp, state, i: methodSelected(lp, i))
else:
        for i, fp in enumerate(lightlocations):
                methodSelected(fp, i)


output = [resultdict[i] for i, point in enumerate(floorpoints)]

# Assign your output to the OUT variable.
OUT = output, lines, int(round(time.time() * 1000) - startime), execpts
# ----------------------------------------
code_block_11 = CodeBlock(output=python_custom_ray_tracer) { pointIntensity = output[0]; lines = output[1]; runtime = output[2]; errors = output[3]; }

# group: Score for Generative Design - number of unlit floor points
code_block_12 = CodeBlock { 0; }
allIndicesOf = List.AllIndicesOf(list=code_block_11.pointIntensity, item=code_block_12)
unlit_floor_points = List.Count(list=allIndicesOf)  # graph output

# group: Colour the floor points pased on recieved light intensity
code_block_13 = CodeBlock(floorPoints=code_block_10.floorPoints, pointIntensities=code_block_11.pointIntensity) { floorPoints; pointIntensities; }
maximumItem = List.MaximumItem(list=code_block_11.pointIntensity)
code_block_14 = CodeBlock(x=code_block_13.pointIntensities, max=maximumItem) { x>0?(x/max)*255:0; }
code_block_15 = CodeBlock(y=code_block_14) { 255-y; }
byARGB = Color.ByARGB(alpha=code_block_14, red=code_block_14, blue=code_block_15)
byGeometryColor = Modifiers.GeometryColor.ByGeometryColor(geometry=code_block_13.floorPoints, color=byARGB)

# group: Score for Generative Design- number of overlit floor points. Maybe minimising power distribution would be better
code_block_16 = CodeBlock { 0.012; }
gt = code_block_11.pointIntensity > code_block_16
filterByBoolMask_2 = List.FilterByBoolMask(list=code_block_11.pointIntensity, mask=gt)
overlit_floor_points = List.Count(list=filterByBoolMask_2.in)  # graph output

# group: Visualise the light locations
code_block_17 = CodeBlock { 500; }
byCenterPointRadius = Sphere.ByCenterPointRadius(centerPoint=lighting_points, radius=code_block_17)
color_palette = ColorPalette({R: 255, G: 255, B: 0, A: 255})
byGeometryColor_2 = Modifiers.GeometryColor.ByGeometryColor(geometry=byCenterPointRadius, color=color_palette)

# group: Outputs
python_run_time = Watch(code_block_11.runtime)
errors = Watch(code_block_11.errors)
lines = CodeBlock(lines=code_block_11.lines) { lines; }

# note: Checking / Outputs
# Red indicates checking nodes to ensure the script has deployed correctly.
code_block_18 = CodeBlock()
# ---------- code_block_18.designscript (10 lines) ----------
def FilterPointsOutsideFace(surface, points){

flatPoints = List.Flatten(points, 1);
intersects = Geometry.DoesIntersect(surface, flatPoints);

intersecting = List.FilterByBoolMask(flatPoints, intersects)["in"];

return intersecting;

};
# ----------------------------------------
watch = Watch(code_block_10.intensity)
