# Dynamo custom node BoundingBox.2dRectangle.dyf "ꟿ BoundingBox.2dRectangle" (Dynamo 2.0.2.6826)
# category: Springs.Geometry.Actions
# Returns a 2d rectangle from a bounding box

boundingBox = Input(boundingBox: Autodesk.DesignScript.Geometry.BoundingBox)
elevation = Input(elevation: double = 0)
code_block = CodeBlock(bb=boundingBox, z=elevation)
# ---------- code_block.designscript (7 lines) ----------
a = bb.MinPoint;
b = bb.MaxPoint;
r1 = Rectangle.ByCornerPoints(
  Point.ByCoordinates(a.X, a.Y, z),
  Point.ByCoordinates(b.X, a.Y, z),
  Point.ByCoordinates(b.X, b.Y, z),
  Point.ByCoordinates(a.X, b.Y, z) );
# ----------------------------------------
rectangle = Output(code_block.r1)
