# Dynamo custom node Curve.Offset+.dyf "ꟿ Curve.Offset+" (Dynamo 2.0.2.6826)
# category: Springs.Geometry.Actions
# Offsets a curve towards the specified point

distance = Input(distance: var)
curve = Input(curve: var)
point = Input(point: var)
distanceTo = Geometry.DistanceTo(other=point)  # unwired: geometry
code_block = CodeBlock(dist=distance, c=curve, fn1=distanceTo) { d1 = [- dist, dist]; cl1 = c.Offset(d1<1>); c1 = MinimumItemByKey(cl1, fn1); }
curve_2 = Output(code_block.c1)  # "curve"
