# Dynamo custom node List.FirstLast.dyf "ꟿ List.FirstLast" (Dynamo 2.0.2.6826)
# category: Springs.Actions
# Simple utility node to get both the first and last items of a list as separate outputs. This avoids the unnecessary sublist when using the List.Deconstruct node.

list = Input(list: var[]..[])
firstItem = List.FirstItem(list=list)
first = Output(firstItem)
lastItem = List.LastItem(list=list)
last = Output(lastItem)
list_create = List.Create(item0=firstItem, item1=lastItem)
combined = Output(list_create)
