# Dynamo custom node List.MaxIndex.dyf "ꟿ List.MaxIndex" (Dynamo 2.0.3.8810)
# category: Springs.Actions
# Gets the maximum index of a list. Good for use with floating point values

list = Input(list: var[])
python_script = Python(IN[0]=list)
# ---------- python_script.python (10 lines) ----------
# Copyright(c) 2019, Dimitar Venkov
# @5devene, dimitar.ven@gmail.com
# www.badmonkeys.net

def tolist(x):
	if hasattr(x,'__iter__'): return x
	return [x]

data = tolist(IN[0])
OUT = max(enumerate(data), key=lambda x: x[1])
# ----------------------------------------
code_block = CodeBlock(r=python_script) { r[0]; r[1]; }
idx = Output(code_block.out0)
val = Output(code_block.out1)
