# Dynamo custom node List.NullReorder.dyf "ꟿ List.NullReorder" (Dynamo 2.0.2.6826)
# category: Springs.Actions
# Simiar to the built-in function with the difference that it can handle null indices. Part of the SmartCopyMonitor workflow.

list = Input(list: var[])
indices = Input(indices: var[])
code_block = CodeBlock(l1=list, l2=indices)
# ---------- code_block.designscript (16 lines) ----------
l1;
l2;
l3 = [Imperative]
{
out1 = [];
n = 0;
for (i in l2)
{
	if (i != null)
	{
		out1[i] = l1[n];
	}
	n = n + 1;
}
return = out1;
};
# ----------------------------------------
list_2 = Output(code_block.out2)  # "list"
