# Dynamo custom node Math.Median.dyf "ꟿ Math.Median" (Dynamo 2.0.3.8810)
# category: Springs.Query
# Calculate a median value from a list of numbers

list = Input(list: var[])
code_block = CodeBlock(x=list)
# ---------- code_block.designscript (7 lines) ----------
xs = List.Sort(x);
n = List.Count(x);
m = Math.Ceiling(n / 2);
odd = xs[m-1];
even = (odd + xs[m]) / 2;
isEven = n % 2 == 0;
r = isEven ? even : odd;
# ----------------------------------------
median = Output(code_block.r)
