# Dynamo custom node Process.EmptyWorkingSet.dyf "ꟿ Process.EmptyWorkingSet" (Dynamo 2.0.2.6826)
# category: Springs.Revit.Utility.Actions
# Use at your own risk! Removes as many pages as possible from the working set of the active Revit session.

object = Input(object: var[]..[])
python_script = Python(IN[0]=object)
# ---------- python_script.python (12 lines) ----------
import System
from System.Diagnostics import Process

pf_path = System.Environment.GetFolderPath(System.Environment.SpecialFolder.ProgramFilesX86)
import sys
sys.path.append('%s\IronPython 2.7\Lib' %pf_path)
import ctypes

#flush = ctypes.windll.psapi.EmptyWorkingSet #before Windows 7
flush = ctypes.windll.kernel32.K32EmptyWorkingSet
try_flush = flush(Process.GetCurrentProcess().Handle)
OUT = try_flush != 0
# ----------------------------------------
success = Output(python_script)
