# Dynamo custom node RelativeLevel.AtHeight.dyf "ꟿ RelativeLevel.AtHeight" (Dynamo 2.0.2.6826)
# category: Springs.Revit.Utility.Query
# Select the level closest to the input height from the list of input levels

zHeight = Input(zHeight: var[])
elevations = Input(elevations: var[])
levels = Input(levels: var[])
belowOnly = Input(belowOnly: bool = false)
python_script = Python(IN[0]=zHeight, IN[1]=elevations, IN[2]=levels, IN[3]=belowOnly)
# ---------- python_script.python (17 lines) ----------
# Copyright(c) 2018, Dimitar Venkov
# @5devene, dimitar.ven@gmail.com
# www.badmonkeys.net

from itertools import izip

heights, elevs, names, belowOnly = IN
BIG_VAL = float('inf')

def evalHeight(e, belowOnly=belowOnly):
	if belowOnly:
		if e > z:
			return BIG_VAL
	return abs(z - e)

lvl_dict = dict(izip(map(int,elevs), names))
OUT = [lvl_dict[min(lvl_dict, key=evalHeight)] for z in heights]
# ----------------------------------------
level = Output(python_script)
