# Dynamo custom node Utility.Announce.dyf "ꟿ Utility.Announce" (Dynamo 2.0.2.6826)
# category: Springs.Actions
# Uses the standard windows speech synthesiser to make an announcement when the note gets executed. Useful when placed after a long running task.

message = Input(message: string = "Dynamo task complete.")
passThrough = Input(passThrough: var[]..[])
count = List.Count(list=passThrough)
python_script = Python(IN[0]=message, IN[1]=count)
# ---------- python_script.python (9 lines) ----------
import clr
clr.AddReference('System.Speech')
import System.Speech as sp
import System.Speech.Synthesis as sy

se = sy.SpeechSynthesizer()
se.SelectVoiceByHints(sy.VoiceGender.Female, sy.VoiceAge.Adult)
se.Rate = 3
se.SpeakAsync(IN[0])
# ----------------------------------------
passThrough_2 = Output(passThrough)  # "passThrough"
