# Dynamo graph 05-01_ViewPlacementOnSheet.dyn (Dynamo 2.16.4.10216)
# author: Dynamo Team
# This will layout viewports on a selected sheet in a variety of ways.
# packages: spring nodes 204.1.0, GenerativeDesign 3.0.18.0, Rhythm 2024.10.1

# group: User Inputs
select_sheet = Sheets("GenerativeDesignLayout")  # graph input
option = DoubleSlider(182, range=0..500 step 1)  # graph input

# group: Get the sheet titleblock and extract a rectangle representing it
titleBlock = Sheet.TitleBlock(sheet=select_sheet)
boundingBox = Element.BoundingBox(element=titleBlock)
minPoint = BoundingBox.MinPoint(boundingBox=boundingBox)
remember = Data.Remember(minPoint)
maxPoint = BoundingBox.MaxPoint(boundingBox=boundingBox)
remember_2 = Data.Remember(maxPoint)
byCorners = BoundingBox.ByCorners(min=remember, max=remember_2)
# note: Custom Package: spring nodes v.204.1.0
# note: Custom Node: spring nodesv.204.1.0
ꟿ_boundingbox_2drectangle = Custom[ꟿ BoundingBox.2dRectangle](boundingBox=byCorners)  # package spring nodes; Returns a 2d rectangle from a bounding box

# group: Margins for titleblock
left_margin = DoubleSlider(21, range=0..100 step 0.1)
right_margin = DoubleSlider(-120, range=-165..165 step 0.1)
bottom_margin = DoubleSlider(20, range=-25..100 step 0.1)
top_margin = DoubleSlider(-21, range=-30..100 step 0.1)

# group: Combined translation data
x_translations = List.Create(item0=left_margin, item1=right_margin, item2=right_margin, item3=left_margin)
y_translations = List.Create(item0=bottom_margin, item1=bottom_margin, item2=top_margin, item3=top_margin)

# group: Add the offset to the titleblock boundaries
points = PolyCurve.Points(polyCurve=ꟿ_boundingbox_2drectangle)
flatten = List.Flatten(list=points)
translate = Geometry.Translate(geometry=flatten, xTranslation=x_translations, yTranslation=y_translations)
byCornerPoints = Rectangle.ByCornerPoints(points=translate)

# group: Extract Viewports for selected sheet
viewports = Sheet.Viewports(sheet=select_sheet)

# group: Allows us to retrieve the elements later on. (this makes it generative design compatible)
id = Element.Id(element=viewports)

# group: View Title Dimensions
offset_left_to_right = UnitInput("-0\"", UnitType="autodesk.unit.unit:feet-1.0.1")  # graph input
offset_top_to_bottom = UnitInput("-0\"", UnitType="autodesk.unit.unit:feet-1.0.1")  # graph input
view_title_line_length_buffer = UnitInput("0\"", UnitType="autodesk.unit.unit:feet-1.0.1")  # graph input

# group: Relocate the view title and extract the real outermost bounding box (includes view title and view boundary)
py_relocateviewtitle = Python(IN[0]=viewports, IN[1]=offset_left_to_right.Value, IN[2]=offset_top_to_bottom.Value, IN[3]=view_title_line_length_buffer.Value)  # ".py | relocateViewTitle+ReturnRealBoundary"; CPython3
# ---------- py_relocateviewtitle.python (67 lines) ----------
# Load the Python Standard and DesignScript Libraries
import sys
import clr
clr.AddReference('ProtoGeometry')
from Autodesk.DesignScript.Geometry import *

clr.AddReference('RevitAPI')
from Autodesk.Revit.DB import *

clr.AddReference('RevitNodes')
import Revit
clr.ImportExtensions(Revit.GeometryConversion)
clr.ImportExtensions(Revit.Elements)

clr.AddReference('RevitServices')
import RevitServices
from RevitServices.Persistence import DocumentManager
from RevitServices.Transactions import TransactionManager

doc = DocumentManager.Instance.CurrentDBDocument
uidoc=DocumentManager.Instance.CurrentUIApplication.ActiveUIDocument

def toList(x):
        if isinstance(x,list): return UnwrapElement(x)
        else : return [UnwrapElement(x)]



viewports = UnwrapElement(IN[0])

horizontalOffset = IN[1]
verticalOffset = IN[2]
lineLengthBuffer = IN[3]

viewportData = []

for i in viewports:
        #get viewport width data
        box = i.GetBoxOutline()
        min = box.MinimumPoint
        max = box.MaximumPoint

        #set the label location and length initially
        TransactionManager.Instance.EnsureInTransaction(doc)
        i.LabelOffset = XYZ(horizontalOffset,verticalOffset,0)
        i.LabelLineLength = max.X - min.X + lineLengthBuffer
        TransactionManager.Instance.TransactionTaskDone()

        #sublist to append to
        vData = []

        #real minimum point
        labelOutline = i.GetLabelOutline()
        vData.append(labelOutline.MinimumPoint.ToPoint())

        box = i.GetBoxOutline()
        vData.append(min.ToPoint())
        vData.append(max.ToPoint())

        # handle the viewport titles
        labelOffset = i.LabelOffset
        tForm = Transform.CreateTranslation(labelOffset)

        viewportData.append(vData)

# Assign your output to the OUT variable.
OUT = viewportData
# ----------------------------------------

# group: Weave and cache the data for Generative Design
remember_3 = Data.Remember(id)
remember_4 = Data.Remember(py_relocateviewtitle)
list_create = List.Create(item0=remember_3, item1=remember_4)
transpose = List.Transpose(lists=list_create)

# group: Randomize and reaccess the data
shuffle = List.Shuffle(list=transpose, seed=option)
transpose_2 = List.Transpose(lists=shuffle)
code_block = CodeBlock(list=transpose_2) { ids = list[0]; geos = list[1]; }

# group: Construct the real outer bounding box of viewports
byGeometry = BoundingBox.ByGeometry(geom=code_block.geos)
# note: Custom Node: spring nodesv.204.1.0
ꟿ_boundingbox_2drectangle_2 = Custom[ꟿ BoundingBox.2dRectangle](boundingBox=byGeometry)

# group: pack the viewports
# note: Custom Node: Rhythmv.2024.10.1
ʳʰʸᵗʰᵐ_generativedesign = Rhythm.GenerativeDesign.GenerativeDesign.PackViewports(container=byCornerPoints, viewportRectangles=ꟿ_boundingbox_2drectangle_2, viewportIds=code_block.ids)

# group: Relocate the rectangles for preview geometry
code_block_2 = CodeBlock(rectangles=ʳʰʸᵗʰᵐ_generativedesign.viewportRectangles) { rectangles; }
center = Polygon.Center(polygon=ʳʰʸᵗʰᵐ_generativedesign.viewportRectangles)
byOrigin = CoordinateSystem.ByOrigin(origin=center)
byOrigin_2 = CoordinateSystem.ByOrigin(origin=ʳʰʸᵗʰᵐ_generativedesign.proposedLocations)
transform = Geometry.Transform(geometry=code_block_2, fromCoordinateSystem=byOrigin, contextCoordinateSystem=byOrigin_2)

# group: Output
count = List.Count(list=transform)
amount_placed = Watch(count)  # graph output

# group: Relocate viewports that don't fit to the side of the titleblock.
setDifference = List.SetDifference(list1=code_block.ids, list2=ʳʰʸᵗʰᵐ_generativedesign.viewportsThatFit)
code_block_3 = CodeBlock(id=setDifference) { Revit.Elements.ElementSelector.ByElementId(id); }
minPoint_2 = BoundingBox.MinPoint(boundingBox=byCorners)
code_block_4 = CodeBlock(items=setDifference) { -500..-500 * List.Count(items); }
translate_2 = Geometry.Translate(geometry=minPoint_2, xTranslation=code_block_4)
gate = Data.Gate(false, translate_2)
setBoxCenter = Viewport.SetBoxCenter(viewport=code_block_3, point=gate)

# group: Locate the viewports when happy with the result
code_block_5 = CodeBlock(id=ʳʰʸᵗʰᵐ_generativedesign.viewportsThatFit) { Revit.Elements.ElementSelector.ByElementId(id); }
gate_2 = Data.Gate(false, ʳʰʸᵗʰᵐ_generativedesign.proposedLocations)
setBoxCenter_2 = Viewport.SetBoxCenter(viewport=code_block_5, point=gate_2)

list_create_2 = List.Create(item0=setBoxCenter, item1=setBoxCenter_2)
flatten_2 = List.Flatten(list=list_create_2)
py_setviewportnumber = Python(IN[0]=flatten_2, IN[1]=setBoxCenter, IN[2]=setBoxCenter_2)  # CPython3; frozen
# ---------- py_setviewportnumber.python (66 lines) ----------
# Load the Python Standard and DesignScript Libraries
import sys
import clr
import uuid
clr.AddReference('ProtoGeometry')
from Autodesk.DesignScript.Geometry import *

clr.AddReference('RevitAPI')
from Autodesk.Revit.DB import *

clr.AddReference('RevitNodes')
import Revit
clr.ImportExtensions(Revit.GeometryConversion)
clr.ImportExtensions(Revit.Elements)

clr.AddReference('RevitServices')
import RevitServices
from RevitServices.Persistence import DocumentManager
from RevitServices.Transactions import TransactionManager

doc = DocumentManager.Instance.CurrentDBDocument
uidoc=DocumentManager.Instance.CurrentUIApplication.ActiveUIDocument

def toList(x):
        if isinstance(x,list): return UnwrapElement(x)
        else : return [UnwrapElement(x)]

allViewports = UnwrapElement(IN[0])
viewportsOffSheet = UnwrapElement(IN[1])
viewportsOnSheet = UnwrapElement(IN[2])

offsheetViewports = []
onsheetViewports = []

#randomize the numbering
TransactionManager.Instance.EnsureInTransaction(doc)

for i in allViewports:
        detailNumberParameter = i.get_Parameter(BuiltInParameter.VIEWPORT_DETAIL_NUMBER)
        detailNumberParameter.Set(str(uuid.uuid4()))
doc.Regenerate()
TransactionManager.Instance.TransactionTaskDone()

#number the offsheet ones
offsheet = 1
TransactionManager.Instance.EnsureInTransaction(doc)
for i in viewportsOffSheet:
        detailNumberParameter = i.get_Parameter(BuiltInParameter.VIEWPORT_DETAIL_NUMBER)
        detailNumberParameter.Set("x-"+ str(offsheet))
        offsheet = offsheet + 1
        offsheetViewports.append(i)
doc.Regenerate()
TransactionManager.Instance.TransactionTaskDone()

#number the on sheet ones
onsheet = 1
TransactionManager.Instance.EnsureInTransaction(doc)
for i in viewportsOnSheet:
        detailNumberParameter = i.get_Parameter(BuiltInParameter.VIEWPORT_DETAIL_NUMBER)
        detailNumberParameter.Set(str(onsheet))
        onsheetViewports.append(i)
        onsheet = onsheet + 1
TransactionManager.Instance.TransactionTaskDone()

# Assign your output to the OUT variable.
OUT = offsheetViewports,onsheetViewports
# ----------------------------------------

# group: Build a view name lookup dictionary
string_from_object = FromObject(object=id)
code_block_6 = CodeBlock { "View Name"; }
getParameterValueByName = Element.GetParameterValueByName(element=viewports, parameterName=code_block_6)
byKeysValues = DesignScript.Builtin.Dictionary.ByKeysValues(keys=string_from_object, values=getParameterValueByName)
remember_5 = Data.Remember(byKeysValues)

# group: Retrieve the view titles
string_from_object_2 = FromObject(object=ʳʰʸᵗʰᵐ_generativedesign.viewportsThatFit)
valueAtKey = DesignScript.Builtin.Dictionary.ValueAtKey(dictionary=remember_5, key=string_from_object_2)
byPointAndString = Analysis.Label.ByPointAndString(point=ʳʰʸᵗʰᵐ_generativedesign.proposedLocations, label=valueAtKey)

# group: Outputs
setDifference_2 = List.SetDifference(list1=code_block.ids, list2=ʳʰʸᵗʰᵐ_generativedesign.viewportsThatFit)
code_block_7 = CodeBlock(id=setDifference_2) { Revit.Elements.ElementSelector.ByElementId(id); }
code_block_8 = CodeBlock { 1000; }
byCoordinates = Point.ByCoordinates(x=code_block_8, y=code_block_8)
gate_3 = Data.Gate(false, byCoordinates)
setBoxCenter_3 = Viewport.SetBoxCenter(viewport=code_block_7, point=gate_3)
