# Dynamo custom node ClosedCurve.Offset+.dyf "ꟿ ClosedCurve.Offset+" (Dynamo 2.0.2.6826)
# category: Springs.Geometry.Actions
# Offsets a curve both ways and correctly differenciates the external and internal offset. If an offset goes beyond the curve's bounds, the result will fail and a null value will be appended instead. Also works for convex curves like arcs.

curve = Input(curve: var)
distance = Input(distance: double)
code_block = CodeBlock(c=curve, dist=distance)
# ---------- code_block.designscript (31 lines) ----------
c;
dist;
off1 = [Imperative]{
	c1_fail = false;
	c2_fail = false;
	rev = 0;
	c1 = c.Offset(dist);
	c2 = c.Offset(-dist);
	if (c1 == null){
		c1 = c;
		c1_fail = true;
	}
	if (c2 == null){
		c2 = c;
		c2_fail = true;
	}
	out1 = [c1,c2];
	if (c1.Length > c2.Length){
		out1 = [c2,c1];
		rev = 1;
	}
	if (c1_fail){
	out1[0-rev] = null;
	}
	if (c2_fail){
	out1[1-rev] = null;
	}
	return = out1;
};
off1[0];
off1[1];
# ----------------------------------------
internal_offset = Output(code_block.out3)
external_offset = Output(code_block.out4)
