# Dynamo custom node Collect.LinkedInstanceElements.dyf "ꟿ Collect.LinkedInstanceElements" (Dynamo 2.0.3.8810)
# category: Springs.Revit.Selection.Actions
# Extract elements by category from the selected linked instances. The transform CS can be used to get the exact location of the elements in the host file. If an error occurs or the linked document is unloaded, an error will be returned in the elements output and the appropriate transform will be a null. You can use those nulls to filter out the errors.

linkInstance = Input(linkInstance: var[])
CategoryOrType = Input(CategoryOrType: var[])
refresh = Input(refresh: bool = true)
python_script = Python(IN[0]=linkInstance, IN[1]=CategoryOrType, IN[2]=refresh)
# ---------- python_script.python (71 lines) ----------
# Copyright(c) 2019, Dimitar Venkov
# @5devene, dimitar.ven@gmail.com
# www.badmonkeys.net

import clr

clr.AddReference("RevitNodes")
import Revit
clr.ImportExtensions(Revit.Elements)
clr.ImportExtensions(Revit.GeometryConversion)

clr.AddReference('RevitServices')
from RevitServices.Persistence import DocumentManager
doc = DocumentManager.Instance.CurrentDBDocument

clr.AddReference("RevitAPI")
from Autodesk.Revit.DB import FilteredElementCollector, RevitLinkType, ElementMulticategoryFilter, ElementId
import Autodesk.Revit.DB as DB

from System.Collections.Generic import List
import System

def tolist(obj1):
	if hasattr(obj1,"__iter__"): return obj1
	else: return [obj1]

links = UnwrapElement(tolist(IN[0]) )
cats = UnwrapElement(tolist(IN[1]) )
elements, transforms = [], []
OUT = elements, transforms

ueWrapper = None
wrappers = clr.GetClrType(Revit.Elements.ElementWrapper).GetMethods()
for w in wrappers:
	if w.ToString().startswith("Revit.Elements.UnknownElement"):
		ueWrapper = w
		break

for link in links:
	try:
		if RevitLinkType.IsLoaded(doc, link.GetTypeId() ):
			linkDoc = link.GetLinkDocument()
			
			if isinstance(cats[0], DB.Category):
				catId = List[DB.ElementId](c.Id for c in cats)
				filter = DB.ElementMulticategoryFilter(catId)
			elif isinstance(cats[0], DB.ElementType):
				types = List[System.Type](t.GetType() for t in cats)
				filter = DB.ElementMulticlassFilter(types)
			else:
				types = List[System.Type](cats)
				filter = DB.ElementMulticlassFilter(types)
			
			fec = FilteredElementCollector(linkDoc).WhereElementIsNotElementType().WherePasses(filter)
			linkEls = []
			for e in fec:
				try:
					linkEls.append(e.ToDSType(True) )
				except:
					if ueWrapper:
						linkEls.append(ueWrapper.Invoke(None, (e, True) ) )
			elements.append(linkEls)
			transforms.append(link.GetTotalTransform().ToCoordinateSystem(1) )
			fec.Dispose()
			filter.Dispose()
		else:
			elements.append('Linked document is unloaded')
			transforms.append(None)
	except Exception, ex:
		elements.append(str(ex) )
		transforms.append(None)
# ----------------------------------------
code_block = CodeBlock(res=python_script) { res[0]; res[1]; }
elements = Output(code_block.out0)
transform = Output(code_block.out1)
