# Dynamo custom node Document.CentralPath.dyf "ꟿ Document.CentralPath" (Dynamo 2.0.2.6826)
# category: Springs.Revit.Query
# If the document is workshared, the node returns the path to the central document as a string. Otherwise a null value will be returned.

refresh = Input(refresh: bool = true)
centralPath = Python(IN[0]=refresh)  # "Doc.CentralPath"
# ---------- centralPath.python (13 lines) ----------
import clr

clr.AddReference('RevitServices')
from RevitServices.Persistence import DocumentManager
doc = DocumentManager.Instance.CurrentDBDocument

clr.AddReference('RevitAPI')
from Autodesk.Revit.DB import *

OUT = None
if doc.IsWorkshared:
	cp = doc.GetWorksharingCentralModelPath()
	OUT = ModelPathUtils.ConvertModelPathToUserVisiblePath(cp)
# ----------------------------------------
path = Output(centralPath)
