# Dynamo custom node FamilyTemplatePaths.dyf "ꟿ FamilyTemplatePaths.CommonPaths" (Dynamo 2.10.1.3976)
# category: Springs.Revit.Utility.Query
# Fetches the default family template paths

familyTemplatePath = Python()  # IronPython2; graph input
# ---------- familyTemplatePath.python (10 lines) ----------
import clr

clr.AddReference('RevitServices')
from RevitServices.Persistence import DocumentManager

app = DocumentManager.Instance.CurrentUIApplication.Application
ver = int(app.VersionNumber)
OUT = app.FamilyTemplatePath
if ver > 2020:
	OUT += r"\English"
# ----------------------------------------
FamilyTemplateFolder = Output(familyTemplatePath)
fromPath = DirectoryObject(path=familyTemplatePath)  # "Directory.FromPath"
getDirectoryContents = FileSystem.GetDirectoryContents(directory=fromPath)
fileName = FileSystem.FileName(path=getDirectoryContents.files)
string = StringInput("Generic Model.rft")  # graph input
contains = String.Contains(str=fileName, searchFor=string)
filterByBoolMask = List.FilterByBoolMask(list=getDirectoryContents.files, mask=contains)
firstItem = List.FirstItem(list=filterByBoolMask.in)
GenericModelTemplate = Output(firstItem)
fileName_2 = FileSystem.FileName(path=getDirectoryContents.directories)
string_2 = StringInput("Conceptual Mass")  # graph input
contains_2 = String.Contains(str=fileName_2, searchFor=string_2)
filterByBoolMask_2 = List.FilterByBoolMask(list=getDirectoryContents.directories, mask=contains_2)
firstItem_2 = List.FirstItem(list=filterByBoolMask_2.in)
fromPath_2 = DirectoryObject(path=firstItem_2)  # "Directory.FromPath"
getDirectoryContents_2 = FileSystem.GetDirectoryContents(directory=fromPath_2)
firstItem_3 = List.FirstItem(list=getDirectoryContents_2.files)
MassFamilyTemplate = Output(firstItem_3)
