# Dynamo custom node Geometry.DifferentiateDisplay.dyf "ꟿ Geometry.DifferentiateDisplay" (Dynamo 2.3.0.5885)
# category: Springs.GeometryColor.Create
# Paints the input geometry using the default color range. Also works well with lists of geometry.

randomCol = Input(randomCol: bool = false)
geo = Input(geo: var[]..[])
code_block = CodeBlock(rand=randomCol, geo=geo)
# ---------- code_block.designscript (22 lines) ----------
def col1(x){
r = Math.Random(0, 128);
g = Math.Random(0, 128);
b = Math.Random(0, 128);
return = DSCore.Color.ByARGB(255, 127+r, 127+g, 127+b);
};

rand;
col = [Imperative]{
if (rand)
{
	return = col1(GetKeys(geo));
}
else
{
	dcr = ColorRange1D.Default();
	return = ColorRange1D.GetColorAtParameter
	  (dcr, 0..1..#(Count(geo)));
}
}

Display.ByGeometryColor(geo, col);
# ----------------------------------------
displayGeo = Output(code_block.out2)
