# Dynamo custom node Geometry.GroupByDistance.dyf "ꟿ Geometry.GroupByDistance" (Dynamo 2.0.2.6826)
# category: Springs.Geometry.Actions
# Splits the list of geometry elements into groups if the distance between them is less than the provided margin.

geometry = Input(geometry: var[])
margin = Input(margin: double = 1)
python_script = Python(IN[0]=geometry, IN[1]=margin)
# ---------- python_script.python (26 lines) ----------
#Copyright(c) 2016, Dimitar Venkov
# @5devene, dimitar.ven@gmail.com
#Inspired from the "Group Curves" node by Konrad Sobon
# @arch_laboratory, http://archi-lab.net

import clr
clr.AddReference('ProtoGeometry')
from Autodesk.DesignScript.Geometry import Geometry

pts = IN[0]
margin = IN[1]
dist1 = Geometry.DistanceTo

Groups, Queue = [], []
while pts:
	group = []
	Queue.append(pts.pop() )
	while Queue:
		p1 = Queue.pop()
		group.append(p1)
		for i in xrange(len(pts)-1,-1,-1):
			if dist1(p1, pts[i]) <= margin:
				Queue.append(pts.pop(i) )
	Groups.append(group)

OUT = Groups
# ----------------------------------------
geometry_2 = Output(python_script)  # "geometry[][]"
