# Dynamo custom node Geometry.ReadTag.dyf "ꟿ Geometry.ReadTag" (Dynamo 2.0.2.6826)
# category: Springs.Geometry.Actions
# Design script geometry can store a <string, object> dictionary for the duration of the active graph. If no parameter with the active name is found, a null value will be returned instead.

geometry = Input(geometry: var)
tagName = Input(tagName: string)
python_script = Python(IN[0]=geometry, IN[1]=tagName)
# ---------- python_script.python (1 lines) ----------
OUT = IN[0].Tags.LookupTag(IN[1])
# ----------------------------------------
value = Output(python_script)
