# Dynamo custom node Line.StraightenXY.dyf "ꟿ Line.StraightenXY" (Dynamo 2.0.2.6826)
# category: Springs.Geometry.Actions
# Checks a line's end points for irregularities and corrects them if they are at or below the specified margin. The default margin is 1/5000 of the curve length, which is conservative.

line = Input(line: var)
margin = Input(margin: double = 5000)
code_block = CodeBlock(c=line, x=margin)
# ---------- code_block.designscript (20 lines) ----------
c;
x;
straightened = [Imperative]{
margin = c.Length / x;
cS = c.StartPoint;
cE = c.EndPoint;
dX = Math.Abs(cS.X - cE.X);
dY = Math.Abs(cS.Y - cE.Y);
if (dX <= margin){
	return = Line.ByStartPointEndPoint(
	cS,Point.ByCoordinates(cS.X, cE.Y, cE.Z));
}
elseif (dY <= margin){
	return = Line.ByStartPointEndPoint(
	cS,Point.ByCoordinates(cE.X, cS.Y, cE.Z));
}
else{
	return = c;
}
};
# ----------------------------------------
line_2 = Output(code_block.out2)  # "line"
