# Dynamo custom node List.NullAllIndicesOf.dyf "ꟿ List.NullAllIndicesOf" (Dynamo 2.0.2.6826)
# category: Springs.Actions
# list all of the indices of a list that match the specified value. Capable of handling null values, part of the SmartCopyMonitor workflow.

list = Input(list: var[])
value = Input(value: var)
code_block = CodeBlock(l1=list, val=value)
# ---------- code_block.designscript (15 lines) ----------
l1;
val;
indices = [Imperative]{
out1 = [];
j = 0;
for(i in GetKeys(l1))
{
	if(l1[i] == val)
	{
		out1[j] = i;
		j = j + 1;
	}
}
return = out1;
};
# ----------------------------------------
indices = Output(code_block.out2)
