# Dynamo custom node PolyCurve.Points.dyf "ꟿ PolyCurve.Points" (Dynamo 2.0.2.6826)
# category: Springs.Geometry.Query
# Gets all the unique start and end points of the underlying curves in a sorted list.

polyCurve = Input(polyCurve: var)
code_block = CodeBlock(pc=polyCurve)
# ---------- code_block.designscript (11 lines) ----------
pc;
c = pc.Curves();
sp = c.StartPoint;
pts = [Imperative]{
if (!pc.IsClosed)
{
return = List.AddItemToEnd(
  c[-1].EndPoint, sp);
}
return = sp;
};
# ----------------------------------------
points = Output(code_block.out3)
