# Dynamo custom node Quads.ByPointMatrix.dyf "ꟿ Quads.ByPointMatrix" (Dynamo 2.0.3.8810)
# category: Springs.Geometry.Actions
# Creates a CCW or CW list of quad pairs from a rectangular nested list of points.

points = Input(points: var[][])
CCW = Input(CCW: bool = true)
python_script = Python(IN[0]=points, IN[1]=CCW)
# ---------- python_script.python (15 lines) ----------
pts, ccw = IN
OUT = []

for i in xrange(len(pts) - 1):
	for j in xrange(len(pts[0]) - 1):
		if ccw:
			OUT.append([pts[i][j],
						pts[i][j+1],
						pts[i+1][j+1],
						pts[i+1][j]])
		else:
			OUT.append([pts[i][j],
						pts[i+1][j],
						pts[i+1][j+1],
						pts[i][j+1]])
# ----------------------------------------
quads = Output(python_script)
