# Dynamo custom node TkMesh.Flatten.dyf "ꟿ TkMesh.Flatten" (Dynamo 2.0.3.8810)
# category: Springs.Geometry.Actions
# Sets the Z coordinate of each vertex of the mesh to the desired value.

tkMesh = Input(tkMesh: var[])
newZ = Input(newZ: double = 0)
python_script = Python(IN[0]=tkMesh, IN[1]=newZ)
# ---------- python_script.python (15 lines) ----------
# Copyright(c) 2020, Dimitar Venkov
# @5devene, dimitar.ven@gmail.com
# www.badmonkeys.net

import clr
clr.AddReference('ProtoGeometry')
import Autodesk.DesignScript.Geometry as DS

meshes, Z = IN

OUT = []
for m in meshes:
	vertices = [DS.Point.ByCoordinates(p.X, p.Y, Z) for p in m.Vertices()]
	indices = m.VertexIndicesByTri()
	OUT.append(m.ByVerticesAndIndices(vertices, indices))
# ----------------------------------------
mesh = Output(python_script)
