# Dynamo custom node Utility.SetData.dyf "ꟿ Utility.SetData" (Dynamo 2.0.2.6826)
# category: Springs.Actions
# Using the application's app domain, this node will store a reference to the input data under the specified name. use the `Utility.GetData` node to retrieve the data somewhere else.
# Try not to store large ammounts of data, because you risk creating a memory leak that will persist till you close down the aplication.

key = Input(key: string)
data = Input(data: var[]..[])
python_script = Python(IN[0]=key, IN[1]=data)
# ---------- python_script.python (4 lines) ----------
import System

dataKey, data = IN
System.AppDomain.CurrentDomain.SetData("_Dyn_Wireless_%s" % dataKey, data)
# ----------------------------------------
