# Dynamo graph Building Generator - Imperial.dyn (Dynamo 3.0.0.7040)
# packages: Refinery Toolkit 3.0.0

# group: Input
building_type = IntegerSlider(2, range=0..8 step 1)
length = DoubleSlider(53, range=1..100 step 1)
width = DoubleSlider(62, range=1..100 step 1)
depth = DoubleSlider(15, range=1..50 step 1)
total_floor_area = DoubleSlider(18400, range=0..50000 step 100)
floor_height = DoubleSlider(9, range=1..20 step 0.1)
curved = BoolSelector(false)
cores = BoolSelector(true)
hallway_to_depth_ratio = DoubleSlider(0.2, range=0..1 step 0.1)
core_size_floors = DoubleSlider(5, range=0..20 step 1)
core_size_floor_area = DoubleSlider(0.1, range=0..1 step 0.1)
code_block = CodeBlock()
# ---------- code_block.designscript (6 lines) ----------
[
	Point.ByCoordinates(80, 0),
	Point.ByCoordinates(0, 80),
	Point.ByCoordinates(-80, 0),
	Point.ByCoordinates(0, -50)
];
# ----------------------------------------
boolean = BoolSelector(true)
setback = DoubleSlider(10, range=0..50 step 1)
max_height = DoubleSlider(100, range=0..500 step 10)
code_block_2 = CodeBlock { [30, 15]; [40, 10]; }
byOriginRadii = Ellipse.ByOriginRadii(xAxisRadius=code_block_2.out0, yAxisRadius=code_block_2.out1)
floors = DoubleSlider(12, range=1..100 step 1)
floor_height_2 = DoubleSlider(9, range=1..20 step 0.1)

selectBuildingType = Autodesk.RefineryToolkits.MassingSandbox.Generate.Building.SelectBuildingType(shapeIndex=building_type)
byTypeArea = Autodesk.RefineryToolkits.MassingSandbox.Generate.Building.ByTypeArea(typeStr=selectBuildingType, length=length, width=width, depth=depth, buildingArea=total_floor_area, floorHeight=floor_height, curvedBool=curved, createCoreBool=cores, hallwayToDepth=hallway_to_depth_ratio, coreSizeFactorFloors=core_size_floors, coreSizeFactorArea=core_size_floor_area)
byPoints = PolyCurve.ByPoints(points=code_block, connectLastToFirst=boolean)

# group: Site
volumeByOutlineSetback = Autodesk.RefineryToolkits.MassingSandbox.Generate.Site.VolumeByOutlineSetback(siteOutline=byPoints, setback=setback, heightLimit=max_height)
clashTest = Autodesk.RefineryToolkits.MassingSandbox.Analyze.SiteAnalysis.ClashTest(buildingSolid=byTypeArea.buildingSolid, siteSolid=volumeByOutlineSetback.siteSolid)
watch = Watch(clashTest.intersects)

angle_threshold = DoubleSlider(45, range=0..90 step 1)
deconstructFacadeShell = Autodesk.RefineryToolkits.MassingSandbox.Generate.Building.DeconstructFacadeShell(solid=byTypeArea.buildingSolid, angleThreshold=angle_threshold)
bySolid = PolySurface.BySolid(solid=byTypeArea.buildingSolid)
contextByElement = Autodesk.RefineryToolkits.MassingSandbox.Generate.Site.ContextByElement(polysurface=bySolid)

# group: Display
color_palette = ColorPalette({R: 255, G: 255, B: 255, A: 90})
byGeometryColor = Modifiers.GeometryColor.ByGeometryColor(geometry=deconstructFacadeShell.verticalSrfList, color=color_palette)
join = List.Join(list0=deconstructFacadeShell.horizontalSrfList, list1=byTypeArea.netFloorSrfList)
color_palette_2 = ColorPalette({R: 0, G: 255, B: 255, A: 143})
byGeometryColor_2 = Modifiers.GeometryColor.ByGeometryColor(geometry=join@L1, color=color_palette_2)
toCuboid = BoundingBox.ToCuboid(boundingBox=contextByElement.boundingBoxList)
edges = Topology.Edges(topology=toCuboid)
curveGeometry = Edge.CurveGeometry(edge=edges)
color_palette_3 = ColorPalette({R: 0, G: 0, B: 0, A: 133})
byGeometryColor_3 = Modifiers.GeometryColor.ByGeometryColor(geometry=curveGeometry, color=color_palette_3)
edges_2 = Topology.Edges(topology=clashTest.buildingOutside)
curveGeometry_2 = Edge.CurveGeometry(edge=edges_2)
color_palette_4 = ColorPalette({R: 255, G: 0, B: 0, A: 255})
byGeometryColor_4 = Modifiers.GeometryColor.ByGeometryColor(geometry=curveGeometry_2, color=color_palette_4)
edges_3 = Topology.Edges(topology=volumeByOutlineSetback.siteSolid)
curveGeometry_3 = Edge.CurveGeometry(edge=edges_3)
color_palette_5 = ColorPalette({R: 0, G: 0, B: 255, A: 31})
byGeometryColor_5 = Modifiers.GeometryColor.ByGeometryColor(geometry=curveGeometry_3, color=color_palette_5)
color_palette_6 = ColorPalette({R: 255, G: 0, B: 255, A: 255})
byGeometryColor_6 = Modifiers.GeometryColor.ByGeometryColor(geometry=byTypeArea.coreSolidList, color=color_palette_6)

# group: Revit
categories = Categories("OST_Mass")
byGeometry = DirectShape.ByGeometry(geometry=byTypeArea.buildingSolid, category=categories)  # frozen
floor_types = FloorTypes("LW Concrete on Metal Deck")
createRevitFloors = Autodesk.RefineryToolkits.MassingRevit.Integrate.Revit.CreateRevitFloors(srfList=byTypeArea.netFloorSrfList, floorType=floor_types)  # frozen

byOutlineFloors = Autodesk.RefineryToolkits.MassingSandbox.Generate.Building.ByOutlineFloors(edgeLoopCrvList=byOriginRadii, floorCount=floors, floorHeight=floor_height_2)
