# Dynamo graph View Distance.dyn (Dynamo 3.0.0.7040)
# packages: Refinery Toolkit 3.0.0

# group: Input
building_size = IntegerSlider(32, range=0..100 step 1)
building_size_2 = IntegerSlider(50, range=0..100 step 1)
building_size_3 = IntegerSlider(74, range=0..100 step 1)
context_radius = IntegerSlider(140, range=0..1000 step 1)
context_count = IntegerSlider(26, range=0..100 step 1)
building_size_4 = IntegerSlider(50, range=0..100 step 1)
building_variation = IntegerSlider(15, range=0..30 step 1)
proximity = IntegerSlider(28, range=0..50 step 1)
resolution = IntegerSlider(6, range=1..20 step 1)

# group: Test Building
byLengths = Cuboid.ByLengths(width=building_size, length=building_size_2, height=building_size_3)
code_block = CodeBlock { 2; }
div = building_size_3 / code_block
translate = Geometry.Translate(geometry=byLengths, zTranslation=div)
deconstructFacadeShell = Autodesk.RefineryToolkits.MassingSandbox.Generate.Building.DeconstructFacadeShell(solid=translate)
identity = Object.Identity(object=deconstructFacadeShell.horizontalSrfList)

# group: Context
randomList = Math.RandomList(amount=context_count)
sub = building_size_4 - building_variation
code_block_2 = CodeBlock { 2; }
div_2 = sub / code_block_2
add = building_size_4 + building_variation
div_3 = add / code_block_2
remapRange = Math.RemapRange(numbers=randomList, newMin=div_2, newMax=div_3)
randomList_2 = Math.RandomList(amount=context_count)
remapRange_2 = Math.RemapRange(numbers=randomList_2, newMin=div_2, newMax=div_3)
randomList_3 = Math.RandomList(amount=context_count)
remapRange_3 = Math.RemapRange(numbers=randomList_3, newMin=sub, newMax=add)
byLengths_2 = Cuboid.ByLengths(width=remapRange, length=remapRange_2, height=remapRange_3)
randomList_4 = Math.RandomList(amount=context_count)
code_block_3 = CodeBlock(x=context_radius) { -x; }
remapRange_4 = Math.RemapRange(numbers=randomList_4, newMin=code_block_3, newMax=context_radius)
randomList_5 = Math.RandomList(amount=context_count)
remapRange_5 = Math.RemapRange(numbers=randomList_5, newMin=code_block_3, newMax=context_radius)
byCoordinates = Vector.ByCoordinates(x=remapRange_4, y=remapRange_5)
code_block_4 = CodeBlock(v=byCoordinates, y=proximity) { Vector.Scale(v, (1 + Math.Abs(y/v.Length))); }
translate_2 = Geometry.Translate(geometry=byLengths_2, direction=code_block_4)
code_block_5 = CodeBlock { 2; }
div_4 = remapRange_3 / code_block_5
translate_3 = Geometry.Translate(geometry=translate_2, zTranslation=div_4)

viewDistance = Autodesk.RefineryToolkits.MassingSandbox.Analyze.SiteAnalysis.ViewDistance(surface=deconstructFacadeShell.verticalSrfList, contextGeomList=translate_3, resolution=resolution, maxDistance=context_radius)

# group: Custom Visualization
code_block_6 = CodeBlock { 0; 255; }
mapTo = Math.MapTo(rangeMin=code_block_6.out0, rangeMax=context_radius, inputValue=viewDistance.distanceList, targetRangeMin=code_block_6.out0, targetRangeMax=code_block_6.out1)
byARGB = Color.ByARGB(red=mapTo, green=mapTo, blue=mapTo)
bySurfaceColors = Modifiers.GeometryColor.BySurfaceColors(surface=deconstructFacadeShell.verticalSrfList, colors=byARGB)
