# Dynamo graph dt_GenerativeToolkit_OpenessTest(RVT).dyn (Dynamo 3.0.0.7040)
# packages: Refinery Toolkit 3.0.0

# group: Get Desk point
family_types = FamilyTypes("Desk:60\" x 30\"")
all_elements_of_family_type = ElementsOfFamilyType(Family_Type=family_types)
getLocation = Element.GetLocation(element=all_elements_of_family_type)

# group: Get object dimensions
elementType = Element.ElementType(element=all_elements_of_family_type)
code_block = CodeBlock { "Depth"; "Width"; }
getParameterValueByName = Element.GetParameterValueByName(element=elementType, parameterName=code_block.out1)
getParameterValueByName_2 = Element.GetParameterValueByName(element=elementType, parameterName=code_block.out0)

# group: Surface by object
byOrigin = CoordinateSystem.ByOrigin(origin=getLocation)
ZAxis = Vector.ZAxis()
getElementRotation = Custom[GetElementRotation](FamInstance=all_elements_of_family_type)
code_block_2 = CodeBlock(rotation=getElementRotation.Rotation) { -rotation; }
rotate = CoordinateSystem.Rotate(coordinateSystem=byOrigin, origin=getLocation, axis=ZAxis, degrees=code_block_2)
byWidthLength = Rectangle.ByWidthLength(coordinateSystem=rotate, width=getParameterValueByName, length=getParameterValueByName_2)

byPatch = Surface.ByPatch(closedCurve=byWidthLength)

# group: Obstacles- Column Polygons
categories = Categories("OST_Columns")
all_elements_of_category = ElementsOfCategory(Category=categories)
getLocation_2 = Element.GetLocation(element=all_elements_of_category)
byOrigin_2 = CoordinateSystem.ByOrigin(origin=getLocation_2)
elementType_2 = Element.ElementType(element=all_elements_of_category)
code_block_3 = CodeBlock { "Depth"; "Width"; }
getParameterValueByName_3 = Element.GetParameterValueByName(element=elementType_2, parameterName=code_block_3.out1)
getParameterValueByName_4 = Element.GetParameterValueByName(element=elementType_2, parameterName=code_block_3.out0)
byWidthLength_2 = Rectangle.ByWidthLength(coordinateSystem=byOrigin_2, width=getParameterValueByName_3, length=getParameterValueByName_4)

# group: Obstacles- Wall Polygons
categories_2 = Categories("OST_Walls")
all_elements_of_category_2 = ElementsOfCategory(Category=categories_2)
getLocation_3 = Element.GetLocation(element=all_elements_of_category_2)
elementType_3 = Element.ElementType(element=all_elements_of_category_2)
code_block_4 = CodeBlock { "Width"; }
getParameterValueByName_5 = Element.GetParameterValueByName(element=elementType_3, parameterName=code_block_4)
direction = Line.Direction(line=getLocation_3)
byThickeningCurveNormal = PolyCurve.ByThickeningCurveNormal(curve=getLocation_3, thickness=getParameterValueByName_5, normal=direction)
curves = PolyCurve.Curves(polyCurve=byThickeningCurveNormal)
startPoint = Curve.StartPoint(curve=curves)
byPoints = Polygon.ByPoints(points=startPoint)

join = List.Join(list0=byWidthLength_2, list1=byPoints)

# group: Refinery Toolkit - Openess From Point
fromSurface = Autodesk.RefineryToolkits.SpacePlanning.Analyze.Openess.FromSurface(surface=byPatch, obstructions=join)
watch = Watch(fromSurface)
