# Dynamo graph 02-03_OfficeLayout.dyn "03_Office-layout" (Dynamo 3.3.0.6316)
# author: Dynamo Team
# This graph will generate a series of desk layouts based on a floor plate and neighborhood boundaries.
# packages: Refinery Toolkit 3.0.2

# note: Checking / Outputs
# Orange indicates checking nodes to ensure the script has deployed correctly.
# note: Working / Functions
# Green indicates the working of the script. No changes should be made in these groups unless advised.
# note: Variables / Inputs
# Red indicates Variables that can be altered per project and must be set accordingly before running the script.

# group: OFFICE LAYOUT GENERATOR Graph Example
# note: ADDITIONAL COMMENTS
# 1) Select the floor geometry in your Revit file, on the 'Floor Plate' group
# 2) Select the boundary lines in the Revit model.
# 3) Open Generative Design (Manage > Generative Design...)
# 4) Create a New Study
# 5) Under generation method select Randomize
# 6) Under Inputs, uncheck and set a value for the inputs that will not change during run
# 7) Under settings, select the number of solutions wanted
# 8) Fix any possible problems in the issues section
# 9) Click generate and wait for the outputs
# note: ASSOCIATED FILE(S)
# 02-03_Office-layout.rvt
# note: AUTHOR(S) / CREATION DATE
# Last updated by Dynamo Team/ August 2024
# matterlab for Autodesk Refinery Team / April 2020
# note: DESCRIPTION
# This Graph can be used with Generative Design for Revit to generate desk layouts on a floor plan. You can use Generative Design to maximise the amount of desks placed while maintaining a larger area reserved for amenities.
# note: REQUIRED DYNAMO PACKAGES
# DynamoIronPython 2.7
# note: 02-03-Office-layout.dyn
# note: DYNAMO VERSION
# 3.2.1

# group: Dynamo Inputs
select_floor_plate = DSModelElementSelection()  # 1 picked in the model; graph input
select_neighbourhood_boundaries = DSModelElementMultipleSelection()  # 6 picked in the model; graph input

# group: Geometry [Revit/Dynamo]: Extract Floor Geometry
geometry = Element.Geometry(element=select_floor_plate)
explode = Geometry.Explode(geometry=geometry)
code_block = CodeBlock(geometry1=explode)
# ---------- code_block.designscript (4 lines) ----------
surfPoints = Surface.PointAtParameter(geometry1, 0.5, 0.5);
zVal = Point.Z(surfPoints);
maxZ = DSCore.List.MaximumItem(zVal);
mask = zVal == maxZ;
# ----------------------------------------
filterByBoolMask = List.FilterByBoolMask(list=explode, mask=code_block.mask)
flatten = List.Flatten(list=filterByBoolMask.in)

# group: Remember Floor
remember = Remember(flatten)
code_block_2 = CodeBlock(x=remember) { x[0]; }
code_block_3 = CodeBlock(floorSurface=code_block_2) { floorSurface; }
code_block_4 = CodeBlock(floorSurface=code_block_3) { floorSurface; }
perimeterCurves = Surface.PerimeterCurves(surface=code_block_2)
flatten_2 = List.Flatten(list=perimeterCurves)

# group: Geometry [Revit/Dynamo]: Extract Neighbourhood Boundary Points
geometry_2 = Element.Geometry(element=select_neighbourhood_boundaries)
flatten_3 = List.Flatten(list=geometry_2)

# group: Remember Neighbourhood
remember_2 = Remember(flatten_3)
startPoint = Curve.StartPoint(curve=remember_2)
endPoint = Curve.EndPoint(curve=remember_2)

# group: Refinery Inputs
IN_boundary1_stPt = DoubleSlider(0.5, range=0..1 step 0.1)  # graph input
IN_boundary2_stPt = DoubleSlider(0.9, range=0..1 step 0.1)  # graph input
IN_boundary3_stPt = DoubleSlider(0.7, range=0..1 step 0.1)  # graph input
# note: BOUNDARY LINES START POINT:
# These inputs are used by Generative Design to determine how much the neighbourhood boundaries can move. They should be a number between 0 and 1. For each boundary curve there should be an input here to match.
IN_boundary4_stPt = DoubleSlider(0.8, range=0..1 step 0.1)  # graph input
IN_boundary5_stPt = DoubleSlider(0.6, range=0..1 step 0.1)  # graph input
IN_boundary6_stPt = DoubleSlider(0.7, range=0..1 step 0.1)  # graph input
join = List.Join(list0=IN_boundary1_stPt, list1=IN_boundary2_stPt, list2=IN_boundary3_stPt, list3=IN_boundary4_stPt, list4=IN_boundary5_stPt, list5=IN_boundary6_stPt)
IN_boundary1_endPt = DoubleSlider(0, range=0..1 step 0.1)  # graph input
IN_boundary2_endPt = DoubleSlider(0.3, range=0..1 step 0.1)  # graph input
IN_boundary3_endPt = DoubleSlider(0, range=0..1 step 0.1)  # graph input
# note: BOUNDARY LINES END POINT:
# These inputs are used by Generative Design to determine how much the neighbourhood boundaries can move. They should be a number between 0 and 1. For each boundary curve there should be an input here to match.
IN_boundary4_endPt = DoubleSlider(0.3, range=0..1 step 0.1)  # graph input
IN_boundary5_endPt = DoubleSlider(0.3, range=0..1 step 0.1)  # graph input
IN_boundary6_endPt = DoubleSlider(0.2, range=0..1 step 0.1)  # graph input
join_2 = List.Join(list0=IN_boundary1_endPt, list1=IN_boundary2_endPt, list2=IN_boundary3_endPt, list3=IN_boundary4_endPt, list4=IN_boundary5_endPt, list5=IN_boundary6_endPt)

code_block_5 = CodeBlock(neigStartPoint=startPoint, neigEndPoint=endPoint, startPointsMove=join, endPointsMove=join_2) { neigStartPoint; neigEndPoint; startPointsMove; endPointsMove; }

# group: Geometry [Dynamo]: Find which Points sit on which Curves
count = List.Count(list=startPoint)
ofRepeatedItem = List.OfRepeatedItem(item=flatten_2, amount=count)
doesIntersect = Geometry.DoesIntersect(geometry=startPoint, other=flatten_2, lacing=CrossProduct)
filterByBoolMask_2 = List.FilterByBoolMask(list=ofRepeatedItem, mask=doesIntersect)
byJoinedCurves = PolyCurve.ByJoinedCurves(curves=filterByBoolMask_2.in)

# group: Goemetry [Dynamo]: Find which Points sit on which Curves
count_2 = List.Count(list=endPoint)
ofRepeatedItem_2 = List.OfRepeatedItem(item=flatten_2, amount=count_2)
doesIntersect_2 = Geometry.DoesIntersect(geometry=endPoint, other=flatten_2, lacing=CrossProduct)
filterByBoolMask_3 = List.FilterByBoolMask(list=ofRepeatedItem_2, mask=doesIntersect_2)
byJoinedCurves_2 = PolyCurve.ByJoinedCurves(curves=filterByBoolMask_3.in)

# group: Geometry [Dynamo]: Create New Neighbourhood Boundaries
code_block_6 = CodeBlock { 1000; }
python_script_point_move_along = Python(IN[0]=code_block_5.neigStartPoint, IN[1]=byJoinedCurves, IN[2]=code_block_6, IN[3]=code_block_5.startPointsMove)  # "Python Script - Point Move Along Curve"; CPython3
# ---------- python_script_point_move_along.python (39 lines) ----------
# Enable Python support and load DesignScript library
import clr
clr.AddReference('ProtoGeometry')
from Autodesk.DesignScript.Geometry import *
clr.AddReference('DSCoreNodes')
from DSCore import *

def PointMoveAlongCurve(pt,polyCrv,len,param):
	absLength = Math.Abs(length)
	ptParam = polyCrv.ParameterAtPoint(pt)
	dist = polyCrv.SegmentLengthAtParameter(ptParam)
	minusDist = dist - absLength
	maxDist = dist + absLength

	if(minusDist < 0):
		minusDist = 0

	if(maxDist > polyCrv.Length):
		maxDist = polyCrv.Length

	minusPt = polyCrv.PointAtSegmentLength(minusDist)
	maxPt = polyCrv.PointAtSegmentLength(maxDist)
	number = Math.MapTo(0, 1, param, minusDist, maxDist)
	newPoint = polyCrv.PointAtSegmentLength(number)
	return newPoint

# The inputs to this node will be stored as a list in the IN variables.
point = IN[0]
polycurve = IN[1]
length = IN[2]
parameter = IN[3]

points = []

for pt,pCrv,pa in zip(point,polycurve,parameter):
	points.append(PointMoveAlongCurve(pt,pCrv,length,pa))

# Assign your output to the OUT variable.
OUT = points
# ----------------------------------------
python_script_point_move_along_2 = Python(IN[0]=code_block_5.neigEndPoint, IN[1]=byJoinedCurves_2, IN[2]=code_block_6, IN[3]=code_block_5.endPointsMove)  # "Python Script - Point Move Along Curve"; CPython3; same code as python_script_point_move_along
byStartPointEndPoint = Line.ByStartPointEndPoint(startPoint=python_script_point_move_along, endPoint=python_script_point_move_along_2)

# group: Geometry [Dynamo]: Split Floor Surface into Multiple Surfaces
intersect = Geometry.Intersect(geometry=code_block_4, other=byStartPointEndPoint, lacing=Longest)
type = Object.Type(object=intersect)
code_block_7 = CodeBlock { "Autodesk.DesignScript.Geometry.Line"; }
eq = type == code_block_7
filterByBoolMask_4 = List.FilterByBoolMask(list=intersect, mask=eq)
flatten_4 = List.Flatten(list=filterByBoolMask_4.in)
code_block_8 = CodeBlock { 0.5; }
normalAtParameter = Surface.NormalAtParameter(surface=code_block_4, u=code_block_8, v=code_block_8)
code_block_9 = CodeBlock { 5000; }
extrude = Curve.Extrude(curve=flatten_4, direction=normalAtParameter, distance=code_block_9)
byJoinedSurfaces = PolySurface.ByJoinedSurfaces(surfaces=extrude)
split = Geometry.Split(geometry=code_block_4, other=byJoinedSurfaces)

# group: Logic: Generate Amenity Spaces
code_block_10 = CodeBlock { 1000; 3000; }

create = Autodesk.RefineryToolkits.SpacePlanning.Generate.AmenitySpace.Create(surface=split, offset=code_block_10.out0, depth=code_block_10.out1)

# group: Desk Input
select_desk = DSModelFamilyInstanceSelection()  # 1 picked in the model; graph input
geometry_3 = Element.Geometry(element=select_desk)
byGeometry = BoundingBox.ByGeometry(geom=geometry_3)
maxPoint = BoundingBox.MaxPoint(boundingBox=byGeometry)
minPoint = BoundingBox.MinPoint(boundingBox=byGeometry)
code_block_11 = CodeBlock(maxValue=maxPoint, minValue=minPoint) { Math.Abs(maxValue.X - minValue.X); Math.Abs(maxValue.Y - minValue.Y); }
back_to_back_tolerance = DoubleSlider(2200, range=0..14000 step 1)

# note: Width
remember_3 = Remember(code_block_11.out0)
name = Element.Name(element=select_desk)

# group: Remember Desk
# note: Height
remember_4 = Remember(code_block_11.out1)
# note: Desk Name
remember_5 = Remember(name)
code_block_12 = CodeBlock(backToBack=back_to_back_tolerance) { backToBack; }

code_block_13 = CodeBlock(deskWidth=remember_3, deskHeight=remember_4, deskName=remember_5, backToBackTolerance=code_block_12) { deskWidth; deskHeight; deskName; backToBackTolerance; }
create_2 = Autodesk.RefineryToolkits.SpacePlanning.Generate.DeskLayout.Create(surface=create.remainingSurface, deskWidth=code_block_13.deskWidth, deskDepth=code_block_13.deskHeight, backToBack=code_block_13.backToBackTolerance)

# group: Math: Calculate Number of Desks
flatten_5 = List.Flatten(list=create_2)
count_3 = List.Count(list=flatten_5)
width = Rectangle.Width(rectangle=flatten_5)

# group: Math: Calculate Areas
area = Surface.Area(surface=create.amenitySurface)
code_block_14 = CodeBlock(x=area) { Math.Sum(x); }
convert_by_units = DynamoUnitConvert(code_block_14, MeasurementType="autodesk.unit.quantity:area-1.0.2", FromConversion="autodesk.unit.unit:squareMillimeters-1.0.1", ToConversion="autodesk.unit.unit:squareMeters-1.0.1")
code_block_15 = CodeBlock(x=convert_by_units) { Math.Round(x,2); }

# group: Outputs
# note: NOTE:
# In order to see an "Output" in Generative Design, you have to right-click on a compatible node and check the "is Output" option. Rename the node to see a legible output name in Generative Design.
number_of_desks = Watch(count_3)  # graph output
total_amenity_space_area_m² = Watch(code_block_15)  # graph output

# group (continued): Logic: Generate Amenity Spaces
code_block_16 = CodeBlock(amenitySurfaces=create.amenitySurface) { amenitySurfaces; }
perimeterCurves_2 = Surface.PerimeterCurves(surface=create.amenitySurface)
code_block_17 = CodeBlock(ammenities=perimeterCurves_2) { ammenities; }

# group: Logic: Generate new Desk Layout
code_block_18 = CodeBlock(deskWidth=code_block_13.deskWidth) { deskWidth; }

# group: Geometry:Rotate Desks
code_block_19 = CodeBlock(rotatedWidth=width, deskWidth=code_block_18) { rotatedWidth==deskWidth; }
filterByBoolMask_5 = List.FilterByBoolMask(list=flatten_5, mask=code_block_19)
code_block_20 = CodeBlock(notRotated=filterByBoolMask_5.in, rotatedDesk=filterByBoolMask_5.out) { notRotated; rotatedDesk; }
code_block_21 = CodeBlock(notRot=code_block_20.notRotated, rot=code_block_20.rotatedDesk) { Rectangle.Center(notRot); Rectangle.Center(rot); }

# group: Data gate for revit creation of elements
code_block_22 = CodeBlock(familyName=code_block_13.deskName, pointsNotRot=code_block_21.out0, pointsRot=code_block_21.out1, ammenities=code_block_17)
# ---------- code_block_22.designscript (4 lines) ----------
[familyName,
pointsNotRot,
pointsRot,
ammenities];
# ----------------------------------------
gate = Gate(false, code_block_22)
code_block_23 = CodeBlock(a=gate) { a[0]; a[1]; a[2]; a[3]; }
byName = FamilyType.ByName(name=code_block_23.out0)

# group: Create Revit Families
byPoint = FamilyInstance.ByPoint(familyType=byName, point=code_block_23.out2)
code_block_24 = CodeBlock { 90; }
# note: Create revit families at the selected grid position.
setRotation = FamilyInstance.SetRotation(familyInstance=byPoint, degree=code_block_24)
byPoint_2 = FamilyInstance.ByPoint(familyType=byName, point=code_block_23.out1)
byCurve = ModelCurve.ByCurve(curve=code_block_23.out3)
