# Dynamo custom node BoundingBox.Scale.dyf "ꟿ BoundingBox.Scale" (Dynamo 2.0.2.6826)
# category: Springs.Geometry.Actions
# Scales the bounding box in three dimensions according to it's center.

boundingBox = Input(boundingBox: Autodesk.DesignScript.Geometry.BoundingBox)
xAmmount = Input(xAmmount: double = 1)
yAmmount = Input(yAmmount: double = 1)
zAmmount = Input(zAmmount: double = 1)
code_block = CodeBlock(bb1=boundingBox, xA=xAmmount, yA=yAmmount, zA=zAmmount)
# ---------- code_block.designscript (11 lines) ----------
a = bb1.MinPoint;
b = bb1.MaxPoint;
mid = Point.ByCoordinates(
  (a.X + b.X) / 2,
  (a.Y + b.Y) / 2,
  (a.Z + b.Z) / 2);
pl1 = Plane.ByOriginNormal(
  mid, Vector.ZAxis() );
a1 = a.Scale(pl1, xA, yA, zA);
b1 = b.Scale(pl1, xA, yA, zA);
bb2 = BoundingBox.ByCorners(a1, b1);
# ----------------------------------------
boundingBox_2 = Output(code_block.bb2)  # "boundingBox"
