# Dynamo custom node Delaunay2D.ByPoints.dyf "ꟿ Delaunay2D.ByPoints" (Dynamo 2.0.2.6826)
# category: Springs.Geometry.Create
# Create a delaunay triangulation of a set of planar points. You can get the result as points or as lines.

points = Input(points: var[])
asPoints = Input(asPoints: bool = false)
code_block = CodeBlock(pts0=points, asPts=asPoints)
# ---------- code_block.designscript (7 lines) ----------
p0 = Point.ByCoordinates(12345.6789,12345.6789,12345.6789);
pts1 = DSCore.List.AddItemToEnd(p0, pts0);
c1 = DSCore.List.Chop(Delaunay.ByPoints(pts1), 3);
p1 = c1.StartPoint;
m1 = AllFalse(p0.IsAlmostEqualTo(p1)<1>);
r1 = asPts ? p1 : c1;
res = DSCore.List.FilterByBoolMask(r1, m1)["in"];
# ----------------------------------------
pts_lines = Output(code_block.res)  # "pts/lines"
