# Dynamo custom node Geometry.BoxedDistanceTo.dyf "ꟿ Geometry.BoxedDistanceTo" (Dynamo 2.0.2.6826)
# category: Springs.Geometry.Query
# Computes the minimal distance between the axis-aligned bounding boxes of two geometry elements. Works directly with a bounding box input.

geometry = Input(geometry: var)
other = Input(other: var)
# note: https://www.gamedev.net/forums/topic/568111-any-quick-way-to-calculate-min-distance-between-2-bounding-boxes/?do=findComment&comment=4633797
code_block = CodeBlock(g1=geometry, g2=other)
# ---------- code_block.designscript (31 lines) ----------
s1 = DSCore.Object.Type(g1);
t1 = String.Contains(s1, "BoundingBox");
a = t1 ? g1 : BoundingBox.ByGeometry(g1);
s2 = DSCore.Object.Type(g2);
t2 = String.Contains(s2, "BoundingBox");
b = t2 ? g2 : BoundingBox.ByGeometry(g2);
am = a.MinPoint;
aM = a.MaxPoint;
bm = b.MinPoint;
bM = b.MaxPoint;
amin = [am.X, am.Y, am.Z];
amax = [aM.X, aM.Y, aM.Z];
bmin = [bm.X, bm.Y, bm.Z];
bmax = [bM.X, bM.Y, bM.Z];
dist = [Imperative]{
sqDist = 0;
for (i in GetKeys(amin) )
{
	if (bmax[i] < amin[i])
	{
		d = bmax[i] - amin[i];
		sqDist = sqDist + d * d;
	}
	elseif (bmin[i] > amax[i])
	{
		d = bmin[i] - amax[i];
		sqDist = sqDist + d * d;
	}
}
return = Math.Sqrt(sqDist);
};
# ----------------------------------------
distance = Output(code_block.out14)
