# Dynamo custom node Geometry.SplitRecursively.dyf "ꟿ Geometry.SplitRecursively" (Dynamo 2.0.2.6826)
# category: Springs.Geometry.Actions
# Splits a surface or a solid recursively, using the resulting reduced geometry for every consecutive split. Select a point or another geometry to control the direction of the split.

geometry = Input(geometry: var)
tools = Input(tools: var[])
pickPoint = Input(pickPoint: var)
code_block = CodeBlock(face=geometry, planes=tools, dir1=pickPoint)
# ---------- code_block.designscript (23 lines) ----------
face;
planes;
dir1;
geom = [Imperative]{
outp = [];
i = 0;
for (p in planes){
	s1 = face.Split(p);
	if(Count(s1) < 2){
		face = s1[0];
		continue;
	}
	ind1 = SortIndexByValue(
		dir1.DistanceTo(s1) );
	s1 = Reorder(s1,ind1);
	face = s1[0];
	s2 = s1[1];
	outp[i] = s1[1];
	i = i + 1;
}
outp[i] = face;
return = outp;
};
# ----------------------------------------
geometry_2 = Output(code_block.out3)  # "geometry"
