# Dynamo custom node Line.IsInPlane.dyf "ꟿ Line.IsInPlane" (Dynamo 2.0.3.8810)
# category: Springs.Geometry.Query
# Checks if a line lies in a given plane

plane = Input(plane: Autodesk.DesignScript.Geometry.Plane)
line = Input(line: Autodesk.DesignScript.Geometry.Curve)
code_block = CodeBlock(pl=plane, crv=line)
# ---------- code_block.designscript (10 lines) ----------
N = pl.Normal;
O = pl.Origin;
a = crv.StartPoint;
b = crv.EndPoint;
d = Autodesk.Vector.ByTwoPoints(a, b);
t1 = Math.Abs(N.Dot(d)) <= 0.000001;
c = a.IsAlmostEqualTo(O) ? b : a;
r = Autodesk.Vector.ByTwoPoints(O, c);
t2 = Math.Abs(N.Dot(r)) <= 0.000001;
t1 && t2;
# ----------------------------------------
result = Output(code_block.out9)
