# Dynamo custom node Line.XYOffset.dyf "ꟿ Line.XYOffset" (Dynamo 2.0.2.6826)
# category: Springs.Geometry
# Offsets a line in the XY plane toards the specified point

line = Input(line: var)
point = Input(point: var)
distance = Input(distance: double)
code_block = CodeBlock(c=line, op=point, dist=distance)
# ---------- code_block.designscript (6 lines) ----------
v0 = c.NormalAtParameter(0.5);
v1 = v0.Reverse();
p0 = c.StartPoint;
ov = p0.Add(v0).DistanceTo(op) <
  p0.Add(v1).DistanceTo(op) ? v0 : v1;
c.Translate(ov, dist);
# ----------------------------------------
line_2 = Output(code_block.out4)  # "line"
