# Dynamo custom node List.EveryOther.dyf "ꟿ List.EveryOther" (Dynamo 2.0.2.6826)
# category: Springs.Actions
# Useful for when you want to combine an item on the list with every other item on the list. For example in list {1,2,3} , "2" will be paired up only with "1" and "3" and will not be paired up with itself.

list = Input(list: var[]..[])
removeItemAtIndex = List.RemoveItemAtIndex(list=list)  # unwired: indices
code_block = CodeBlock(fn1=removeItemAtIndex, l1=list) { __Map(fn1,0..List.Count(l1)-1); }
code_block_2 = CodeBlock(x=list) { n = 1..List.Count(x); }
dropItems = List.DropItems(list=list, amount=code_block_2)
withDuplicates = Input(withDuplicates: bool = true)
code_block_3 = CodeBlock(a=code_block, b=dropItems, dup=withDuplicates) { data = [a, b]; data[dup ? 0 : 1]; }
lists = Output(code_block_3.out1)
