# Dynamo custom node List.Split.dyf "ꟿ List.Split" (Dynamo 2.0.2.6826)
# category: Springs.Actions
# Splits a list at the desired length

list = Input(list: var[]..[])
amount = Input(amount: int)
code_block = CodeBlock(l1=list, amt=amount) { DSCore.List.TakeItems(l1, amt); DSCore.List.DropItems(l1, amt); }
list1 = Output(code_block.out0)
list2 = Output(code_block.out1)
