# Dynamo custom node N-hedron.ByOriginVector.dyf "ꟿ N-hedron.ByOriginVector" (Dynamo 2.0.2.6826)
# category: Springs.Geometry.Create
# Creates a multi-sided poyhedron with defined side length and total height.

length = Input(length: double = 10)
sides = Input(sides: int = 3)
origin = Input(origin: Autodesk.DesignScript.Geometry.Point = Autodesk.DesignScript.Geometry.Point.Origin())
axis = Input(axis: Autodesk.DesignScript.Geometry.Vector = Autodesk.DesignScript.Geometry.Vector.ZAxis())
height = Input(height: double = 8)
code_block = CodeBlock(l=length, n=sides, pt=origin, vec=axis, h=height)
# ---------- code_block.designscript (8 lines) ----------
r1 = l/Math.Sin(360/n)/2;
c1 = Circle.ByCenterPointRadiusNormal(pt,r1,vec);
pol1 = Polygon.RegularPolygon(c1,n);
pt2 = pt.Translate(vec,h);
l1 = Line.ByStartPointEndPoint(pt2,pol1.Points);
l2 = DSCore.List.AddItemToEnd(l1[0],l1);
pyr = PolySurface.ByJoinedSurfaces([Surface.
	ByRuledLoft(l2),pol1.Patch()]).ExtractSolids()[0];
# ----------------------------------------
solid = Output(code_block.pyr)
