# Dynamo custom node Number.ToString.dyf "ꟿ Number.ToString" (Dynamo 2.0.2.6826)
# category: Springs.Create
# Converts the input number(s) to string. You can optionally limit the number of digits.

num = Input(num: var[])
digits = Input(digits: int = null)
python_script = Python(IN[0]=num, IN[1]=digits)
# ---------- python_script.python (17 lines) ----------
# Copyright(c) 2017, Dimitar Venkov
# @5devene, dimitar.ven@gmail.com
# www.badmonkeys.net

def tolist(x):
	if hasattr(x,'__iter__'): return x
	else : return [x]

def n2s(n, digits=IN[1]):
	if digits is not None:
		n = round(n, digits)
	n = unicode(n)
	if n.endswith('.0'):
		n = n[:-2]
	return n

OUT = map(n2s, tolist(IN[0]))
# ----------------------------------------
str = Output(python_script)
