# Dynamo custom node Point.BoxedDistanceTo.dyf "ꟿ Point.BoxedDistanceTo" (Dynamo 2.0.2.6826)
# category: Springs.Geometry.Query
# Computes the minimal distance between a point and the axis-aligned bounding boxe of a geometry element. Works directly with a bounding box input for the geometry.

geometry = Input(geometry: var)
point = Input(point: var)
code_block = CodeBlock(g2=geometry, a=point)
# ---------- code_block.designscript (25 lines) ----------
s2 = DSCore.Object.Type(g2);
t2 = String.Contains(s2, "BoundingBox");
b = t2 ? g2 : BoundingBox.ByGeometry(g2);
bm = b.MinPoint;
bM = b.MaxPoint;
ap = [a.X, a.Y, a.Z];
bmin = [bm.X, bm.Y, bm.Z];
bmax = [bM.X, bM.Y, bM.Z];
dist = [Imperative]{
sqDist = 0;
for (i in GetKeys(ap) )
{
	if (ap[i] < bmin[i])
	{
		d = ap[i] - bmin[i];
		sqDist = sqDist + d * d;
	}
	elseif (ap[i] > bmax[i])
	{
		d = ap[i] - bmax[i];
		sqDist = sqDist + d * d;
	}
}
return = Math.Sqrt(sqDist);
};
# ----------------------------------------
distance = Output(code_block.out8)
