# Dynamo custom node Point.PullOntoPlane.dyf "ꟿ Point.PullOntoPlane" (Dynamo 2.0.2.6826)
# category: Springs.Geometry.Actions
# Pulls (projects) the point onto the input plane, following the plane normal.

plane = Input(plane: var)
point = Input(point: var)
code_block = CodeBlock(pl=plane, pt=point) { n = pl.Normal; o = pl.Origin; d = n.Dot(o.AsVector() ) - n.Dot(pt.AsVector() ); p1 = pt.Add(n.Scale(d) ); }
point_2 = Output(code_block.p1)  # "point"
