# Dynamo custom node PolyCurve.Chamfer.dyf "ꟿ PolyCurve.Chamfer" (Dynamo 2.0.2.6826)
# category: Springs.Geometry.Actions
# Symmetrically chamfers the corners of the polycurve by the designated distance

polycurve = Input(polycurve: var)
distance = Input(distance: var)
code_block = CodeBlock(pc=polycurve, d1=distance)
# ---------- code_block.designscript (17 lines) ----------
c = pc.Curves();
isClosed = pc.IsClosed;
d2 = c.Length - d1;
spt = c.PointAtSegmentLength(d1);
spar = c.ParameterAtPoint(spt);
ept = c.PointAtSegmentLength(d2);
epar = c.ParameterAtPoint(ept);
spar[0] = isClosed ? spar[0] : 0;
epar[-1] = isClosed ? epar[-1] : 1;
c1 = c.TrimByParameter(spar, epar);
c2 = Line.ByStartPointEndPoint(ept,
  DSCore.List.ShiftIndices(spt, -1) );
drop = isClosed ? 0 : -1;
c2f = DSCore.List.DropItems(c2, drop);
c3 = PolyCurve.ByJoinedCurves(
  List.Clean(Flatten(
  List.Transpose([c1, c2f]) ) ) );
# ----------------------------------------
polycurve_2 = Output(code_block.c3)  # "polycurve"
