# Dynamo custom node PolyCurve.Fillet+.dyf "ꟿ PolyCurve.Fillet+" (Dynamo 2.0.2.6826)
# category: Springs.Geometry.Actions
# Fillet a polycurve in its plane. Unlike the built in node, this works in both in the CW and the CCW direction.

polycurve = Input(polycurve: var)
radius = Input(radius: var)
code_block = CodeBlock(pc=polycurve, r=radius)
# ---------- code_block.designscript (30 lines) ----------
c = pc.Curves();
isClosed = pc.IsClosed;
shift = isClosed ? 1 : 0;
c0 = DSCore.List.ShiftIndices(c, shift);
drop = isClosed ? 0 : 1;
c0f = DSCore.List.DropItems(c0, drop);
a1 = Arc.ByFillet(c, c0f, r);
p1 = a1.StartPoint;
shift1 = isClosed ? -1 : 1;
p2 = DSCore.List.ShiftIndices(a1.EndPoint, shift1);
par1 = c.ParameterAtPoint(p1);
par2 = c.ParameterAtPoint(p2);
par1f = isClosed ? par1 : par2;
par2f = isClosed ? par2 : par1;
par1f[0] = isClosed ? par1f[0] : 0;
c1 = c.TrimByParameter(par1f, par2f);
c2 = [Imperative]{
if (isClosed)
{
return = PolyCurve.ByJoinedCurves(Flatten(
  List.Transpose([c1, a1]) ) );
}
else
{
  parE = c[-1].ParameterAtPoint(p2[0]);
  cE = c[-1].TrimByParameter(parE,1);
  return = PolyCurve.ByJoinedCurves(Flatten(
    [List.Transpose([c1, a1]), cE]) );
}
};
# ----------------------------------------
polycurve_2 = Output(code_block.out16)  # "polycurve"
