# Dynamo custom node Surface.OuterPerimeterCurves.dyf "ꟿ Surface.OuterPerimeterCurves" (Dynamo 2.0.3.8810)
# category: Springs.Geometry.Actions
# Get only the outer perimeter of a surface, dropping  the inner openings.

surf = Input(surf: var[])
python_script = Python(IN[0]=surf)
# ---------- python_script.python (20 lines) ----------
# Copyright(c) 2020, Dimitar Venkov
# @5devene, dimitar.ven@gmail.com
# www.badmonkeys.net

import clr
clr.AddReference('ProtoGeometry')
import Autodesk.DesignScript.Geometry as DS

def tolist(x):
    if hasattr(x,'__iter__'): return x
    return [x]

surfaces = tolist(IN[0])

def dropSurfaceOpenings(srf):
	face = srf.Faces[0]
	extLoop = [lp for lp in srf.Faces[0].Loops if lp.IsExternal][0]
	return [ce.Edge.CurveGeometry for ce in extLoop.CoEdges]

OUT = map(dropSurfaceOpenings, surfaces)
# ----------------------------------------
curves = Output(python_script)
