# Dynamo custom node TkMesh.Merge.dyf "ꟿ TkMesh.Merge" (Dynamo 2.0.2.6826)
# category: Springs.Geometry.Actions
# Creates a single mesh entity from a list of toolkit meshes.

tkMeshes = Input(tkMeshes: var[])
python_script = Python(IN[0]=tkMeshes)
# ---------- python_script.python (10 lines) ----------
meshes = IN[0]
vertices, indices = [], []
lastInd = 0

for m in meshes:
	vertices.extend(m.Vertices() )
	indices.extend([i + lastInd for i in m.VertexIndicesByTri()])
	lastInd += int(m.VertexCount)

OUT = m.ByVerticesAndIndices(vertices, indices)
# ----------------------------------------
tkMesh = Output(python_script)
