# Dynamo graph matterlab_Create-sheets-for-existing-views.dyn "matterlab-CreateSheetsForExistingViews" (Dynamo 2.5.0.7460)
# pr
# packages: GenerativeDesign 0.75.1

# group: CreateSheetsForViews
# note: DYNAMO FILE NAME
# matterlab-CreateSheetsForViews.dyn
# note: ASSOCIATED FILE(S)
# N/A
# note: Martin Stacey (matterlab) / 2020.02.07
# note: DESCRIPTION
# This script places all cropped views on a document to sheets. The user should select a titleblock, define the titleblock margins and viewport margin, Refinery will try placing views alligned in rows into sheets, and minimize the sheets needed and maximize the view original order. The view original order is the order that views are set in Revit (first floorplans, then ceiling plans, then elevations, etc.)
# note: DYNAMO VERSION
# 2.5.0
# note: REQUIRED DYNAMO PACKAGES
# N/A
# note: ADDITIONAL COMMENTS
# N/A

# group: Inputs: Titleblock instance
# note: Select a titleblock instance
# this will make dynamo
# aware of its width and height
select_title_block_for_sheets = DSModelElementSelection()  # 1 picked in the model; graph input

# group: Project Units
string = StringInput("DUT_MILLIMETERS")
python_script = Python()
# ---------- python_script.python (21 lines) ----------
# Load the Python Standard and DesignScript Libraries
import clr
#imports the Revit API
clr.AddReference('RevitAPI')
from Autodesk.Revit.DB import *
#imports revit services and the document manager
clr.AddReference('RevitServices')
import RevitServices
from RevitServices.Persistence import DocumentManager

#gets the current document
doc = DocumentManager.Instance.CurrentDBDocument

# The inputs to this node will be stored as a list in the IN variables.
dataEnteringNode = IN

# Place your code below this line
unitType = str(Document.GetUnits(doc).GetFormatOptions(UnitType.UT_Length).DisplayUnits)

# Assign your output to the OUT variable.
OUT = unitType
# ----------------------------------------
remember = Data.Remember(python_script)
code_block = CodeBlock(projectUnits=remember) { projectUnits; }
get_scale_factor_python = Python(IN[0]=string, IN[1]=code_block)
# ---------- get_scale_factor_python.python (31 lines) ----------
import clr
import sys

#sets the distance to convert as input 0
originalUnit = IN[0]
unitToConvert = IN[1]

#builds a hard coded list of dictionary values for the conversion factors
conversionToFeet = {
	"DUT_METERS":1/3.28084,
	"DUT_METERS_CENTIMETERS": 1/3.28084,
	"DUT_MILLIMETERS" : 304.8, 
	"DUT_CENTIMETERS" : 30.48, 
	"DUT_DECIMAL_FEET" : 1,
	"DUT_FEET_FRACTIONAL_INCHES": 1,
	"DUT_DECIMAL_INCHES" : 1/12.0, 
	"DUT_FRACTIONAL_INCHES" : 1/12.0
}

originalUnitInFeet = 1/conversionToFeet[originalUnit]

convertedUnit = originalUnitInFeet * conversionToFeet[unitToConvert]
convertedUnit = round(convertedUnit,10)
#gets the relevant conversion factor from the hard coded dictionary for the display units
#conversion = conversionFactors[unitType]/304.8

#multiplies the conversion factor by the distance to convert
#convertedValue = distance * conversion

# return the converted length value
OUT = convertedUnit
# ----------------------------------------

# group: Margins in mm
title_block_left_margin = IntegerSlider(25, range=0..900 step 1)
title_block_right_margin = IntegerSlider(127, range=0..900 step 1)
# note: Margins need to be inserted
# manually due to the fact that
# you may have different designs
# for the
title_block_bottom_margin = IntegerSlider(25, range=0..900 step 1)
title_block_top_margin = IntegerSlider(25, range=0..900 step 1)
margin_for_each_viewport = IntegerSlider(15, range=0..900 step 1)

# group: Sheet separation
# note: Separation between sheets
# (parameter only used for
# visualization)
sheet_separation = IntegerSlider(200, range=0..900 step 1)

# group: Unit Conversion
# note: Scales harcoded inputs (mm) into its equivalent value in projects units
scale = CodeBlock(units=get_scale_factor_python, lefMargin=title_block_left_margin, rightMargin=title_block_right_margin, bottomMargin=title_block_bottom_margin, topMargin=title_block_top_margin, viewportMargin=margin_for_each_viewport, separation=sheet_separation) { units; units*lefMargin; units*rightMargin; units*bottomMargin; units*topMargin; units*viewportMargin; units*separation; }

# group: Inputs: Shuffle seed
# note: A shuffle seed will shuffle the order
# of placement of views, giving Refinery
# the capability to play around different
# commbinations
shuffle_seed = IntegerSlider(71, range=0..100 step 1)  # graph input

# group: Change Views Units
string_2 = StringInput("DUT_DECIMAL_FEET")
python_script_2 = Python()  # same code as python_script

remember_2 = Data.Remember(python_script_2)

# group (continued): Change Views Units
code_block_2 = CodeBlock(projectUnits=remember_2) { projectUnits; }
get_scale_factor_python_2 = Python(IN[0]=string_2, IN[1]=code_block_2)  # same code as get_scale_factor_python

# group: View Types
# note: Only croped views would be added to sheets
element_types = ElementTypes("ViewPlan")
all_elements_of_type = ElementsOfType(element_type=element_types)

# group: Select only cropped views
string_3 = StringInput("Crop View")
getParameterValueByName = Element.GetParameterValueByName(element=all_elements_of_type, parameterName=string_3)
code_block_3 = CodeBlock(a=getParameterValueByName) { a==1; }
filterByBoolMask = List.FilterByBoolMask(list=all_elements_of_type, mask=code_block_3)
flatten = List.Flatten(list=filterByBoolMask.in)
code_block_4 = CodeBlock(viewList=flatten) { viewList; }

# group: Scale views to in-sheet size
string_4 = StringInput("Scale Value    1:")
getParameterValueByName_2 = Element.GetParameterValueByName(element=code_block_4, parameterName=string_4)
get_cropview_rectangle_in_m = Python(IN[0]=code_block_4)
# ---------- get_cropview_rectangle_in_m.python (20 lines) ----------
# Load the Python Standard and DesignScript Libraries
import sys
import clr
clr.AddReference('ProtoGeometry')
clr.AddReference('RevitAPI')
from Autodesk.DesignScript.Geometry import *
from Autodesk.Revit.DB import XYZ


views = IN[0]
viewRectangles = []
for view in views:
	viewUnwrap = UnwrapElement(view)
	cropBox = viewUnwrap.CropBox
	viewWidth = cropBox.Max.X - cropBox.Min.X
	viewHeight = cropBox.Max.Y - cropBox.Min.Y
	viewRectangle = Rectangle.ByWidthLength(viewWidth,viewHeight)
	viewRectangles.append(viewRectangle)

OUT = viewRectangles
# ----------------------------------------
width = Rectangle.Width(rectangle=get_cropview_rectangle_in_m)
height = Rectangle.Height(rectangle=get_cropview_rectangle_in_m)
code_block_5 = CodeBlock(units=get_scale_factor_python_2, scale=getParameterValueByName_2, width=width, height=height) { units; scale; w = units*width*(1/scale); h=units*height*(1/scale); }
byWidthLength = Rectangle.ByWidthLength(width=code_block_5.w, length=code_block_5.h)
id = Element.Id(element=code_block_4)

count = List.Count(list=code_block_5.h)

# group: Remember View Info
remember_3 = Data.Remember(count)
remember_4 = Data.Remember(byWidthLength)
remember_5 = Data.Remember(id)

code_block_6 = CodeBlock(viewsCount=remember_3) { 0..viewsCount-1; }
id_2 = Element.Id(element=select_title_block_for_sheets)

# group: Remember name of object
string_5 = StringInput("Sheet Width")
getParameterValueByName_3 = Element.GetParameterValueByName(element=select_title_block_for_sheets, parameterName=string_5)
remember_6 = Data.Remember(getParameterValueByName_3)
string_6 = StringInput("Sheet Height")
getParameterValueByName_4 = Element.GetParameterValueByName(element=select_title_block_for_sheets, parameterName=string_6)
remember_7 = Data.Remember(getParameterValueByName_4)
remember_8 = Data.Remember(id_2)

code_block_7 = CodeBlock(sheetWidth=remember_6, sheetHeight=remember_7) { sheetWidth; sheetHeight; }

# group: Get tittleblock parameters
# note: Tittleblock (no margins)
byWidthLength_2 = Rectangle.ByWidthLength(width=code_block_7.sheetWidth, length=code_block_7.sheetHeight)
code_block_8 = CodeBlock(w=code_block_7.sheetWidth, h=code_block_7.sheetHeight) { w/2; h/2; }
# note: Tittleblock Rectangle (no margins)
translate = Geometry.Translate(geometry=byWidthLength_2, xTranslation=code_block_8.out0, yTranslation=code_block_8.out1)
add = scale.out1 + scale.out2
# note: Width with margins
sub = code_block_7.sheetWidth - add
add_2 = scale.out3 + scale.out4
# note: Height with margins
sub_2 = code_block_7.sheetHeight - add_2
# note: Tittleblock (with margins)
byWidthLength_3 = Rectangle.ByWidthLength(width=sub, length=sub_2)
code_block_9 = CodeBlock(mL=scale.out1, mB=scale.out3, mV=scale.out5, sS=shuffle_seed, sV=scale.out6) { mL; mB; mV; sS; sV; }
code_block_10 = CodeBlock(w=sub, mL=code_block_9.mL, h=sub_2, mB=code_block_9.mB) { w/2+mL; h/2+mB; }
# note: Tittleblock Rectangle (with margins)
translate_2 = Geometry.Translate(geometry=byWidthLength_3, xTranslation=code_block_10.out0, yTranslation=code_block_10.out1)
code_block_11 = CodeBlock(marginLeft=code_block_9.mL, marginBottom=code_block_9.mB, sheetSeparation=code_block_9.sV, mV=code_block_9.mV, shuffleSeed=code_block_9.sS) { marginLeft; marginBottom; sheetSeparation; viewportMargin = mV*2; shuffleSeed; }

# group: Tittleblock parameters
code_block_12 = CodeBlock(TittleBlRectNoMargins=translate, TittleBlRectWithMargins=translate_2, offsetLeft=code_block_11.marginLeft, offsetBottom=code_block_11.marginBottom, sheetSeparation=code_block_11.sheetSeparation, viewOffsets=code_block_11.viewportMargin)
# ---------- code_block_12.designscript (9 lines) ----------
TittleBlRectNoMargins;
TittleBlRectWithMargins;
[TittleBlRectNoMargins,TittleBlRectWithMargins];
offsetLeft;
offsetBottom;
sheetSeparation;
viewOffsets;
tittleBlockHeight = TittleBlRectWithMargins.Height;
tittleBlockWidth = TittleBlRectWithMargins.Width;
# ----------------------------------------

# group: Shuffle List of Views
shuffle_range_with_seed = Python(IN[0]=code_block_11.shuffleSeed, IN[1]=code_block_6)
# ---------- shuffle_range_with_seed.python (12 lines) ----------
import sys
import clr
clr.AddReference('ProtoGeometry')
from Autodesk.DesignScript.Geometry import *
import random
seedIN = IN[0]
listIN = IN[1]

random.seed(seedIN)
random.shuffle(listIN)
#OUT = "csdc"
OUT = listIN
# ----------------------------------------
arrange_list_with_range_order = Python(IN[0]=shuffle_range_with_seed, IN[1]=remember_4)
# ---------- arrange_list_with_range_order.python (11 lines) ----------
import sys
import clr
clr.AddReference('ProtoGeometry')
from Autodesk.DesignScript.Geometry import *
import random
newOrder = IN[0]
listIN = IN[1]
listOUT = []
for i in newOrder:
	listOUT.append(listIN[i])
OUT = listOUT
# ----------------------------------------

code_block_13 = CodeBlock(viewportMargin=code_block_11.viewportMargin) { viewportMargin; }

# group: Add margins to viewports
width_2 = Rectangle.Width(rectangle=arrange_list_with_range_order)
add_3 = width_2 + code_block_13
height_2 = Rectangle.Height(rectangle=arrange_list_with_range_order)
add_4 = code_block_13 + height_2
byWidthLength_4 = Rectangle.ByWidthLength(width=add_3, length=add_4)

code_block_14 = CodeBlock(viewRectNoMargins=arrange_list_with_range_order, viewRectWithMargins=byWidthLength_4, sheetHeight=code_block_12.tittleBlockHeight, viewWidthWithMargins=add_3, viewHeightWithMargins=add_4) { viewRectNoMargins; viewRectWithMargins; sheetHeight; viewWidthWithMargins; viewHeightWithMargins; }

# group: Divide Views to Rows, and Sheets
divide_views_to_rows = Python(IN[0]=add_3, IN[1]=code_block_12.tittleBlockWidth)
# ---------- divide_views_to_rows.python (25 lines) ----------
# Load the Python Standard and DesignScript Libraries
import sys
import clr
clr.AddReference('ProtoGeometry')
from Autodesk.DesignScript.Geometry import *

viewsWidths = IN[0]
sheetWidth = IN[1]



groupWidths = []
subList = []
wSum = 0

for w in viewsWidths:
	if wSum + w > sheetWidth:
		groupWidths.append(subList)
		subList = []
		wSum=0
	subList.append(w)
	wSum += w
if len(subList)>0:
	groupWidths.append(subList)
OUT = groupWidths
# ----------------------------------------
groupHeights = Python(IN[0]=add_4, IN[1]=divide_views_to_rows)
# ---------- groupHeights.python (19 lines) ----------
# Load the Python Standard and DesignScript Libraries
import sys
import clr
clr.AddReference('ProtoGeometry')
from Autodesk.DesignScript.Geometry import *

viewHeights = IN[0]
groupViewWidths = IN[1]
groupViewHeights = []

subList = []
count = 0
for widths in groupViewWidths:
	for w in widths:
		subList.append(viewHeights[count])
		count+=1
	groupViewHeights.append(subList)
	subList = []
OUT = groupViewHeights
# ----------------------------------------
groupsMaxHeight = Python(IN[0]=groupHeights)
# ---------- groupsMaxHeight.python (13 lines) ----------
# Load the Python Standard and DesignScript Libraries
import sys
import clr
clr.AddReference('ProtoGeometry')
from Autodesk.DesignScript.Geometry import *
groupHeights = IN[0]

for i, I in enumerate(groupHeights):
	maxVal = max(I)
	for j,J in enumerate(I):
		groupHeights[i][j] = maxVal
useMaxHeights = 0
OUT = groupHeights
# ----------------------------------------
divide_views_to_sheets = Python(IN[0]=code_block_14.sheetHeight, IN[1]=groupsMaxHeight, IN[2]=divide_views_to_rows)
# ---------- divide_views_to_sheets.python (35 lines) ----------
# Load the Python Standard and DesignScript Libraries
import sys
import clr
clr.AddReference('ProtoGeometry')
from Autodesk.DesignScript.Geometry import *

sheetHeight = IN[0]
viewsMaxHeights = IN[1]
viewsInRows = IN[2]



groupWidths = []
groupHeights = []

subList = []
subListW = []
hSum = 0

for i, hs in enumerate(viewsMaxHeights):
	h = max(hs)
	if hSum + h > sheetHeight:
		groupHeights.append(subList)
		groupWidths.append(subListW)
		subList = []
		subListW = []
		hSum = 0
	subList.append(hs)
	subListW.append(viewsInRows[i])
	hSum += h
if len(subList)>0:
	groupHeights.append(subList)
	groupWidths.append(subListW)
	
OUT = [groupWidths,groupHeights]
# ----------------------------------------
# note: Sheet Count
code_block_15 = CodeBlock(x=divide_views_to_sheets) { List.Count(x[1]); }
dividedWidths = CodeBlock(x=divide_views_to_sheets) { x[0]; }
dividedHeights = CodeBlock(x=divide_views_to_sheets) { x[1]; }

code_block_16 = CodeBlock(tittleBlockViz=code_block_12.out2, sheetSeparation=code_block_12.sheetSeparation, viewsNoMargins=code_block_14.viewRectNoMargins, viewswithMargins=code_block_14.viewRectWithMargins, sheetHeight=code_block_14.sheetHeight, sheetCount=code_block_15)
# ---------- code_block_16.designscript (7 lines) ----------
tittleBlockViz;
sheetSeparation;
viewsNoMargins;
viewswithMargins;
sheetHeight;
totSheetSep = -sheetSeparation-sheetHeight;
sheetSeparations = 0..#sheetCount..totSheetSep;
# ----------------------------------------

# group: Sheet Visualization
# note: Each sheet is drawn as a rectangle, it includes its margins to make it easier to visualize
translate_3 = Geometry.Translate(geometry=code_block_16.tittleBlockViz@L1, yTranslation=code_block_16.sheetSeparations)

code_block_17 = CodeBlock(viewsShuffledOrder=shuffle_range_with_seed, viewsOriginalOrder=code_block_6) { viewsShuffledOrder; viewsOriginalOrder; }

# group: Get Viewport Sheet Number
sheetsNumber = Python(IN[0]=dividedWidths)
# ---------- sheetsNumber.python (18 lines) ----------
# Load the Python Standard and DesignScript Libraries
import sys
import clr
clr.AddReference('ProtoGeometry')
from Autodesk.DesignScript.Geometry import *

# The inputs to this node will be stored as a list in the IN variables.
sheets = IN[0]
accumWidthSheets = []
for i,list in enumerate(sheets):
	accumWidths = []
	for widths in list:
		subList = []
		for w in widths:
			subList.append(i)
		accumWidths.append(subList)
	accumWidthSheets.append(accumWidths)
OUT = accumWidthSheets
# ----------------------------------------
flatten_2 = List.Flatten(list=sheetsNumber)
code_block_18 = CodeBlock(viewsSheetNumber=flatten_2) { viewsSheetNumber; }

code_block_19 = CodeBlock(TittleBlRectWithMargins=code_block_12.TittleBlRectWithMargins, viewRectNoMargins=arrange_list_with_range_order, viewRectWithMargins=byWidthLength_4) { TittleBlRectWithMargins; viewRectNoMargins; viewRectWithMargins; }

# group: Metrics for Refinery
code_block_20 = CodeBlock(sheetCount=code_block_15) { sheetCount; }
code_block_21 = CodeBlock(viewsShuffledOrder=code_block_17.viewsShuffledOrder, viewsOriginalOrder=code_block_17.viewsOriginalOrder) { viewsShuffledOrder; viewsOriginalOrder; }
shuffle_score = Python(IN[0]=code_block_21.viewsOriginalOrder, IN[1]=code_block_21.viewsShuffledOrder)
# ---------- shuffle_score.python (15 lines) ----------
original = IN[0]
shuffled = IN[1]
up = 0
down = 0
if len(shuffled)<2:
	resultPercentage = 100
else:
	for i in range(0,len(shuffled)-1):
		if shuffled[i+1] == shuffled[i]-1 or shuffled[i+1] == shuffled[i]+1:
			up = up + 1.0
	for i in range(1,len(shuffled)):
		if shuffled[i-1] == shuffled[i]-1 or shuffled[i-1] == shuffled[i]+1:
			down = down + 1.0	
	resultPercentage = ((up+down)/((len(original)-1)*2))*100
OUT = resultPercentage
# ----------------------------------------
code_block_22 = CodeBlock(amountOfShuffle=shuffle_score) { amountOfShuffle; }
width_3 = Rectangle.Width(rectangle=code_block_19.viewRectWithMargins)
height_3 = Rectangle.Height(rectangle=code_block_19.viewRectWithMargins)
mul = width_3 * height_3
# note: Python: Add the total views area per sheet, creates a score based on how evenly distributed are views along sheets.
code_block_23 = CodeBlock(sheetNumber=flatten_2, sheetArea=mul, sheetCount=code_block_15) { sheetNumber; sheetArea; sheetCount; }

python_script_3 = Python(IN[0]=code_block_23.sheetNumber, IN[1]=code_block_23.sheetArea, IN[2]=code_block_23.sheetCount)
# ---------- python_script_3.python (27 lines) ----------
# Load the Python Standard and DesignScript Libraries
import sys
import clr
clr.AddReference('ProtoGeometry')
from Autodesk.DesignScript.Geometry import *

sheetsNumber = IN[0]
sheetsAreas = IN[1]
sheetCount = IN[2]

#get Area per Sheet
areaPerSheet = [0] * sheetCount
for i, s in enumerate(sheetsNumber):
	areaPerSheet [s] +=sheetsAreas[i]

#Get Average
average = 0
for a in areaPerSheet:
	average += a
average = average / sheetCount

#Compare with average
addedDiffWithAverage = 0
for a in areaPerSheet:
	addedDiffWithAverage = (a - average) * (a - average)

OUT = addedDiffWithAverage
# ----------------------------------------

# group: Outputs
# note: Count the number of sheets needed to place
# all views selected
sheet_count = Watch(code_block_20)  # graph output
# note: Measures the percent of how the
# order defined in Revit (first floorplans, then ceilingplans etc.) is mantained by suggested
# sheet placement.
score_for_order_mantained = Watch(code_block_22)  # graph output
# note: Percent that is used by all views and their margins.
score_for_evenly_distributed = Watch(python_script_3)  # graph output

# group: Get Viewport Origin Point
accumWidths = Python(IN[0]=dividedWidths)
# ---------- accumWidths.python (20 lines) ----------
# Load the Python Standard and DesignScript Libraries
import sys
import clr
clr.AddReference('ProtoGeometry')
from Autodesk.DesignScript.Geometry import *

# The inputs to this node will be stored as a list in the IN variables.
sheets = IN[0]
accumWidthSheets = []
for list in sheets:
	accumWidths = []
	for widths in list:
		subList = []
		accumWidth = 0
		for w in widths:
			subList.append(accumWidth)
			accumWidth+=w
		accumWidths.append(subList)
	accumWidthSheets.append(accumWidths)
OUT = accumWidthSheets
# ----------------------------------------
flatten_3 = List.Flatten(list=accumWidths)
accumHeights = Python(IN[0]=dividedHeights)
# ---------- accumHeights.python (21 lines) ----------
# Load the Python Standard and DesignScript Libraries
import sys
import clr
clr.AddReference('ProtoGeometry')
from Autodesk.DesignScript.Geometry import *

# The inputs to this node will be stored as a list in the IN variables.
sheets = IN[0]
accumHeightsInSheets = []
for list in sheets:
	accumHeights = []
	accumHeight = 0
	for heights in list:
		subList = []
		h = max(heights)
		for w in heights:
			subList.append(accumHeight)
		accumHeight+=h
		accumHeights.append(subList)
	accumHeightsInSheets.append(accumHeights)
OUT = accumHeightsInSheets
# ----------------------------------------
flatten_4 = List.Flatten(list=accumHeights)
code_block_24 = CodeBlock(offsetLeft=code_block_12.offsetLeft, offsetBottom=code_block_12.offsetBottom, viewHeight=code_block_14.viewHeightWithMargins, viewWidth=code_block_14.viewWidthWithMargins, sheetHeight=code_block_14.sheetHeight, xPos=flatten_3, yPos=flatten_4)
# ---------- code_block_24.designscript (7 lines) ----------
offsetLeft;
offsetBottom;
halfH= viewHeight/2;
halfW = viewWidth/2;
sheetHeight;
midXPos = xPos + offsetLeft + halfW;
midYPos = sheetHeight + offsetBottom - yPos - halfH;
# ----------------------------------------
byCoordinates = Point.ByCoordinates(x=code_block_24.midXPos, y=code_block_24.midYPos)

# group: View Visualization
mul_2 = code_block_16.totSheetSep * code_block_18
translate_4 = Geometry.Translate(geometry=byCoordinates, yTranslation=mul_2)
X = Point.X(point=translate_4)
# note: Each view is visualized
# as a rectangle at its
# assigned position within
# the sheet
Y = Point.Y(point=translate_4)
translate_5 = Geometry.Translate(geometry=code_block_16.viewswithMargins, xTranslation=X, yTranslation=Y)

# group: Create Sheet List
code_block_25 = CodeBlock(sheetCount=code_block_15) { sheetList = 0..sheetCount-1; }
string_from_object = FromObject(obj=code_block_25)
code_block_26 = CodeBlock(sheetCountSTRING=string_from_object) { sheetCountSTRING; sheetNames = "Refinery" + sheetCountSTRING; sheetNumber = "ref"+ sheetCountSTRING; }

code_block_27 = CodeBlock(tittleBlockId=remember_8) { tittleBlockId; }

# group: Revit Elements
code_block_28 = CodeBlock(tittleBlockId=code_block_27) { tittleBlockId; }
code_block_29 = CodeBlock(tittleBlockId=code_block_28) { tittleBlockId; }

# group: Order viewlist
# note: You need to order the view list (instances) to correspond to the shuffled list (rectangle views) created
code_block_30 = CodeBlock(viewsList=remember_5, tittleBlockId=code_block_29) { viewsList; tittleBlockId; }
arrange_list_with_range_order_2 = Python(IN[0]=code_block_17.viewsShuffledOrder, IN[1]=code_block_30.viewsList)  # same code as arrange_list_with_range_order

# group: Data Gate Node
# note: Data generated by dynamo script needed to place views in sheets
boolean = BoolSelector(true)
code_block_31 = CodeBlock(isDataGateOpen=boolean, sheetNames=code_block_26.sheetNames, sheetNumbers=code_block_26.sheetNumber, pointList=byCoordinates, sheetNumberList=code_block_18, viewsIds=arrange_list_with_range_order_2, tittleBlockId=code_block_30.tittleBlockId)
# ---------- code_block_31.designscript (7 lines) ----------
[isDataGateOpen,
sheetNames,
sheetNumbers,
pointList,
sheetNumberList,
viewsIds,
tittleBlockId];
# ----------------------------------------

gate = Data.Gate(false, code_block_31)

# group (continued): Data Gate Node
code_block_32 = CodeBlock(a=gate)
# ---------- code_block_32.designscript (7 lines) ----------
isDataGateOpen= a[0];
sheetNames = a[1];
sheetNumbers= a[2];
pointList= a[3];
sheetNumberList= a[4];
viewsIds= a[5];
tittleBlockId= a[6];
# ----------------------------------------

# group: Put in Sheet
categories = Categories("OST_Sheets")
all_elements_of_category = ElementsOfCategory(Category=categories)
elements_from_id = Python(IN[0]=code_block_32.tittleBlockId)
# ---------- elements_from_id.python (29 lines) ----------
import clr
clr.AddReference('RevitAPI')
clr.AddReference("RevitNodes")
clr.AddReference("RevitServices")
from Autodesk.Revit.DB import *
import Revit
clr.ImportExtensions(Revit.Elements)
import RevitServices
from RevitServices.Persistence import DocumentManager
from RevitServices.Transactions import TransactionManager

doc = DocumentManager.Instance.CurrentDBDocument
TransactionManager.Instance.EnsureInTransaction(doc)

ids = IN[0]
if not isinstance(ids, list):
	ids = [ids]

elemIds = []
for id in ids:
    elemIds.append(ElementId(id))

elems = []
for elemId in elemIds:
	elems.append(doc.GetElement(elemId))

TransactionManager.Instance.TransactionTaskDone()

OUT = elems
# ----------------------------------------
code_block_33 = CodeBlock(x=elements_from_id) { x[0]; }
elementType = Element.ElementType(element=code_block_33)
# note: Erase existing viewports that are
# assigned to views you which to place
element_types_2 = ElementTypes("Viewport")
all_elements_of_type_2 = ElementsOfType(element_type=element_types_2)
id_3 = Element.Id(element=all_elements_of_type_2)
delete_existing_viewports = Python(IN[0]=id_3, IN[1]=code_block_32.isDataGateOpen)
# ---------- delete_existing_viewports.python (34 lines) ----------
import clr
clr.AddReference('ProtoGeometry')
from Autodesk.DesignScript.Geometry import *
clr.AddReference('RevitNodes')
import Revit
clr.ImportExtensions(Revit.Elements)
clr.ImportExtensions(Revit.GeometryConversion)
clr.AddReference('RevitServices')
import RevitServices
from RevitServices.Persistence import DocumentManager
from RevitServices.Transactions import TransactionManager
from System.Collections.Generic import *
clr.AddReference('RevitAPI')
import Autodesk
from Autodesk.Revit.DB import *

doc = DocumentManager.Instance.CurrentDBDocument
uiapp = DocumentManager.Instance.CurrentUIApplication
app = uiapp.Application
uidoc=DocumentManager.Instance.CurrentUIApplication.ActiveUIDocument

allViewportsIds = UnwrapElement(IN[0])
dataGateOpen = IN[1]

TransactionManager.Instance.EnsureInTransaction(doc)
if dataGateOpen:
	for vId in allViewportsIds:
		if not doc.GetElement(ElementId(vId)) == None:
			doc.Delete(ElementId(vId))
outText = "Datagate closed non viewports were deleted"
if dataGateOpen:
	outText = "all viewports deleted"
TransactionManager.Instance.TransactionTaskDone()
OUT= dataGateOpen
# ----------------------------------------
code_block_34 = CodeBlock(dataGate=delete_existing_viewports) { dataGate; }
make_sheets = Python(IN[0]=all_elements_of_category, IN[1]=elementType, IN[2]=code_block_32.sheetNames, IN[3]=code_block_32.sheetNumbers, IN[4]=code_block_34)
# ---------- make_sheets.python (45 lines) ----------
import clr
clr.AddReference('RevitAPI')
clr.AddReference("RevitNodes")
clr.AddReference("RevitServices")
from Autodesk.Revit.DB import *
import Revit
clr.ImportExtensions(Revit.Elements)
import RevitServices
from RevitServices.Persistence import DocumentManager
from RevitServices.Transactions import TransactionManager

doc = DocumentManager.Instance.CurrentDBDocument

ExistingSheets = IN[0]
NewTitleBlock = UnwrapElement(IN[1])
NewSheetNames = IN[2]
NewSheetNumbers = IN[3]
dataGateOpen = IN[4]
TransactionManager.Instance.EnsureInTransaction(doc)

newSheetList = []

def ExistingSheetWithNameOrNumber(existingSheets,newName,newNumber):
	for e in existingSheets:
		sheetNameExists = e.SheetName == newName
		sheetNumberExists = e.SheetNumber == newNumber
		if sheetNameExists or sheetNumberExists:
			return e
	return 0
if dataGateOpen == True:
	for i in range(len(NewSheetNames)):
		newName = NewSheetNames[i]
		newNumber = NewSheetNumbers[i]	
		existingSheet = ExistingSheetWithNameOrNumber(ExistingSheets,newName,newNumber)
		if not existingSheet == 0:
			newSheetList.append(existingSheet)
		else:
			newsheet = ViewSheet.Create(doc,NewTitleBlock.Id)
			newsheet.Name = newName
			newsheet.SheetNumber = newNumber
			newSheetList.append(newsheet.ToDSType(False))

TransactionManager.Instance.TransactionTaskDone()

OUT = newSheetList
# ----------------------------------------
elements_from_id_2 = Python(IN[0]=code_block_32.viewsIds)  # same code as elements_from_id
zip_view_information = Python(IN[0]=code_block_32.pointList, IN[1]=code_block_32.sheetNumberList, IN[2]=elements_from_id_2, IN[3]=code_block_34)
# ---------- zip_view_information.python (11 lines) ----------
# Load the Python Standard and DesignScript Libraries
import sys
import clr
clr.AddReference('ProtoGeometry')
from Autodesk.DesignScript.Geometry import *

position = IN[0]
sheetNumbers = IN[1]
views = IN[2]
gateIsOpen = IN[3]
OUT = zip(views,sheetNumbers,  position)
# ----------------------------------------
# note: Place Viewports at location
python_script_4 = Python(IN[0]=make_sheets, IN[1]=zip_view_information, IN[2]=code_block_34)
# ---------- python_script_4.python (38 lines) ----------
import clr
clr.AddReference('ProtoGeometry')
from Autodesk.DesignScript.Geometry import *
clr.AddReference('RevitNodes')
import Revit
clr.ImportExtensions(Revit.Elements)
clr.ImportExtensions(Revit.GeometryConversion)
clr.AddReference('RevitServices')
import RevitServices
from RevitServices.Persistence import DocumentManager
from RevitServices.Transactions import TransactionManager
from System.Collections.Generic import *
clr.AddReference('RevitAPI')
import Autodesk
from Autodesk.Revit.DB import *

doc = DocumentManager.Instance.CurrentDBDocument
uiapp = DocumentManager.Instance.CurrentUIApplication
app = uiapp.Application
uidoc=DocumentManager.Instance.CurrentUIApplication.ActiveUIDocument

sheets = UnwrapElement(IN[0])
viewsZIP = IN[1]
dataGateOpen = IN[2]

TransactionManager.Instance.EnsureInTransaction(doc)
newViewports=[]

if dataGateOpen == True:
	for vZ in viewsZIP:
		v = UnwrapElement(vZ[0])
		s = sheets[vZ[1]]
		p = UnwrapElement(vZ[2]).ToXyz()
		newViewport=Viewport.Create(doc, s.Id,v.Id, p)
		newViewports.append(newViewport)

TransactionManager.Instance.TransactionTaskDone()
OUT=newViewports
# ----------------------------------------

code_block_35 = CodeBlock { percentUsedPerSheet; percentUsed; }  # unwired: percentUsedPerSheet, percentUsed
code_block_36 = CodeBlock(sheetNumbers=flatten_2) { sheetNumbers; }
