# Dynamo custom node Application.OpenViews.dyf "ꟿ Application.OpenViews" (Dynamo 2.0.3.8810)
# category: Springs.Revit.Query
# Lists all views currently open inside the Revit UI

refresh = Input(refresh: bool = true)
python_script = Python(IN[0]=refresh)
# ---------- python_script.python (12 lines) ----------
import clr

clr.AddReference('RevitServices')
from RevitServices.Persistence import DocumentManager
doc = DocumentManager.Instance.CurrentDBDocument
uidoc = DocumentManager.Instance.CurrentUIApplication.ActiveUIDocument

clr.AddReference('RevitNodes')
import Revit
clr.ImportExtensions(Revit.Elements)

OUT = [doc.GetElement(v.ViewId).ToDSType(1) for v in uidoc.GetOpenUIViews()]
# ----------------------------------------
views = Output(python_script)
