# Dynamo custom node BoundingBox.MidPoint.dyf "ꟿ BoundingBox.MidPoint" (Dynamo 2.0.2.6826)
# category: Springs.Geometry.Query
# Fetches the mid point of the bounding box.

boundingBox = Input(boundingBox: Autodesk.DesignScript.Geometry.BoundingBox)
code_block = CodeBlock(bb1=boundingBox)
# ---------- code_block.designscript (6 lines) ----------
a = bb1.MinPoint;
b = bb1.MaxPoint;
pt = Point.ByCoordinates(
  (a.X + b.X) / 2,
  (a.Y + b.Y) / 2,
  (a.Z + b.Z) / 2);
# ----------------------------------------
point = Output(code_block.pt)
