# Dynamo custom node Geometry.Extents.dyf "ꟿ Geometry.Extents" (Dynamo 2.0.2.6826)
# category: Springs.Geometry.Query
# Gets the dimensions of the geometry's bounding box.

geometry = Input(geometry: var)
code_block = CodeBlock(g=geometry)
# ---------- code_block.designscript (8 lines) ----------
s1 = DSCore.Object.Type(g);
t1 = String.Contains(s1, "BoundingBox");
bb = t1 ? g : BoundingBox.ByGeometry(g);
min = bb.MinPoint;
max = bb.MaxPoint;
w = Math.Abs(min.X - max.X);
l = Math.Abs(min.Y - max.Y);
h = Math.Abs(min.Z - max.Z);
# ----------------------------------------
width = Output(code_block.w)
length = Output(code_block.l)
height = Output(code_block.h)
