# Dynamo custom node Geometry.IndexByDistance.dyf "ꟿ Geometry.IndexByDistance" (Dynamo 2.0.2.6826)
# category: Springs.Geometry.Actions
# Provides the index of the closest or farthest geometry. Should prove faster than getting the geometry and finding its index in two separate operations.

geometry = Input(geometry: var[])
other = Input(other: var[])
isClosest = Input(isClosest: bool = true)
python_script = Python(IN[0]=geometry, IN[1]=other, IN[2]=isClosest)
# ---------- python_script.python (31 lines) ----------
# Copyright(c) 2017, Dimitar Venkov
# @5devene, dimitar.ven@gmail.com
# www.badmonkeys.net

from operator import lt, gt
from sys import maxsize

def tolist(x):
	if hasattr(x,'__iter__'): return x
	else : return [x]

geom = tolist(IN[0])
other = tolist(IN[1])
isClosest = IN[2]

_fn = lt if isClosest else gt
_base = maxsize if isClosest else -maxsize
inds, dists = [], []
OUT = inds, dists

for g in geom:
	d = _base
	ind, i = 0, 0
	for o in other:
		d1 = g.DistanceTo(o)
		if _fn(d1, d):
			d = d1
			ind = i
		i += 1
	inds.append(ind)
	dists.append(d)
# ----------------------------------------
code_block = CodeBlock(r=python_script) { r[0]; r[1]; }
index = Output(code_block.out0)
distance = Output(code_block.out1)
