# Dynamo custom node Geometry.WriteTag.dyf "ꟿ Geometry.WriteTag" (Dynamo 2.0.2.6826)
# category: Springs.Geometry.Actions
# Design script geometry can store a <string, object> dictionary for the duration of the active graph. You can store a name/value pair and retrieve it further down the graph.

geometry = Input(geometry: var)
tagName = Input(tagName: string)
value = Input(value: var)
override = Input(override: bool = true)
python_script = Python(IN[0]=geometry, IN[1]=tagName, IN[2]=value, IN[3]=override)
# ---------- python_script.python (9 lines) ----------
geo, par, val,override = IN
setPreviously = False
try:
	tags = geo.Tags
	if tags.LookupTag(par) is None or override:
		tags.AddTag(par, val)
except ValueError:
	setPreviously = True
OUT = IN[0], setPreviously
# ----------------------------------------
code_block = CodeBlock(r=python_script) { r[0]; r[1]; }
geometry_2 = Output(code_block.out0)  # "geometry"
setPreviously = Output(code_block.out1)
