# Dynamo custom node List.ItemAtIndex+.dyf "ꟿ List.ItemAtIndex+" (Dynamo 2.0.2.6826)
# category: Springs.Actions
# Identical to the built in node but works with negative indices

list = Input(list: var[]..[])
index = Input(index: var[])
code_block = CodeBlock(items=list, idx=index) { items[idx]; }
item = Output(code_block)
