# Dynamo custom node List.NullSetDifference.dyf "ꟿ List.NullSetDifference" (Dynamo 2.0.2.6826)
# category: Springs.Actions
# Similar to the built in node, with a built-in safety for null values. Part of the SmartCopyMonitor workflow.

list1 = Input(list1: var[])
list2 = Input(list2: var[])
code_block = CodeBlock(newl=list1, oldl=list2)
# ---------- code_block.designscript (12 lines) ----------
newl;
oldl;
res = [Imperative]{
if (oldl != null)
{
	return = SetDifference(newl, oldl);
}
else
{
	return = newl;
}
};
# ----------------------------------------
list = Output(code_block.out2)
