# Dynamo custom node Mesh.ToToolkitMesh.dyf "ꟿ Mesh.ToTkMesh" (Dynamo 2.0.2.6826)
# category: Springs.Geometry.Actions
# Converts a Dynamo mesh to a toolkit mesh. You obviously need to have the appropriate version of the mesh toolkit package downloaded first.

mesh = Input(mesh: var)
code_block = CodeBlock(m1=mesh)
# ---------- code_block.designscript (4 lines) ----------
vp = m1.VertexPositions;
fi = m1.FaceIndices;
fi2 = Flatten(DSCore.List.Transpose([fi.A,fi.B,fi.C]));
tkMesh = Dynamo.Mesh.ByVerticesAndIndices(vp,fi2);
# ----------------------------------------
tkMesh = Output(code_block.tkMesh)
