# Dynamo custom node PolyCurve.ArcChamfer.dyf "ꟿ PolyCurve.ArcChamfer" (Dynamo 2.0.2.6826)
# category: Springs.Geometry.Actions
# Symmetrically chamfers the corners of the polycurve by the designated distance and close with tangent arcs.

polycurve = Input(polycurve: var)
distance = Input(distance: var)
flip = Input(flip: bool = false)
code_block = CodeBlock(pc=polycurve, d1=distance, flip=flip)
# ---------- code_block.designscript (19 lines) ----------
c = pc.Curves();
isClosed = pc.IsClosed;
d2 = c.Length - d1;
spt = c.PointAtSegmentLength(d1);
spar = c.ParameterAtPoint(spt);
ept = c.PointAtSegmentLength(d2);
epar = c.ParameterAtPoint(ept);
spar[0] = isClosed ? spar[0] : 0;
epar[-1] = isClosed ? epar[-1] : 1;
c1 = c.TrimByParameter(spar, epar);
pt2 = DSCore.List.ShiftIndices(ept, 1);
v0 = c1.TangentAtParameter(0);
v1 = flip ? v0.Reverse() : v0;
c2 = Arc.ByStartPointEndPointStartTangent(
  spt, pt2, v1);
drop = isClosed ? 0 : 1;
c2f = DSCore.List.DropItems(c2, drop);
c3 = PolyCurve.ByJoinedCurves(
  Flatten(List.Transpose([c1, c2f]) ) );
# ----------------------------------------
polycurve_2 = Output(code_block.c3)  # "polycurve"
