# Dynamo custom node RevitLinkType.IsLoaded.dyf "ꟿ RevitLinkType.IsLoaded" (Dynamo 2.0.3.8810)
# category: Springs.Revit.Query
# Checks if a rvt link is loaded

linkType = Input(linkType: var[])
isLoaded = Python(IN[0]=linkType)  # "RvtLinkType.IsLoaded"
# ---------- isLoaded.python (15 lines) ----------
import clr

clr.AddReference('RevitServices')
from RevitServices.Persistence import DocumentManager
doc = DocumentManager.Instance.CurrentDBDocument

clr.AddReference('RevitAPI')
import Autodesk.Revit.DB as DB

def tolist(x):
    if hasattr(x,'__iter__'): return x
    return [x]

links = tolist(UnwrapElement(IN[0]))
OUT = [DB.RevitLinkType.IsLoaded(doc, x.Id) for x in links]
# ----------------------------------------
bool = Output(isLoaded)
