# Dynamo custom node SelectLinkedElement.dyf "ꟿ SelectLinkedElement" (Dynamo 2.0.2.6826)
# category: Springs.Revit.Selection.Actions
# Select the linked instance first, followed by the element. If your selection fails, just press escape.
# To refresh the node, connect a boolean switch node.

refresh = Input(refresh: bool = true)
python_script = Python(IN[0]=refresh)
# ---------- python_script.python (31 lines) ----------
# Copyright(c) 2019, Dimitar Venkov
# @5devene, dimitar.ven@gmail.com
# www.badmonkeys.net

import clr

clr.AddReference("RevitAPIUI")
from Autodesk.Revit.UI import Selection

clr.AddReference("RevitAPI")
from Autodesk.Revit.DB import RevitLinkInstance, Transform 

clr.AddReference("RevitServices")
import RevitServices
from RevitServices.Persistence import DocumentManager
doc = DocumentManager.Instance.CurrentDBDocument
uidoc = DocumentManager.Instance.CurrentUIApplication.ActiveUIDocument

clr.AddReference("RevitNodes")
import Revit
clr.ImportExtensions(Revit.Elements)
clr.ImportExtensions(Revit.GeometryConversion)

sel1 = uidoc.Selection
ot = Selection.ObjectType.LinkedElement
el_ref = sel1.PickObject(ot, "Pick a linked element.")
linkInst = doc.GetElement(el_ref.ElementId)
linkDoc = linkInst.GetLinkDocument()
linkEl = linkDoc.GetElement(el_ref.LinkedElementId).ToDSType(1)
tf1 = linkInst.GetTotalTransform().ToCoordinateSystem(1)
OUT = linkEl, tf1
# ----------------------------------------
code_block = CodeBlock(r=python_script) { r[0]; r[1]; }
element = Output(code_block.out0)
transform = Output(code_block.out1)
