# Dynamo custom node String.ToLine.dyf "ꟿ String.ToLine" (Dynamo 2.0.2.6826)
# category: Springs.Geometry.Serialization.Actions
# De-serilize a Revit parameter string into a geometric line.

str = Input(str: var)
separator = Input(separator: string = ",")
code_block = CodeBlock(par=str, s1=separator)
# ---------- code_block.designscript (6 lines) ----------
par;
s1;
par1 = String.ToNumber(String.Split(par, s1));
p1 = Point.ByCoordinates(par1[0],par1[1],par1[2]);
p2 = Point.ByCoordinates(par1[3],par1[4],par1[5]);
ln = Line.ByStartPointEndPoint(p1,p2);
# ----------------------------------------
line = Output(code_block.ln)
