# Dynamo custom node TkMesh.ToMesh.dyf "ꟿ TkMesh.ToMesh" (Dynamo 2.0.2.6826)
# category: Springs.Geometry.Actions
# Attempts to convert a toolkit mesh to a Dynamo mesh. You obviously need to have the appropriate version of the mesh toolkit package downloaded first.

tkMesh = Input(tkMesh: var)
code_block = CodeBlock(m1=tkMesh)
# ---------- code_block.designscript (5 lines) ----------
vp = m1.Vertices();
fi = m1.VertexIndicesByTri();
fi2 = DSCore.List.Transpose(List.Chop(fi,3) );
fi3 = IndexGroup.ByIndices(fi2[0], fi2[1], fi2[2]);
dsMesh = DesignScript.Mesh.ByPointsFaceIndices(vp,fi3);
# ----------------------------------------
mesh = Output(code_block.dsMesh)
