# Dynamo custom node Utility.GetData.dyf "ꟿ Utility.GetData" (Dynamo 2.0.2.6826)
# category: Springs.Query
# Using the application's app domain, this node will try to fetch any data stored under the specified name. You'll need to first store the data with the `Utility.SetData` node.

key = Input(key: string)
refresh = Input(refresh: bool = true)
python_script = Python(IN[0]=key, IN[1]=refresh)
# ---------- python_script.python (4 lines) ----------
import System

dataKey, _ = IN
OUT = System.AppDomain.CurrentDomain.GetData("_Dyn_Wireless_%s" % dataKey)
# ----------------------------------------
data = Output(python_script)
