# Dynamo custom node Voronoi2D.ByPoints.dyf "ꟿ Voronoi2D.ByPoints" (Dynamo 2.0.2.6826)
# category: Springs.Geometry.Create
# Create a voronoi tessellation of a set of planar points. The cell lines will be culled to the bounding extent of the points.

points = Input(points: var[])
code_block = CodeBlock(pts=points)
# ---------- code_block.designscript (20 lines) ----------
bb = BoundingBox.ByGeometry(pts);
a0 = bb.MinPoint;
b0 = bb.MaxPoint;
x = a0.DistanceTo(b0) * 0.1;
v1 = Autodesk.Vector.ByCoordinates(x, x, 0);
a = a0.Subtract(v1);
b = b0.Add(v1);
f1 = Autodesk.Surface.ByPerimeterPoints([
  Point.ByCoordinates(a.X, a.Y),
  Point.ByCoordinates(b.X, a.Y),
  Point.ByCoordinates(b.X, b.Y),
  Point.ByCoordinates(a.X, b.Y)]);
uv1 = f1.UVParameterAtPoint(pts);
ln0 = Voronoi.ByParametersOnSurface(uv1, f1);
mask = ln0.StartPoint.DoesIntersect(f1) &&
  ln0.EndPoint.DoesIntersect(f1);
ln1 = List.FilterByBoolMask(ln0, mask)["in"];
ln2 = Flatten(List.FilterByBoolMask(ln0, mask)["out"].
  Intersect(f1) );
List.Join([ln1, ln2]);
# ----------------------------------------
lines = Output(code_block.out13)
