# Dynamo graph generators2.dyn (Dynamo 2.14.0.4641)

# group: Variables / Inputs
width = DoubleSlider(15, range=0..100 step 0.1)
length = DoubleSlider(30, range=0..100 step 0.1)
height = DoubleSlider(58, range=0..100 step 0.1)

# group: Generator
byLengths = Cuboid.ByLengths(width=width, length=length, height=height)

# group: General
color_palette = ColorPalette({R: 0, G: 255, B: 255, A: 255})
byGeometryColor = Modifiers.GeometryColor.ByGeometryColor(geometry=byLengths, color=color_palette)
explode = Geometry.Explode(geometry=byLengths)

# group: Checking / Outputs
area = Surface.Area(surface=explode)
sum = Math.Sum()  # unwired: values
volume = Solid.Volume(solid=byLengths)
