# Dynamo graph remembernodeinputs1.dyn (Dynamo 2.13.1.3887)
# packages: GenerativeDesign 2.0.10.0

categories = Categories("OST_Walls")
all_elements_of_category = ElementsOfCategory(Category=categories)
geometry = Element.Geometry(element=all_elements_of_category)
flatten = List.Flatten(list=geometry)
watch = Watch(flatten)
remember = Data.Remember(watch)
select_model_element = DSModelElementSelection()  # 1 picked in the model
code_block = CodeBlock { "Head Height"; }
getParameterValueByName = Element.GetParameterValueByName(element=select_model_element, parameterName=code_block)
watch_2 = Watch(getParameterValueByName)
remember_2 = Data.Remember(watch_2)
categories_2 = Categories("OST_Walls")
all_elements_of_category_2 = ElementsOfCategory(Category=categories_2)
code_block_2 = CodeBlock { "Area"; }
getParameterValueByName_2 = Element.GetParameterValueByName(element=all_elements_of_category_2, parameterName=code_block_2)
flatten_2 = List.Flatten(list=getParameterValueByName_2)
watch_3 = Watch(flatten_2)
remember_3 = Data.Remember(watch_3)
