# Dynamo graph remembernodeinputs2.dyn (Dynamo 2.13.1.3887)
# packages: GenerativeDesign 2.0.10.0

categories = Categories("OST_Sheets")
all_elements_of_category = ElementsOfCategory(Category=categories)
flatten = List.Flatten(list=all_elements_of_category)
watch = Watch(flatten)
remember = Data.Remember(watch)
select_model_element = DSModelElementSelection()  # 1 picked in the model
code_block = CodeBlock { "Level"; }
getParameterValueByName = Element.GetParameterValueByName(element=select_model_element, parameterName=code_block)
watch_2 = Watch(getParameterValueByName)
remember_2 = Data.Remember(watch_2)
categories_2 = Categories("OST_StructuralColumns")
all_elements_of_category_2 = ElementsOfCategory(Category=categories_2)
code_block_2 = CodeBlock { "Structural Material"; }
getParameterValueByName_2 = Element.GetParameterValueByName(element=all_elements_of_category_2, parameterName=code_block_2)
flatten_2 = List.Flatten(list=getParameterValueByName_2)
watch_3 = Watch(flatten_2)
remember_3 = Data.Remember(watch_3)
