# Dynamo graph testrevit1.dyn (Dynamo 2.13.1.3887)
# packages: GenerativeDesign 2.0.10.0

# group: Revit Selection Nodes
categories = Categories("OST_Rooms")
all_elements_of_category = ElementsOfCategory(Category=categories)

# group: Room Geometry
geometry = Element.Geometry(element=all_elements_of_category)
flatten = List.Flatten(list=geometry)
remember = Data.Remember(flatten)

# group: Display / Validation
color_palette = ColorPalette({R: 135, G: 206, B: 250, A: 150})
byGeometryColor = Modifiers.GeometryColor.ByGeometryColor(geometry=remember, color=color_palette)

# group: Room Data
number = Room.Number(room=all_elements_of_category)
remember_2 = Data.Remember(number)
name = Room.Name(room=all_elements_of_category)
remember_3 = Data.Remember(name)
