# Dynamo graph spaceAnalysis-CreateSimpleSpaceLattice.dyn (Dynamo 2.10.0.3455)
# packages: SpaceAnalysis 0.3.3

# group: Defining barriers for the space lattice
number_slider = DoubleSlider(3, range=0..100 step 0.1)
number_slider_2 = DoubleSlider(3, range=0..100 step 0.1)
byCoordinates = Point.ByCoordinates(x=number_slider, y=number_slider_2)
byOrigin = CoordinateSystem.ByOrigin(origin=byCoordinates)
byWidthLength = Rectangle.ByWidthLength(cs=byOrigin)
explode = Geometry.Explode(geometry=byWidthLength)

# group: just for display
color_palette = ColorPalette({R: 255, G: 0, B: 0, A: 255})
byGeometryColor = Modifiers.GeometryColor.ByGeometryColor(geometry=explode, color=color_palette)

# group: Space Lattice bounding box
number_slider_3 = DoubleSlider(4.6, range=1..100 step 0.1)
byCoordinates_2 = Point.ByCoordinates(x=number_slider_3, y=number_slider_3)
byCorners = BoundingBox.ByCorners(max=byCoordinates_2)

# group: Build our space lattice and see the edges in dynamo
# note: Custom Package: SpaceAnalysis v.0.3.3
byBoundingBoxAndLines = Core.SpaceLattice.ByBoundingBoxAndLines(boundingBox=byCorners, barriers=explode)
edges = Core.SpaceLattice.Edges(spaceLattice=byBoundingBoxAndLines)

# group: just for display
color_palette_2 = ColorPalette({R: 50, G: 205, B: 50, A: 255})
byGeometryColor_2 = Modifiers.GeometryColor.ByGeometryColor(geometry=edges, color=color_palette_2)
