# Dynamo graph dynamo1.dyn (Dynamo 2.14.0.4641)

number = DoubleInput(0)
number_2 = DoubleInput(0)
byCoordinates = Point.ByCoordinates(x=number, y=number_2)
number_slider = DoubleSlider(5.6, range=0..100 step 0.1)
number_slider_2 = DoubleSlider(11.5, range=0..100 step 0.1)
byCoordinates_2 = Point.ByCoordinates(x=number_slider, y=number_slider_2)
distanceTo = Geometry.DistanceTo(geometry=byCoordinates, other=byCoordinates_2)
byCenterPointRadius = Circle.ByCenterPointRadius(centerPoint=byCoordinates, radius=distanceTo)
