# Dynamo graph _generative_template_2.13.dyn (Dynamo 2.13.1.3887)

# group: Checking / Outputs
# note: Orange indicates checking nodes to ensure the script has deployed correctly.

# group: Graph Title
# note: ADDITIONAL COMMENTS
# note: REQUIRED DYNAMO PACKAGES
# note: DYNAMO VERSION
# note: DYNAMO PROJECT
# note: ASSOCIATED FILE(S)
# N/A
# note: AUTHOR(S) / CREATION DATE
# note: DESCRIPTION

# group: Working / Functions
# note: Core Workings of the Dynamo Graph

# group: Variables / Inputs
# note: Variables that can be altered per project and must be set accordingly before running the graph.

# group: Display / Validation
# note: Logic used simply for visualization purposes, does not contain core logic.

# group: Remember / Gate Nodes
# note: Data that needs to be cached from Dynamo for Revit is stored here.

# group: Variables / Inputs
# note: These are examples inputs. They are set as inputs by right clicking on them and selecting, "IsInput".
# We also assign a default starting value, and a start and stop range, with increments.
width = DoubleSlider(10, range=10..100 step 0.1)  # graph input
length = DoubleSlider(20, range=20..100 step 0.1)  # graph input
height = DoubleSlider(15, range=15..100 step 0.1)  # graph input

# group: Working / Functions
# note: This is the core logic of our graph. Notice how the node is half-toned. This is because we are hiding the geometry for this in favor of displaying it other ways.
byLengths = Cuboid.ByLengths(width=width, length=length, height=height)

# group: Display/Validation
# note: In this section, we are using the nodes purely for viewport display purposes.
color_palette = ColorPalette({R: 32, G: 178, B: 170, A: 255})
byGeometryColor = Modifiers.GeometryColor.ByGeometryColor(geometry=byLengths, color=color_palette)

# group: Checking
# note: This portion is interesting because it could fit in either:
# The green groups for working and functions as it is doing some of the work.
# or:
# Orange for verifying what is going on. The important part is to remember to annotate your graph clearly regardless of color.
volume = Solid.Volume(solid=byLengths)

# group: Output
# note: Using a watch node, we are able to provide an output for Generative Design. This is enabled by:
# 1) Renaming the node.
# 2) Right-Clicking and enabling, "IsOutput"
volume_of_solid = Watch(volume)  # graph output
